# Grasshopper definition Kybele_Library_Setup.gh (Grasshopper 1.0.8)

image_sampler = ImageSampler(
    FilePath="C:\Kybele_GreenHouse_v1\Kybele_Logo1.png",
    Filter="Colour",
    Interpolate=False,
    Umax=1,
    Umin=0,
    Vmax=1,
    Vmin=0,
    Wrap=1)
# Optional
# Run this component when you have a custom library of .rad files. It will convert all .rad files into clean .mat files and copy them to
# C:\Users\<username>\AppData\Roaming\ladybug_tools\standards\modifiers.
# Specify the input folder and output folder
# input folder: The custom folder path containing the .rad files
# output folder: The specific ladybug modifiers folder. Ususally the modifier folder path is: users\AppData\Roaming\ladybug_tools\
# standards\modifiers
# 4. Restart Rhino and Grasshopper!
panel = Panel("C:\Users\inanici\AppData\Roaming\ladybug_tools\standards\modifiers")
# 2. Radiance
# a. Download and install Radiance
# Download and install the latest Radiance Windows build (standard installer) from https://www.radiance-online.org/download-install
# Default installation folder (recommended):
# C:\Radiance\
# After install, you should have folders:
# C:\Radiance\bin\
# C:\Radiance\lib\
# b. Place the Radiance folder paths in User Environment
# Open Windows Start Menu,  Type “environment variables”  and open the "Edit the system environment variables" panel,
# Open "Environment Variables"  panel to set the radiance folder paths in PATH and RAYPATH
# Add or Update "C:\Radiance\bin" in PATH and "C:\Radiance\lib" in RAYPATH
# 3. Run!
# Run this component to copy the Kybele materials folders—RadMaterials, RadGlazing, and RadIES—to the root of drive C
# (C:\). It will also copy the matFiles folder to C:\Users\<username>\AppData\Roaming\ladybug_tools\standards\modifiers.
boolean_toggle = BooleanToggle(False)
# Version 1.0, May 2026
# Lighting Module
# 1. Ladybug and Honeybee
# Download and install ladybug 1.8.0 version or above from https://www.food4rhino.com/en/app/ladybug-tools
panel_2 = Panel("C:\Kybele_GreenHouse_v1\Kybele_Library_Small")
python_3_script = Python3Script(custom_folder="C:\AllRadiance_Mat", out_folder=panel, sub_folder=Toggle(False), run=Toggle(False))  # -> out, made, skipped, errors
# ---------- python_3_script: Python ----------
ghenv.Component.Message = 'Kybele 1.0.0 .mat Converter'

import os
from pathlib import Path

made, skipped, errors = [], [], []



def clean_rad_to_mat_text(txt):
    """Remove comment lines (starting with '#', ignoring leading spaces) and blank lines."""
    out_lines = []
    for line in txt.splitlines():
        s = line.strip()
        if not s:
            continue
        if s.startswith("#"):
            continue
        out_lines.append(s)
    return "\n".join(out_lines) + ("\n" if out_lines else "")



def all_rad_files(root, sub_folder=False):
    rootp = Path(root)
    if sub_folder:
        for p in rootp.rglob("*.rad"):
            if p.is_file():
                yield p
    else:
        for p in rootp.glob("*.rad"):
            if p.is_file():
                yield p



def write_text(path, text):
    path.parent.mkdir(parents=True, exist_ok=True)
    with open(str(path), "w", encoding="utf-8", newline="\n") as f:
        f.write(text)



if run:
    try:
        src_root = Path(str(custom_folder or "")).resolve()
        if not src_root.exists():
            errors.append("Source folder not found: {}".format(src_root))
        else:
            dst_root = Path(str(out_folder).strip()) if out_folder else src_root
            dst_root = dst_root.resolve()

            count = 0
            for rad_path in all_rad_files(src_root, sub_folder=bool(sub_folder)):
                try:
                    raw = rad_path.read_text(encoding="utf-8", errors="ignore")
                    cleaned = clean_rad_to_mat_text(raw)

                    if not cleaned.strip():
                        skipped.append("Empty after cleaning → {}".format(rad_path))
                        continue

                    mat_path = dst_root / (rad_path.stem + ".mat")
                    write_text(mat_path, cleaned)
                    made.append(str(mat_path))
                    count += 1
                except Exception as e:
                    errors.append("Failed: {} | {}".format(rad_path, e))

            if not (made or skipped or errors):
                skipped.append("No .rad files found in '{}' (sub_folder={})".format(src_root, bool(sub_folder)))
    except Exception as e:
        errors.append(str(e))
else:
    skipped.append("Set run=True to process files.")
# ---------- end python_3_script ----------
python_3_script_2 = Python3Script(lib_folder=panel_2, run=boolean_toggle)  # -> out, logs; inputs run: Boolean
#   port lib_folder: Filepath of the root folder of Kybele Materials
# ---------- python_3_script_2: Python ----------
ghenv.Component.Message = 'Kybele 1.0.0 File Setup'



import os, shutil, getpass
from pathlib import Path

logs = []
ok = False



def msg(s):
    logs.append(s)



def ensure_dir(p):
    Path(p).mkdir(parents=True, exist_ok=True)



def copy_dir_recursive(src, dst):
    """
    directory copy - works if dst exists.
    Copies files & subfolders; preserves timestamps where possible.
    Returns (copied_files_count, errors)
    """
    copied = 0
    errors = []
    ensure_dir(dst)
    for root, dirs, files in os.walk(src):
        rel = os.path.relpath(root, src)
        target_root = os.path.join(dst, rel) if rel != "." else dst
        ensure_dir(target_root)
        for d in dirs:
            ensure_dir(os.path.join(target_root, d))
        for f in files:
            s = os.path.join(root, f)
            d = os.path.join(target_root, f)
            try:
                shutil.copy2(s, d)
                copied += 1
            except Exception as e:
                errors.append(f"Copy failed: {s} -> {d} | {e}")
    return copied, errors



def find_modifiers_folder():
    """
    Resolve Ladybug Tools user modifiers folder.
    Preference (LBT 1.x):
      %APPDATA%\ladybug_tools\standards\honeybee_standards\radiance\modifiers
    Fallback:
      %APPDATA%\ladybug_tools\standards\modifiers
    If neither exists, create the preferred one.
    """
    appdata = os.getenv("APPDATA")
    root = os.getenv("LBT_USER_FOLDER") or os.path.join(appdata, "ladybug_tools")
    preferred = os.path.join(root, "standards", "honeybee_standards", "radiance", "modifiers")
    fallback  = os.path.join(root, "standards", "modifiers")

    if os.path.isdir(preferred):
        return preferred
    if os.path.isdir(fallback):
        return fallback

    ensure_dir(preferred)
    return preferred



def copy_mat_files(mat_src, modifiers_dst):
    """
    Copy only *.mat files from mat_src (non-recursive) to modifiers_dst.
    Returns (count, errors)
    """
    ensure_dir(modifiers_dst)
    count = 0
    errors = []
    for name in os.listdir(mat_src):
        if name.lower().endswith(".mat"):
            s = os.path.join(mat_src, name)
            d = os.path.join(modifiers_dst, name)
            try:
                shutil.copy2(s, d)
                count += 1
            except Exception as e:
                errors.append(f"Copy failed: {s} -> {d} | {e}")
    return count, errors

if run:
    ok = True


    root = Path(str(lib_folder or "")).resolve()
    subs = {
        "RadMaterials": root / "RadMaterials",
        "matFiles":     root / "matFiles",
        "RadIES":       root / "RadIES",
        "RadGlazing":   root / "RadGlazing",
    }
    missing = [k for k, p in subs.items() if not p.exists()]
    if missing:
        ok = False
        msg(f"ERROR: Missing subfolder(s) inside '{root}': {', '.join(missing)}")
    else:
        dest_rad = Path("C:/RadMaterials")
        try:
            copied, errs = copy_dir_recursive(str(subs["RadMaterials"]), str(dest_rad))
            if errs:
                ok = False
                msg(f"RadMaterials: copied {copied}, with {len(errs)} error(s).")
                logs.extend(errs)
            else:
                msg(f"RadMaterials: copied {copied} file(s) to '{dest_rad}'.")
        except Exception as e:
            ok = False
            msg(f"ERROR copying RadMaterials -> '{dest_rad}': {e}")



        # Copy RadIES to C:\RadIES
        dest_ies = Path("C:/RadIES")
        try:
            copied, errs = copy_dir_recursive(str(subs["RadIES"]), str(dest_ies))
            if errs:
                ok = False
                msg(f"RadIES: copied {copied}, with {len(errs)} error(s).")
                logs.extend(errs)
            else:
                msg(f"RadIES: copied {copied} file(s) to '{dest_ies}'.")
        except Exception as e:
            ok = False
            msg(f"ERROR copying RadIES -> '{dest_ies}': {e}")



        # Copy RadGlazing to C:\RadGlazing
        dest_glz = Path("C:/RadGlazing")
        try:
            copied, errs = copy_dir_recursive(str(subs["RadGlazing"]), str(dest_glz))
            if errs:
                ok = False
                msg(f"RadGlazing: copied {copied}, with {len(errs)} error(s).")
                logs.extend(errs)
            else:
                msg(f"RadGlazing: copied {copied} file(s) to '{dest_glz}'.")
        except Exception as e:
            ok = False
            msg(f"ERROR copying RadGlazing -> '{dest_glz}': {e}")



        # Copy .mat from matFiles to LB modifiers folder
        try:
            modifiers_dst = Path(find_modifiers_folder())
            count, errs = copy_mat_files(str(subs["matFiles"]), str(modifiers_dst))
            if errs:
                ok = False
                msg(f"matFiles: copied {count} *.mat file(s) to '{modifiers_dst}' with {len(errs)} error(s).")
                logs.extend(errs)
            else:
                msg(f"matFiles: copied {count} *.mat file(s) to '{modifiers_dst}'.")
        except Exception as e:
            ok = False
            msg(f"ERROR copying matFiles -> modifiers folder: {e}")

    # Permissions failed errors on C:\
    if any(("ERROR copying RadMaterials" in m or "ERROR copying RadIES" in m or "ERROR copying RadGlazing" in m) for m in logs):
        msg("Hint: If copying to C:\\* failed, run Rhino as Administrator or choose a folder you have write access to (e.g., C:\\Users\\%USERNAME%\\Documents).")

else:
    logs = ["Set run = True to perform the copy."]
# ---------- end python_3_script_2 ----------
panel_3 = Panel(python_3_script.made)
panel_4 = Panel(python_3_script_2.logs)
panel_5 = Panel(python_3_script.errors)
