# Grasshopper definition Kybele_Workflow_Master_File_v1_0.gh (Grasshopper 1.0.8)
# plug-ins: LadybugGrasshopper

# Version 1.0, May 2026
# Lighting Module
# Cite as: Inanici M and Islam S. Kybele Green House Simulation Tool, v1.0, Plug-in for Rhino Grasshopper, 2026.
image_sampler = ImageSampler(
    FilePath="C:\Kybele_GreenHouse_v1\Kybele_Logo1.png",
    Filter="Colour",
    Interpolate=False,
    Umax=1,
    Umin=0,
    Vmax=1,
    Vmin=0,
    Wrap=1)

# ----
# Attention!
# Create a new folder for every new simulation.
# Otherwise, it will overwrite!
# Working Folder
# Simulation name
boolean_toggle = BooleanToggle(True)
# Hyperspectral simulation workflow will be released soon.
boolean_toggle_2 = BooleanToggle(True)
python_3_script = Python3Script(
    root_folder="C:\Kybele_GreenHouse_v1\Results",
    write_folder=boolean_toggle,
    point_in_time_illuminance=boolean_toggle_2,
    point_in_time_render=boolean_toggle_2,
    annual_illuminance=boolean_toggle_2,
    electric_illuminance=boolean_toggle_2)  # -> out, root_folder, PIT_ill_folder, PIT_render_folder, ann_ill_folder, electric_ill_folder, spec_PIT_folder, spec_PIT_ren_folder, spec_ann_ill_folder; inputs root_folder: String
# ---------- python_3_script: Python ----------
import os


if not _root_folder:
    raise ValueError("Root folder path is empty.")


if not os.path.exists(_root_folder):
    os.makedirs(_root_folder)

_root_folder_out = _root_folder



def ensure_folder(parent, folder_name, toggle):
    if not toggle:
        return None

    path = os.path.join(parent, folder_name)

    # Create subfolder if missing
    if not os.path.exists(path):
        os.makedirs(path)

    return path



PIT_ill_folder = ensure_folder(
    _root_folder,
    "point_in_time_illuminance",
    _point_in_time_illuminance
)

PIT_render_folder = ensure_folder(
    _root_folder,
    "point_in_time_render",
    _point_in_time_render
)

ann_ill_folder = ensure_folder(
    _root_folder,
    "annual_illuminance",
    _annual_illuminance
)

electric_ill_folder = ensure_folder(
    _root_folder,
    "electric_illuminance",
    _electric_illuminance
)

spec_PIT_folder = ensure_folder(
    _root_folder,
    "spectral_point_in_time",
    _spectral_point_in_time
)

spec_PIT_ren_folder = ensure_folder(
    _root_folder,
    "spectral_point_in_time_render",
    _spectral_point_in_time_render
)

spec_ann_ill_folder = ensure_folder(
    _root_folder,
    "spectral_annual_illuminance",
    _spectral_annual
)
# ---------- end python_3_script ----------

# ----
# Attention!
# Create a new folder for every new simulation.
# Otherwise, it will overwrite!
# Working Folder- 3 channel (RGB)
panel = Panel(python_3_script.PIT_ill_folder)
panel_2 = Panel(python_3_script.PIT_render_folder)
panel_3 = Panel(python_3_script.ann_ill_folder)
panel_4 = Panel(python_3_script.electric_ill_folder)

# ----
# Radiance Version Check
# Site North
# Define true north direction and align the model
# accordingly for solar positioning.
boolean_toggle_3 = BooleanToggle(True)
construct_point = ConstructPoint(XCoordinate=Slider(11, range=-100..100), YCoordinate=Slider(-6, range=-100..100), ZCoordinate=Slider(1, range=0..1))
python_3_script_2 = Python3Script(radiance=boolean_toggle_3)  # -> version
# ---------- python_3_script_2: Python ----------
ghenv.Component.Message = """Kybele 0.1 Beta 
Radiance Version"""



import subprocess

version = None

if _radiance:
    try:
        result = subprocess.run(["rcontrib", "-version"], capture_output=True, text=True)

        if result.returncode == 0:
            version = result.stdout.strip()
        else:
            version = "Radiance found but version command failed."
    except Exception as e:
        version = f"Error: {str(e)}"
# ---------- end python_3_script_2 ----------
panel_5 = Panel(python_3_script_2)
compass = LBCompass(north=Slider(0, range=-360..360), center=construct_point, scale=Slider(0.02, range=0.01..4))  # -> compass; plug-in component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
custom_preview = CustomPreview(Geometry=compass, Material=ColourSwatch(SwatchColor=RGB(61, 61, 61)))

# ----
# Weather Data
# Download and assign the EPW weather file for the simulation
# https://climate.onebuilding.org/#gsc.tab=0
# https://energyplus.net/weather
panel_6 = Panel("C:\Kybele_GreenHouse_v1\Weather\USA_WA_Seattle-Tacoma.Intl.AP.727930_TMYx.2004-2018.epw")
wea = HBWeaFromEPW(epw_file=panel_6)  # -> wea; plug-in component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
panel_7 = Panel(wea)

# ----
# Geometric
# Definitions
# Points determine the
# locations of luminaires
geometry_pipeline = GeometryPipeline(
    GroupByLayer=False,
    GroupByType=False,
    IncludeHidden=True,
    IncludeLocked=True,
    LayerFilter="Glazing",
    NameFilter="*",
    SublayerFiltering=True,
    TypeFilter=1073741848)
geometry_pipeline_2 = GeometryPipeline(
    GroupByLayer=False,
    GroupByType=False,
    IncludeHidden=True,
    IncludeLocked=True,
    LayerFilter="Floor",
    NameFilter="*",
    SublayerFiltering=True,
    TypeFilter=1073741848)
geometry_pipeline_3 = GeometryPipeline(
    GroupByLayer=False,
    GroupByType=False,
    IncludeHidden=True,
    IncludeLocked=True,
    LayerFilter="Surrounding_buildings",
    NameFilter="*",
    SublayerFiltering=True,
    TypeFilter=1073741848)
geometry_pipeline_4 = GeometryPipeline(
    GroupByLayer=False,
    GroupByType=False,
    IncludeHidden=True,
    IncludeLocked=True,
    LayerFilter="Structure",
    NameFilter="*",
    SublayerFiltering=True,
    TypeFilter=1073741848)
point = Point(Point(-7.74268363, -3.059138958, 3))
# 2
number_slider = Slider(6, range=0..30)
geometry_pipeline_5 = GeometryPipeline(
    GroupByLayer=False,
    GroupByType=False,
    IncludeHidden=True,
    IncludeLocked=True,
    LayerFilter="Ground",
    NameFilter="*",
    SublayerFiltering=True,
    TypeFilter=1073741848)
number_slider_2 = Slider(3.05, range=0..10)
series = Series(Start=0, Step=number_slider_2, Count=number_slider)
unit_x = UnitX(Factor=series)
series_2 = Series(Start=0, Step=number_slider_2, Count=Slider(3, range=0..30))
move = Move(Geometry=point, Motion=unit_x)  # -> graft(Geometry), Transform
unit_y = UnitY(Factor=series_2)
move_2 = Move(Geometry=move.Geometry, Motion=unit_y)  # -> Geometry, Transform

# ----
# Materials (Opaque)
# Kybele Material Components
# Materials (Glazing)
# Create material with r,g,b, values.
lb_falsestarttoggle = LBFalseStartToggle(True)
lb_falsestarttoggle_2 = LBFalseStartToggle(True)
lb_falsestarttoggle_3 = LBFalseStartToggle(True)
lb_falsestarttoggle_4 = LBFalseStartToggle(True)
lb_falsestarttoggle_5 = LBFalseStartToggle(True)
python_3_script_3 = Python3Script(run=lb_falsestarttoggle_5)  # -> out, glazing_modifier
# ---------- python_3_script_3: Python ----------
ghenv.Component.Message = """Kybele 0.1 Beta 
Glazing Materials"""


import os, math
import System
import System.Windows.Forms as WinForms
from System.Collections.Generic import List
from System.Windows.Forms import (
    TableLayoutPanel, ColumnStyle, RowStyle, SizeType, DockStyle,
    Padding, FlowDirection, AnchorStyles, DataGridViewSelectionMode
)
from System.Drawing import (
    Size, Point, Color, Font, FontStyle, Bitmap, Imaging, ContentAlignment
)
from System.Windows.Forms import DataGridViewColumnHeadersHeightSizeMode, Padding



glazing_folder = r"C:\RadGlazing"



def name_case_display(material_id):
    return material_id.replace("_", " ").title()



def safe_float(token):
    try:
        return float(token)
    except:
        return None



def fresnel_vlr_percent(n_idx):
    """
    Normal-incidence Fresnel reflectance for uncoated glass (per surface):
        R = ((n-1)/(n+1))^2
    Report as % (one surface/front reflectance).
    """
    R = ((n_idx - 1.0) / (n_idx + 1.0)) ** 2
    return round(100.0 * R, 1)



def parse_glazing_rad(filepath):
    """
    Returns: (row_list, original_name, fullpath)
             row_list = [name, R, G, B, VLT, VLR%, Specularity, Roughness]
    """
    name_from_file = os.path.splitext(os.path.basename(filepath))[0]
    original_name = name_from_file
    mat_type = None

    kept = []
    with open(filepath, 'r') as f:
        for line in f:
            s = line.strip()
            if not s or s.startswith('#'):
                continue
            kept.append(s)



    for line in kept:
        if line.startswith("void"):
            parts = line.split()
            if len(parts) >= 3:
                mat_type = parts[1].lower()
                original_name = parts[2]
            break




    floats = []
    for line in kept:
        for tok in line.split():
            val = safe_float(tok)
            if val is not None:
                floats.append(val)



    r = g = b = 0.0
    n_idx = 1.52
    specularity = 0.00
    roughness = 0.00

    if len(floats) >= 3:
        r, g, b = floats[0], floats[1], floats[2]

    if mat_type == 'glass' and len(floats) >= 4 and 1.2 <= floats[3] <= 2.2:
        n_idx = floats[3]

    if mat_type == 'trans':
        if len(floats) >= 4:
            specularity = max(0.0, min(1.0, floats[3]))
        if len(floats) >= 5:
            roughness = max(0.0, min(1.0, floats[4]))

    vlt = round((0.265 * r) + (0.670 * g) + (0.065 * b), 1)
    vlr_pct = fresnel_vlr_percent(n_idx)

    row = [
        original_name,
        f"{r:.3f}", f"{g:.3f}", f"{b:.3f}",
        f"{vlt}", f"{vlr_pct}",
        f"{specularity:.2f}", f"{roughness:.2f}"
    ]
    return row, original_name, filepath


def load_glazing_rows():
    rows = []
    for filename in os.listdir(glazing_folder):
        if filename.lower().endswith(".rad"):
            fp = os.path.join(glazing_folder, filename)
            rows.append(parse_glazing_rad(fp))
    rows.sort(key=lambda t: (t[0][0][0].isdigit(), t[0][0].lower()))
    return rows




columns = ["Glazing", "R", "G", "B", "VLT", "VLR%", "Specularity", "Roughness"]

def show_glazing_selector():
    selected_name = [None]
    reload_flag = [True]

    while reload_flag[0]:
        reload_flag[0] = False

        form = WinForms.Form()
        form.Text = "Kybele Radiance Glazing"
        form.Size = System.Drawing.Size(1500, 850)
        form.StartPosition = WinForms.FormStartPosition.CenterScreen

        layout = WinForms.TableLayoutPanel()
        layout.Dock = WinForms.DockStyle.Fill
        layout.RowCount = 3
        layout.ColumnCount = 1
        layout.RowStyles.Add(WinForms.RowStyle(WinForms.SizeType.Absolute, 300))
        layout.RowStyles.Add(WinForms.RowStyle(WinForms.SizeType.Percent, 100))
        layout.RowStyles.Add(WinForms.RowStyle(WinForms.SizeType.Absolute, 40))
        layout.BackColor = System.Drawing.Color.White

        topPanel = WinForms.TableLayoutPanel()
        topPanel.Dock = WinForms.DockStyle.Fill
        topPanel.ColumnCount = 2
        topPanel.RowCount = 2
        topPanel.ColumnStyles.Add(WinForms.ColumnStyle(WinForms.SizeType.Absolute, 300))
        topPanel.ColumnStyles.Add(WinForms.ColumnStyle(WinForms.SizeType.Percent, 100))
        topPanel.RowStyles.Add(WinForms.RowStyle(WinForms.SizeType.Percent, 80))
        topPanel.RowStyles.Add(WinForms.RowStyle(WinForms.SizeType.Percent, 20))
        topPanel.BackColor = System.Drawing.Color.White

        nameLabel = WinForms.Label()
        nameLabel.Text = "Select a glazing!"
        nameLabel.Dock = WinForms.DockStyle.Fill
        nameLabel.TextAlign = System.Drawing.ContentAlignment.BottomLeft
        nameLabel.Font = System.Drawing.Font("Segoe UI", 20, System.Drawing.FontStyle.Bold)
        topPanel.Controls.Add(nameLabel, 1, 0)

        infoLabel = WinForms.Label()
        infoLabel.Text = "RGB(0.00, 0.00, 0.00) | VLT: 0.0% | VLR: 0.0%"
        infoLabel.Dock = WinForms.DockStyle.Fill
        infoLabel.TextAlign = System.Drawing.ContentAlignment.TopLeft
        infoLabel.Font = System.Drawing.Font("Segoe UI", 10)
        topPanel.Controls.Add(infoLabel, 1, 1)

        imageBox = WinForms.PictureBox()
        imageBox.SizeMode = WinForms.PictureBoxSizeMode.Zoom
        imageBox.Dock = WinForms.DockStyle.Fill
        imageBox.BackColor = System.Drawing.Color.White
        topPanel.Controls.Add(imageBox, 0, 0)

        grid = WinForms.DataGridView()
        grid.Dock = WinForms.DockStyle.Fill
        grid.ReadOnly = True
        grid.SelectionMode = WinForms.DataGridViewSelectionMode.FullRowSelect
        grid.AllowUserToAddRows = False
        grid.AllowUserToResizeRows = False
        grid.RowHeadersVisible = False
        grid.AutoSizeColumnsMode = WinForms.DataGridViewAutoSizeColumnsMode.Fill
        grid.BackgroundColor = System.Drawing.Color.White
        grid.ColumnHeadersDefaultCellStyle.Font = System.Drawing.Font("Segoe UI", 10, System.Drawing.FontStyle.Bold)
        grid.ColumnHeadersHeightSizeMode = DataGridViewColumnHeadersHeightSizeMode.EnableResizing
        grid.ColumnHeadersHeight = 40
        grid.CellBorderStyle = WinForms.DataGridViewCellBorderStyle.SingleHorizontal
        grid.GridColor = System.Drawing.Color.LightGray

        for col in columns:
            grid.Columns.Add(col, col)

        glazing_rows = load_glazing_rows()
        for row_list, original_name, fullpath in glazing_rows:
            display_row = row_list[:]
            display_row[0] = name_case_display(row_list[0])
            idx = grid.Rows.Add(display_row)
            grid.Rows[idx].Tag = (original_name, fullpath)

        grid.Columns[0].Width = 80



        def on_select(sender, args):
            if grid.SelectedRows.Count > 0:
                original_name, fullpath = grid.SelectedRows[0].Tag
                selected_name[0] = original_name
                form.Close()

        def on_reload(sender, args):
            reload_flag[0] = True
            form.Close()

        buttonPanel = TableLayoutPanel()
        buttonPanel.Dock = DockStyle.Fill
        buttonPanel.RowCount = 1
        buttonPanel.ColumnCount = 3
        buttonPanel.RowStyles.Add(RowStyle(SizeType.Percent, 100))
        buttonPanel.ColumnStyles.Add(ColumnStyle(SizeType.Percent, 80))
        buttonPanel.ColumnStyles.Add(ColumnStyle(SizeType.Absolute, 1))
        buttonPanel.ColumnStyles.Add(ColumnStyle(SizeType.Percent, 20))
        buttonPanel.Padding = Padding(8, 6, 8, 6)

        selectBtn = WinForms.Button()
        selectBtn.Text = "Select"
        selectBtn.MinimumSize = Size(120, 28)
        selectBtn.AutoSize = False
        selectBtn.Dock = DockStyle.Fill
        selectBtn.Margin = Padding(0, 0, 2, 0)
        selectBtn.Click += on_select
        buttonPanel.Controls.Add(selectBtn, 0, 0)

        reloadBtn = WinForms.Button()
        reloadBtn.Text = "Reload"
        reloadBtn.MinimumSize = Size(120, 28)
        reloadBtn.AutoSize = False
        reloadBtn.Dock = DockStyle.Fill
        reloadBtn.Margin = Padding(2, 0, 0, 0)
        reloadBtn.Click += on_reload
        buttonPanel.Controls.Add(reloadBtn, 2, 0)

        def update_image(sender, args):
            if grid.SelectedRows.Count > 0:
                original_name, fullpath = grid.SelectedRows[0].Tag
                bmp_path = os.path.join(glazing_folder, original_name + "_b.bmp")
                imageBox.Image = System.Drawing.Bitmap.FromFile(bmp_path) if os.path.exists(bmp_path) else None

                display_name = name_case_display(original_name)
                r = grid.SelectedRows[0].Cells[1].Value
                g = grid.SelectedRows[0].Cells[2].Value
                b = grid.SelectedRows[0].Cells[3].Value
                vlt = grid.SelectedRows[0].Cells[4].Value
                vlr = grid.SelectedRows[0].Cells[5].Value
                nameLabel.Text = display_name
                infoLabel.Text = f"RGB({r}, {g}, {b}) | VLT: {vlt}% | VLR: {vlr}%"

        grid.SelectionChanged += update_image

        layout.Controls.Add(topPanel, 0, 0)
        layout.Controls.Add(grid, 0, 1)
        layout.Controls.Add(buttonPanel, 0, 2)
        form.Controls.Add(layout)
        form.ShowDialog()

    return selected_name[0]





if run:
    _glazing_modifier = show_glazing_selector()
else:
    _glazing_modifier = None
# ---------- end python_3_script_3 ----------
panel_8 = Panel("concrete")
kybele_modifiers = Python3Script(run=lb_falsestarttoggle)  # -> out, modifier
# ---------- kybele_modifiers: Python ----------
ghenv.Component.Message = """Kybele 0.1 Beta 
Opaque Materials"""


import os
import System
import System.Windows.Forms as WinForms
from System.Collections.Generic import List
from System.Windows.Forms import (
    TableLayoutPanel, ColumnStyle, RowStyle, SizeType, DockStyle,
    Padding, FlowDirection, AnchorStyles, DataGridViewSelectionMode
)

from System.Drawing import (
    Size, Point, Color, Font, FontStyle, Bitmap, Imaging, ContentAlignment
)
from System.Windows.Forms import DataGridViewColumnHeadersHeightSizeMode, Padding




rad_folder = r"C:\RadMaterials"

def parse_rad_file(filepath):
    with open(filepath, 'r') as file:
        kept = []
        for line in file:
            s = line.strip()
            if not s:
                continue
            if s.startswith('#'):
                continue
            kept.append(s)
    lines = kept

    name = os.path.splitext(os.path.basename(filepath))[0]
    r = g = b = spec = rough = vlr = 0.0

    for line in lines:
        if line.startswith("void"):
            parts = line.split()
            if len(parts) >= 3:
                name = parts[2]
        elif line.startswith("5"):
            parts = line.split()
            if len(parts) >= 6:
                r = float(parts[1]); g = float(parts[2]); b = float(parts[3])
                spec = float(parts[4]); rough = float(parts[5])
                vlr = round((0.265 * r) + (0.670 * g) + (0.065 * b), 1)
            break
    return [name, f"{r:.3f}", f"{g:.3f}", f"{b:.3f}", f"{spec:.2f}", f"{rough:.2f}", f"{vlr}"]



def load_materials():
    materials = []
    for filename in os.listdir(rad_folder):
        if filename.endswith(".rad"):
            full_path = os.path.join(rad_folder, filename)
            materials.append(parse_rad_file(full_path))
    materials.sort(key=lambda row: (row[0][0].isdigit(), row[0].lower()))
    return materials

columns = ["Material", "R", "G", "B", "Specularity", "Roughness", "VLR"]



def name_case_display(material_id):
    return material_id.replace("_", " ").title()



def show_material_selector():
    selected = [None]
    reload_flag = [True]

    while reload_flag[0]:
        reload_flag[0] = False

        form = WinForms.Form()
        form.Text = "Kybele Radiance Material"
        form.Size = System.Drawing.Size(1500, 850)
        form.StartPosition = WinForms.FormStartPosition.CenterScreen

        layout = WinForms.TableLayoutPanel()
        layout.Dock = WinForms.DockStyle.Fill
        layout.RowCount = 3
        layout.ColumnCount = 1
        layout.RowStyles.Add(WinForms.RowStyle(WinForms.SizeType.Absolute, 300))
        layout.RowStyles.Add(WinForms.RowStyle(WinForms.SizeType.Percent, 100))
        layout.RowStyles.Add(WinForms.RowStyle(WinForms.SizeType.Absolute, 40))
        layout.BackColor = System.Drawing.Color.White

        topPanel = WinForms.TableLayoutPanel()
        topPanel.Dock = WinForms.DockStyle.Fill
        topPanel.ColumnCount = 2
        topPanel.RowCount = 2
        topPanel.ColumnStyles.Add(WinForms.ColumnStyle(WinForms.SizeType.Absolute, 300))
        topPanel.ColumnStyles.Add(WinForms.ColumnStyle(WinForms.SizeType.Percent, 100))
        topPanel.RowStyles.Add(WinForms.ColumnStyle(WinForms.SizeType.Percent, 80))
        topPanel.RowStyles.Add(WinForms.ColumnStyle(WinForms.SizeType.Percent, 20))
        topPanel.BackColor = System.Drawing.Color.White

        nameLabel = WinForms.Label()
        nameLabel.Text = "Select a material!"
        nameLabel.Dock = WinForms.DockStyle.Fill
        nameLabel.TextAlign = System.Drawing.ContentAlignment.BottomLeft
        nameLabel.Font = System.Drawing.Font("Segoe UI", 20, System.Drawing.FontStyle.Bold)
        topPanel.Controls.Add(nameLabel, 1, 0)

        infoLabel = WinForms.Label()
        infoLabel.Text = "RGB(0.00, 0.00, 0.00) | VLR: 0.0%"
        infoLabel.Dock = WinForms.DockStyle.Fill
        infoLabel.TextAlign = System.Drawing.ContentAlignment.TopLeft
        infoLabel.Font = System.Drawing.Font("Segoe UI", 10)
        topPanel.Controls.Add(infoLabel, 1, 1)

        imageBox = WinForms.PictureBox()
        imageBox.SizeMode = WinForms.PictureBoxSizeMode.Zoom
        imageBox.Dock = WinForms.DockStyle.Fill
        imageBox.BackColor = System.Drawing.Color.White
        topPanel.Controls.Add(imageBox, 0, 0)

        grid = WinForms.DataGridView()
        grid.Dock = WinForms.DockStyle.Fill
        grid.ReadOnly = True
        grid.SelectionMode = WinForms.DataGridViewSelectionMode.FullRowSelect
        grid.AllowUserToAddRows = False
        grid.AllowUserToResizeRows = False
        grid.RowHeadersVisible = False
        grid.AutoSizeColumnsMode = WinForms.DataGridViewAutoSizeColumnsMode.Fill
        grid.BackgroundColor = System.Drawing.Color.White
        grid.ColumnHeadersDefaultCellStyle.Font = System.Drawing.Font("Segoe UI", 10, System.Drawing.FontStyle.Bold)
        grid.ColumnHeadersHeightSizeMode = DataGridViewColumnHeadersHeightSizeMode.EnableResizing
        grid.ColumnHeadersHeight = 40
        # grid.ColumnHeadersDefaultCellStyle.Padding = Padding(0, 6, 0, 6)

        grid.CellBorderStyle = WinForms.DataGridViewCellBorderStyle.SingleHorizontal
        grid.GridColor = System.Drawing.Color.LightGray

        for col in columns:
            grid.Columns.Add(col, col)


        materials = load_materials()
        for row in materials:
            display_row = row[:]
            display_row[0] = name_case_display(row[0])
            idx = grid.Rows.Add(display_row)
            grid.Rows[idx].Tag = row[0]

        grid.Columns[0].Width = 80



        def on_select(sender, args):
            if grid.SelectedRows.Count > 0:
                original_name = grid.SelectedRows[0].Tag
                selected[0] = original_name
                form.Close()



        def on_reload(sender, args):
            reload_flag[0] = True
            form.Close()

        buttonPanel = TableLayoutPanel()
        buttonPanel.Dock = DockStyle.Fill
        buttonPanel.RowCount = 1
        buttonPanel.ColumnCount = 3
        buttonPanel.RowStyles.Add(RowStyle(SizeType.Percent, 100))


        buttonPanel.ColumnStyles.Add(ColumnStyle(SizeType.Percent, 80))
        buttonPanel.ColumnStyles.Add(ColumnStyle(SizeType.Absolute, 1))
        buttonPanel.ColumnStyles.Add(ColumnStyle(SizeType.Percent, 20))
        buttonPanel.Padding = Padding(8, 6, 8, 6)


        selectBtn = WinForms.Button()
        selectBtn.Text = "Select"
        selectBtn.MinimumSize = Size(120, 28)
        selectBtn.AutoSize = False
        selectBtn.Dock = DockStyle.Fill
        selectBtn.Margin = Padding(0, 0, 2, 0)
        selectBtn.Click += on_select
        buttonPanel.Controls.Add(selectBtn, 0, 0)

        # Reload
        reloadBtn = WinForms.Button()
        reloadBtn.Text = "Reload"
        reloadBtn.MinimumSize = Size(120, 28)
        reloadBtn.AutoSize = False
        reloadBtn.Dock = DockStyle.Fill
        reloadBtn.Margin = Padding(2, 0, 0, 0)
        reloadBtn.Click += on_reload
        buttonPanel.Controls.Add(reloadBtn, 2, 0)



        def update_image(sender, args):
            if grid.SelectedRows.Count > 0:
                original_name = grid.SelectedRows[0].Tag
                bmp_path = os.path.join(rad_folder, original_name + "_b.bmp")
                imageBox.Image = System.Drawing.Bitmap.FromFile(bmp_path) if os.path.exists(bmp_path) else None

                display_name = name_case_display(original_name)
                r = grid.SelectedRows[0].Cells[1].Value
                g = grid.SelectedRows[0].Cells[2].Value
                b = grid.SelectedRows[0].Cells[3].Value
                vlr = grid.SelectedRows[0].Cells[6].Value
                nameLabel.Text = display_name
                infoLabel.Text = f"RGB({r}, {g}, {b}) | VLR: {vlr}%"

        grid.SelectionChanged += update_image

        layout.Controls.Add(topPanel, 0, 0)
        layout.Controls.Add(grid, 0, 1)
        layout.Controls.Add(buttonPanel, 0, 2)
        form.Controls.Add(layout)
        form.ShowDialog()

    return selected[0]



# Main
if run:
    _modifier = show_material_selector()
else:
    _modifier = None
# ---------- end kybele_modifiers ----------
kybele_modifiers_2 = Python3Script(run=lb_falsestarttoggle_2)  # -> out, modifier
# ---------- kybele_modifiers_2: Python ----------
ghenv.Component.Message = """Kybele 0.1 Beta 
Opaque Materials"""

import os
import System
import System.Windows.Forms as WinForms
from System.Collections.Generic import List
from System.Windows.Forms import (
    TableLayoutPanel, ColumnStyle, RowStyle, SizeType, DockStyle,
    Padding, FlowDirection, AnchorStyles, DataGridViewSelectionMode
)

from System.Drawing import (
    Size, Point, Color, Font, FontStyle, Bitmap, Imaging, ContentAlignment
)
from System.Windows.Forms import DataGridViewColumnHeadersHeightSizeMode, Padding




rad_folder = r"C:\RadMaterials"

def parse_rad_file(filepath):
    with open(filepath, 'r') as file:
        kept = []
        for line in file:
            s = line.strip()
            if not s:
                continue
            if s.startswith('#'):
                continue
            kept.append(s)
    lines = kept

    name = os.path.splitext(os.path.basename(filepath))[0]
    r = g = b = spec = rough = vlr = 0.0

    for line in lines:
        if line.startswith("void"):
            parts = line.split()
            if len(parts) >= 3:
                name = parts[2]
        elif line.startswith("5"):
            parts = line.split()
            if len(parts) >= 6:
                r = float(parts[1]); g = float(parts[2]); b = float(parts[3])
                spec = float(parts[4]); rough = float(parts[5])
                vlr = round((0.265 * r) + (0.670 * g) + (0.065 * b), 1)
            break
    return [name, f"{r:.3f}", f"{g:.3f}", f"{b:.3f}", f"{spec:.2f}", f"{rough:.2f}", f"{vlr}"]



def load_materials():
    materials = []
    for filename in os.listdir(rad_folder):
        if filename.endswith(".rad"):
            full_path = os.path.join(rad_folder, filename)
            materials.append(parse_rad_file(full_path))
    materials.sort(key=lambda row: (row[0][0].isdigit(), row[0].lower()))
    return materials

columns = ["Material", "R", "G", "B", "Specularity", "Roughness", "VLR"]



def name_case_display(material_id):
    return material_id.replace("_", " ").title()



def show_material_selector():
    selected = [None]
    reload_flag = [True]

    while reload_flag[0]:
        reload_flag[0] = False

        form = WinForms.Form()
        form.Text = "Kybele Radiance Material"
        form.Size = System.Drawing.Size(1500, 850)
        form.StartPosition = WinForms.FormStartPosition.CenterScreen

        layout = WinForms.TableLayoutPanel()
        layout.Dock = WinForms.DockStyle.Fill
        layout.RowCount = 3
        layout.ColumnCount = 1
        layout.RowStyles.Add(WinForms.RowStyle(WinForms.SizeType.Absolute, 300))
        layout.RowStyles.Add(WinForms.RowStyle(WinForms.SizeType.Percent, 100))
        layout.RowStyles.Add(WinForms.RowStyle(WinForms.SizeType.Absolute, 40))
        layout.BackColor = System.Drawing.Color.White

        topPanel = WinForms.TableLayoutPanel()
        topPanel.Dock = WinForms.DockStyle.Fill
        topPanel.ColumnCount = 2
        topPanel.RowCount = 2
        topPanel.ColumnStyles.Add(WinForms.ColumnStyle(WinForms.SizeType.Absolute, 300))
        topPanel.ColumnStyles.Add(WinForms.ColumnStyle(WinForms.SizeType.Percent, 100))
        topPanel.RowStyles.Add(WinForms.ColumnStyle(WinForms.SizeType.Percent, 80))
        topPanel.RowStyles.Add(WinForms.ColumnStyle(WinForms.SizeType.Percent, 20))
        topPanel.BackColor = System.Drawing.Color.White

        nameLabel = WinForms.Label()
        nameLabel.Text = "Select a material!"
        nameLabel.Dock = WinForms.DockStyle.Fill
        nameLabel.TextAlign = System.Drawing.ContentAlignment.BottomLeft
        nameLabel.Font = System.Drawing.Font("Segoe UI", 20, System.Drawing.FontStyle.Bold)
        topPanel.Controls.Add(nameLabel, 1, 0)

        infoLabel = WinForms.Label()
        infoLabel.Text = "RGB(0.00, 0.00, 0.00) | VLR: 0.0%"
        infoLabel.Dock = WinForms.DockStyle.Fill
        infoLabel.TextAlign = System.Drawing.ContentAlignment.TopLeft
        infoLabel.Font = System.Drawing.Font("Segoe UI", 10)
        topPanel.Controls.Add(infoLabel, 1, 1)

        imageBox = WinForms.PictureBox()
        imageBox.SizeMode = WinForms.PictureBoxSizeMode.Zoom
        imageBox.Dock = WinForms.DockStyle.Fill
        imageBox.BackColor = System.Drawing.Color.White
        topPanel.Controls.Add(imageBox, 0, 0)

        grid = WinForms.DataGridView()
        grid.Dock = WinForms.DockStyle.Fill
        grid.ReadOnly = True
        grid.SelectionMode = WinForms.DataGridViewSelectionMode.FullRowSelect
        grid.AllowUserToAddRows = False
        grid.AllowUserToResizeRows = False
        grid.RowHeadersVisible = False
        grid.AutoSizeColumnsMode = WinForms.DataGridViewAutoSizeColumnsMode.Fill
        grid.BackgroundColor = System.Drawing.Color.White
        grid.ColumnHeadersDefaultCellStyle.Font = System.Drawing.Font("Segoe UI", 10, System.Drawing.FontStyle.Bold)
        grid.ColumnHeadersHeightSizeMode = DataGridViewColumnHeadersHeightSizeMode.EnableResizing
        grid.ColumnHeadersHeight = 40
        # grid.ColumnHeadersDefaultCellStyle.Padding = Padding(0, 6, 0, 6)

        grid.CellBorderStyle = WinForms.DataGridViewCellBorderStyle.SingleHorizontal
        grid.GridColor = System.Drawing.Color.LightGray

        for col in columns:
            grid.Columns.Add(col, col)


        materials = load_materials()
        for row in materials:
            display_row = row[:]
            display_row[0] = name_case_display(row[0])
            idx = grid.Rows.Add(display_row)
            grid.Rows[idx].Tag = row[0]

        grid.Columns[0].Width = 80



        def on_select(sender, args):
            if grid.SelectedRows.Count > 0:
                original_name = grid.SelectedRows[0].Tag
                selected[0] = original_name
                form.Close()



        def on_reload(sender, args):
            reload_flag[0] = True
            form.Close()

        buttonPanel = TableLayoutPanel()
        buttonPanel.Dock = DockStyle.Fill
        buttonPanel.RowCount = 1
        buttonPanel.ColumnCount = 3
        buttonPanel.RowStyles.Add(RowStyle(SizeType.Percent, 100))


        buttonPanel.ColumnStyles.Add(ColumnStyle(SizeType.Percent, 80))
        buttonPanel.ColumnStyles.Add(ColumnStyle(SizeType.Absolute, 1))
        buttonPanel.ColumnStyles.Add(ColumnStyle(SizeType.Percent, 20))
        buttonPanel.Padding = Padding(8, 6, 8, 6)


        selectBtn = WinForms.Button()
        selectBtn.Text = "Select"
        selectBtn.MinimumSize = Size(120, 28)
        selectBtn.AutoSize = False
        selectBtn.Dock = DockStyle.Fill
        selectBtn.Margin = Padding(0, 0, 2, 0)
        selectBtn.Click += on_select
        buttonPanel.Controls.Add(selectBtn, 0, 0)

        # Reload
        reloadBtn = WinForms.Button()
        reloadBtn.Text = "Reload"
        reloadBtn.MinimumSize = Size(120, 28)
        reloadBtn.AutoSize = False
        reloadBtn.Dock = DockStyle.Fill
        reloadBtn.Margin = Padding(2, 0, 0, 0)
        reloadBtn.Click += on_reload
        buttonPanel.Controls.Add(reloadBtn, 2, 0)



        def update_image(sender, args):
            if grid.SelectedRows.Count > 0:
                original_name = grid.SelectedRows[0].Tag
                bmp_path = os.path.join(rad_folder, original_name + "_b.bmp")
                imageBox.Image = System.Drawing.Bitmap.FromFile(bmp_path) if os.path.exists(bmp_path) else None

                display_name = name_case_display(original_name)
                r = grid.SelectedRows[0].Cells[1].Value
                g = grid.SelectedRows[0].Cells[2].Value
                b = grid.SelectedRows[0].Cells[3].Value
                vlr = grid.SelectedRows[0].Cells[6].Value
                nameLabel.Text = display_name
                infoLabel.Text = f"RGB({r}, {g}, {b}) | VLR: {vlr}%"

        grid.SelectionChanged += update_image

        layout.Controls.Add(topPanel, 0, 0)
        layout.Controls.Add(grid, 0, 1)
        layout.Controls.Add(buttonPanel, 0, 2)
        form.Controls.Add(layout)
        form.ShowDialog()

    return selected[0]



# Main
if run:
    _modifier = show_material_selector()
else:
    _modifier = None
# ---------- end kybele_modifiers_2 ----------
panel_9 = Panel("facade")
panel_10 = Panel("glazing1")
kybele_modifiers_3 = Python3Script(run=lb_falsestarttoggle_3)  # -> out, modifier
# ---------- kybele_modifiers_3: Python ----------
ghenv.Component.Message = """Kybele 0.1 Beta 
Opaque Materials"""



import os
import System
import System.Windows.Forms as WinForms
from System.Collections.Generic import List
from System.Windows.Forms import (
    TableLayoutPanel, ColumnStyle, RowStyle, SizeType, DockStyle,
    Padding, FlowDirection, AnchorStyles, DataGridViewSelectionMode
)

from System.Drawing import (
    Size, Point, Color, Font, FontStyle, Bitmap, Imaging, ContentAlignment
)
from System.Windows.Forms import DataGridViewColumnHeadersHeightSizeMode, Padding




rad_folder = r"C:\RadMaterials"

def parse_rad_file(filepath):
    with open(filepath, 'r') as file:
        kept = []
        for line in file:
            s = line.strip()
            if not s:
                continue
            if s.startswith('#'):
                continue
            kept.append(s)
    lines = kept

    name = os.path.splitext(os.path.basename(filepath))[0]
    r = g = b = spec = rough = vlr = 0.0

    for line in lines:
        if line.startswith("void"):
            parts = line.split()
            if len(parts) >= 3:
                name = parts[2]
        elif line.startswith("5"):
            parts = line.split()
            if len(parts) >= 6:
                r = float(parts[1]); g = float(parts[2]); b = float(parts[3])
                spec = float(parts[4]); rough = float(parts[5])
                vlr = round((0.265 * r) + (0.670 * g) + (0.065 * b), 1)
            break
    return [name, f"{r:.3f}", f"{g:.3f}", f"{b:.3f}", f"{spec:.2f}", f"{rough:.2f}", f"{vlr}"]



def load_materials():
    materials = []
    for filename in os.listdir(rad_folder):
        if filename.endswith(".rad"):
            full_path = os.path.join(rad_folder, filename)
            materials.append(parse_rad_file(full_path))
    materials.sort(key=lambda row: (row[0][0].isdigit(), row[0].lower()))
    return materials

columns = ["Material", "R", "G", "B", "Specularity", "Roughness", "VLR"]



def name_case_display(material_id):
    return material_id.replace("_", " ").title()



def show_material_selector():
    selected = [None]
    reload_flag = [True]

    while reload_flag[0]:
        reload_flag[0] = False

        form = WinForms.Form()
        form.Text = "Kybele Radiance Material"
        form.Size = System.Drawing.Size(1500, 850)
        form.StartPosition = WinForms.FormStartPosition.CenterScreen

        layout = WinForms.TableLayoutPanel()
        layout.Dock = WinForms.DockStyle.Fill
        layout.RowCount = 3
        layout.ColumnCount = 1
        layout.RowStyles.Add(WinForms.RowStyle(WinForms.SizeType.Absolute, 300))
        layout.RowStyles.Add(WinForms.RowStyle(WinForms.SizeType.Percent, 100))
        layout.RowStyles.Add(WinForms.RowStyle(WinForms.SizeType.Absolute, 40))
        layout.BackColor = System.Drawing.Color.White

        topPanel = WinForms.TableLayoutPanel()
        topPanel.Dock = WinForms.DockStyle.Fill
        topPanel.ColumnCount = 2
        topPanel.RowCount = 2
        topPanel.ColumnStyles.Add(WinForms.ColumnStyle(WinForms.SizeType.Absolute, 300))
        topPanel.ColumnStyles.Add(WinForms.ColumnStyle(WinForms.SizeType.Percent, 100))
        topPanel.RowStyles.Add(WinForms.ColumnStyle(WinForms.SizeType.Percent, 80))
        topPanel.RowStyles.Add(WinForms.ColumnStyle(WinForms.SizeType.Percent, 20))
        topPanel.BackColor = System.Drawing.Color.White

        nameLabel = WinForms.Label()
        nameLabel.Text = "Select a material!"
        nameLabel.Dock = WinForms.DockStyle.Fill
        nameLabel.TextAlign = System.Drawing.ContentAlignment.BottomLeft
        nameLabel.Font = System.Drawing.Font("Segoe UI", 20, System.Drawing.FontStyle.Bold)
        topPanel.Controls.Add(nameLabel, 1, 0)

        infoLabel = WinForms.Label()
        infoLabel.Text = "RGB(0.00, 0.00, 0.00) | VLR: 0.0%"
        infoLabel.Dock = WinForms.DockStyle.Fill
        infoLabel.TextAlign = System.Drawing.ContentAlignment.TopLeft
        infoLabel.Font = System.Drawing.Font("Segoe UI", 10)
        topPanel.Controls.Add(infoLabel, 1, 1)

        imageBox = WinForms.PictureBox()
        imageBox.SizeMode = WinForms.PictureBoxSizeMode.Zoom
        imageBox.Dock = WinForms.DockStyle.Fill
        imageBox.BackColor = System.Drawing.Color.White
        topPanel.Controls.Add(imageBox, 0, 0)

        grid = WinForms.DataGridView()
        grid.Dock = WinForms.DockStyle.Fill
        grid.ReadOnly = True
        grid.SelectionMode = WinForms.DataGridViewSelectionMode.FullRowSelect
        grid.AllowUserToAddRows = False
        grid.AllowUserToResizeRows = False
        grid.RowHeadersVisible = False
        grid.AutoSizeColumnsMode = WinForms.DataGridViewAutoSizeColumnsMode.Fill
        grid.BackgroundColor = System.Drawing.Color.White
        grid.ColumnHeadersDefaultCellStyle.Font = System.Drawing.Font("Segoe UI", 10, System.Drawing.FontStyle.Bold)
        grid.ColumnHeadersHeightSizeMode = DataGridViewColumnHeadersHeightSizeMode.EnableResizing
        grid.ColumnHeadersHeight = 40
        # grid.ColumnHeadersDefaultCellStyle.Padding = Padding(0, 6, 0, 6)

        grid.CellBorderStyle = WinForms.DataGridViewCellBorderStyle.SingleHorizontal
        grid.GridColor = System.Drawing.Color.LightGray

        for col in columns:
            grid.Columns.Add(col, col)


        materials = load_materials()
        for row in materials:
            display_row = row[:]
            display_row[0] = name_case_display(row[0])
            idx = grid.Rows.Add(display_row)
            grid.Rows[idx].Tag = row[0]

        grid.Columns[0].Width = 80



        def on_select(sender, args):
            if grid.SelectedRows.Count > 0:
                original_name = grid.SelectedRows[0].Tag
                selected[0] = original_name
                form.Close()



        def on_reload(sender, args):
            reload_flag[0] = True
            form.Close()

        buttonPanel = TableLayoutPanel()
        buttonPanel.Dock = DockStyle.Fill
        buttonPanel.RowCount = 1
        buttonPanel.ColumnCount = 3
        buttonPanel.RowStyles.Add(RowStyle(SizeType.Percent, 100))


        buttonPanel.ColumnStyles.Add(ColumnStyle(SizeType.Percent, 80))
        buttonPanel.ColumnStyles.Add(ColumnStyle(SizeType.Absolute, 1))
        buttonPanel.ColumnStyles.Add(ColumnStyle(SizeType.Percent, 20))
        buttonPanel.Padding = Padding(8, 6, 8, 6)


        selectBtn = WinForms.Button()
        selectBtn.Text = "Select"
        selectBtn.MinimumSize = Size(120, 28)
        selectBtn.AutoSize = False
        selectBtn.Dock = DockStyle.Fill
        selectBtn.Margin = Padding(0, 0, 2, 0)
        selectBtn.Click += on_select
        buttonPanel.Controls.Add(selectBtn, 0, 0)

        # Reload
        reloadBtn = WinForms.Button()
        reloadBtn.Text = "Reload"
        reloadBtn.MinimumSize = Size(120, 28)
        reloadBtn.AutoSize = False
        reloadBtn.Dock = DockStyle.Fill
        reloadBtn.Margin = Padding(2, 0, 0, 0)
        reloadBtn.Click += on_reload
        buttonPanel.Controls.Add(reloadBtn, 2, 0)



        def update_image(sender, args):
            if grid.SelectedRows.Count > 0:
                original_name = grid.SelectedRows[0].Tag
                bmp_path = os.path.join(rad_folder, original_name + "_b.bmp")
                imageBox.Image = System.Drawing.Bitmap.FromFile(bmp_path) if os.path.exists(bmp_path) else None

                display_name = name_case_display(original_name)
                r = grid.SelectedRows[0].Cells[1].Value
                g = grid.SelectedRows[0].Cells[2].Value
                b = grid.SelectedRows[0].Cells[3].Value
                vlr = grid.SelectedRows[0].Cells[6].Value
                nameLabel.Text = display_name
                infoLabel.Text = f"RGB({r}, {g}, {b}) | VLR: {vlr}%"

        grid.SelectionChanged += update_image

        layout.Controls.Add(topPanel, 0, 0)
        layout.Controls.Add(grid, 0, 1)
        layout.Controls.Add(buttonPanel, 0, 2)
        form.Controls.Add(layout)
        form.ShowDialog()

    return selected[0]



# Main
if run:
    _modifier = show_material_selector()
else:
    _modifier = None
# ---------- end kybele_modifiers_3 ----------
panel_11 = Panel("aluminum_frames")
kybele_modifiers_4 = Python3Script(run=lb_falsestarttoggle_4)  # -> out, modifier; same code as kybele_modifiers_3
panel_12 = Panel("ground")
panel_13 = Panel(kybele_modifiers.modifier)
area = Area(Geometry=geometry_pipeline_2)  # -> Area, Centroid
face = HBFace(geo=geometry_pipeline_2, name="concrete", rad_mod=kybele_modifiers.modifier)  # -> out, faces; plug-in component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
face_2 = HBFace(geo=geometry_pipeline_4, name="aluminum_frames", rad_mod=kybele_modifiers_2.modifier)  # -> out, faces; plug-in component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
panel_14 = Panel(kybele_modifiers_2.modifier)
face_3 = HBFace(geo=geometry_pipeline_3, name="facade", rad_mod=kybele_modifiers_4.modifier)  # -> out, faces; plug-in component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
panel_15 = Panel(kybele_modifiers_4.modifier)
face_4 = HBFace(geo=geometry_pipeline, name="glazing1", rad_mod=python_3_script_3.glazing_modifier)  # -> out, faces; plug-in component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
panel_16 = Panel(kybele_modifiers_3.modifier)
face_5 = HBFace(geo=geometry_pipeline_5, name="ground", rad_mod=kybele_modifiers_3.modifier)  # -> out, faces; plug-in component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
panel_17 = Panel(python_3_script_3.glazing_modifier)

# ----
# Electric Lighting
# Select a grow light
# lighting from IES file
lb_falsestarttoggle_6 = LBFalseStartToggle(True)
python_3_script_4 = Python3Script(run=lb_falsestarttoggle_6)  # -> out, ies_path, ies_name
# ---------- python_3_script_4: Python ----------
ghenv.Component.Message = """Kybele 0.1 Beta
IES Luminaries"""

import os, re
import System
import System.Windows.Forms as WinForms

from System.Windows.Forms import (
    TableLayoutPanel, ColumnStyle, RowStyle, SizeType, DockStyle,
    Padding, DataGridViewSelectionMode, DataGridViewColumnHeadersHeightSizeMode
)
from System.Drawing import (
    Size, Point, Color, Font, FontStyle, Bitmap, Imaging, ContentAlignment
)


ies_folder = r"C:\RadIES"



def name_case_display(s):
    return s.replace("_", " ").title()



def as_int(x, default=None):
    try: return int(float(x))
    except: return default



def as_float(x, default=None):
    try: return float(x)
    except: return default



def fmt_mm(v_mm):
    try:
        return str(int(round(v_mm)))
    except:
        return "—"



def extract_first(patterns, text, cast=None):
    """
    Try multiple regex patterns; return first captured group.
    cast can be int/float/str.
    """
    for pat in patterns:
        m = re.search(pat, text, flags=re.I)
        if m:
            val = m.group(1)
            if cast:
                try:
                    return cast(val)
                except:
                    return val
            return val
    return None



def parse_ies(filepath):
    """
    Returns:
      row_list: [Name, Lumens, Size, CCT, CRI, Vert Range, Horiz Range]
      original_name: best ID for the row (we use Name again)
      fullpath: filepath
    Parsing is LM-63 tolerant (86/95/02).
    """


    with open(filepath, 'r', errors='ignore') as f:
        lines = [ln.rstrip("\r\n") for ln in f]
    text = "\n".join(lines)



    basename = os.path.splitext(os.path.basename(filepath))[0]
    name = extract_first([
        r'^\s*\[LUMINAIRE\]\s*(.+)$',
        r'^\s*\[LUMCAT\]\s*(.+)$',
        r'^\s*\[LABEL\]\s*(.+)$',
        r'^\s*\[TEST\]\s*(.+)$',
    ], text, cast=str)
    if not name:
        name = extract_first([
            r'^\s*LUMINAIRE\s*:?[\t ]*(.+)$',
            r'^\s*LUMCAT\s*:?[\t ]*(.+)$',
            r'^\s*LABEL\s*:?[\t ]*(.+)$',
            r'^\s*TEST\s*:?[\t ]*(.+)$',
        ], text, cast=str)
    if not name:
        name = basename
    name = name.strip()


    tilt_idx = None
    for i, ln in enumerate(lines):
        if re.match(r'^\s*TILT\s*=\s*', ln, flags=re.I):
            tilt_idx = i
            break
    if tilt_idx is None:


        lumens_total = "—"
        size_str = "—"
        cct_str = extract_first([r'(\d{3,5})\s*K', r'CCT[^0-9]*?(\d{3,5})'], text, cast=str) or "—"
        cri_str = extract_first([r'CRI[^0-9]*?(\d{2,3})', r'Ra[^0-9]*?(\d{2,3})'], text, cast=str) or "—"
        v_range = "—"
        h_range = "—"
        row = [name, str(lumens_total), size_str, str(cct_str), str(cri_str), v_range, h_range]
        return row, name, filepath


    hdr_tokens = []
    j = tilt_idx + 1
    while j < len(lines):
        toks = [t for t in re.split(r'[\s,]+', lines[j].strip()) if t]
        numeric = [as_float(t) for t in toks]
        if len([n for n in numeric if n is not None]) >= 10:
            hdr_tokens = toks
            break
        j += 1


    lamps = lum_per_lamp = 1.0
    mult = 1.0
    n_vert = n_horz = 0
    photometric_type = 3
    units_type = 2
    width = length = height = None
    input_watts = None

    if hdr_tokens:
        if len(hdr_tokens) >= 1:  lamps = as_float(hdr_tokens[0], 1.0)
        if len(hdr_tokens) >= 2:  lum_per_lamp = as_float(hdr_tokens[1], 0.0)
        if len(hdr_tokens) >= 3:  mult = as_float(hdr_tokens[2], 1.0)
        if len(hdr_tokens) >= 4:  n_vert = as_int(hdr_tokens[3], 0)
        if len(hdr_tokens) >= 5:  n_horz = as_int(hdr_tokens[4], 0)
        if len(hdr_tokens) >= 6:  photometric_type = as_int(hdr_tokens[5], 3)
        if len(hdr_tokens) >= 7:  units_type = as_int(hdr_tokens[6], 2)
        if len(hdr_tokens) >= 8:  width = as_float(hdr_tokens[7], None)
        if len(hdr_tokens) >= 9:  length = as_float(hdr_tokens[8], None)
        if len(hdr_tokens) >= 10: height = as_float(hdr_tokens[9], None)
        if len(hdr_tokens) >= 13: input_watts = as_float(hdr_tokens[12], None)



    # Vertical angles
    v_angles, k = [], j+1
    while len(v_angles) < max(n_vert, 0) and k < len(lines):
        for tok in re.split(r'[\s,]+', lines[k].strip()):
            val = as_float(tok)
            if val is not None:
                v_angles.append(val)
                if len(v_angles) >= n_vert: break
        k += 1



    # Horizontal angles
    h_angles = []
    while len(h_angles) < max(n_horz, 0) and k < len(lines):
        for tok in re.split(r'[\s,]+', lines[k].strip()):
            val = as_float(tok)
            if val is not None:
                h_angles.append(val)
                if len(h_angles) >= n_horz: break
        k += 1



    # Derived fields
    if lamps is None: lamps = 1.0
    if lum_per_lamp is None: lum_per_lamp = 0.0
    if mult is None: mult = 1.0
    lumens_total = lamps * lum_per_lamp * mult
    lumens_str = str(int(round(lumens_total))) if lumens_total and lumens_total > 0 else "—"



    # Size
    size_str = "—"
    if width is not None and length is not None and height is not None:
        if units_type == 1:
            Wmm = width * 304.8; Lmm = length * 304.8; Hmm = height * 304.8
        else:
            Wmm = width * 1000.0; Lmm = length * 1000.0; Hmm = height * 1000.0
        size_str = "{}×{}×{} mm".format(fmt_mm(Lmm), fmt_mm(Wmm), fmt_mm(Hmm))



    # CCT & CRI
    cct_val = extract_first([
        r'\b(\d{4,5})\s*K\b',
        r'\bCCT[^0-9]*?(\d{3,5})\b',
        r'\b(\d{3,5})K\b',
    ], text, cast=str)
    cct_str = cct_val if cct_val else "—"

    cri_val = extract_first([
        r'\bCRI[^0-9]*?(\d{2,3})\b',
        r'\bRa[^0-9]*?(\d{2,3})\b',
        r'\bCRI\s*=\s*(\d{2,3})\b',
    ], text, cast=str)
    cri_str = cri_val if cri_val else "—"



    # Ranges
    if v_angles:
        v_min, v_max = (min(v_angles), max(v_angles))
        v_range = "{}–{} ({})".format(int(round(v_min)), int(round(v_max)), len(v_angles))
    else:
        v_range = "—"
    if h_angles:
        h_min, h_max = (min(h_angles), max(h_angles))
        h_range = "{}–{} ({})".format(int(round(h_min)), int(round(h_max)), len(h_angles))
    else:
        h_range = "—"

    row = [name, lumens_str, size_str, cct_str, cri_str, v_range, h_range]
    return row, name, filepath



def load_ies_rows():
    rows = []
    if not os.path.isdir(ies_folder):
        return rows
    for filename in os.listdir(ies_folder):
        if filename.lower().endswith(".ies"):
            fp = os.path.join(ies_folder, filename)
            try:
                rows.append(parse_ies(fp))
            except Exception:
                nm = os.path.splitext(filename)[0]
                rows.append(([nm, "—", "—", "—", "—", "—", "—"], nm, fp))
    rows.sort(key=lambda t: (not t[0][0][0].isdigit(), t[0][0].lower()))
    return rows


columns = ["Name", "Lumens", "Size", "CCT", "CRI", "Vert Range", "Horiz Range"]



def safe_load_image(png_path):
    """Load image without locking the file; return Bitmap or None."""
    if not os.path.exists(png_path):
        return None
    try:
        from System.IO import FileStream, FileMode, FileAccess, FileShare
        fs = FileStream(png_path, FileMode.Open, FileAccess.Read, FileShare.ReadWrite)
        try:
            img = Bitmap(fs)
            return img.Clone()
        finally:
            fs.Close()
    except:
        return None



def show_ies_selector():
    selected_path = [None]
    selected_name = [None]
    reload_flag = [True]

    while reload_flag[0]:
        reload_flag[0] = False

        form = WinForms.Form()
        form.Text = "Kybele IES Selector"
        form.Size = System.Drawing.Size(1500, 850)
        form.StartPosition = WinForms.FormStartPosition.CenterScreen

        layout = WinForms.TableLayoutPanel()
        layout.Dock = WinForms.DockStyle.Fill
        layout.RowCount = 3
        layout.ColumnCount = 1
        layout.RowStyles.Add(WinForms.RowStyle(WinForms.SizeType.Absolute, 300))
        layout.RowStyles.Add(WinForms.RowStyle(WinForms.SizeType.Percent, 100))
        layout.RowStyles.Add(WinForms.RowStyle(WinForms.SizeType.Absolute, 40))
        layout.BackColor = System.Drawing.Color.White

        topPanel = WinForms.TableLayoutPanel()
        topPanel.Dock = WinForms.DockStyle.Fill
        topPanel.ColumnCount = 2
        topPanel.RowCount = 2
        topPanel.ColumnStyles.Add(WinForms.ColumnStyle(WinForms.SizeType.Absolute, 300))
        topPanel.ColumnStyles.Add(WinForms.ColumnStyle(WinForms.SizeType.Percent, 100))
        topPanel.RowStyles.Add(WinForms.RowStyle(WinForms.SizeType.Percent, 80))
        topPanel.RowStyles.Add(WinForms.RowStyle(WinForms.SizeType.Percent, 20))
        topPanel.BackColor = System.Drawing.Color.White

        nameLabel = WinForms.Label()
        nameLabel.Text = "Select an IES!"
        nameLabel.Dock = WinForms.DockStyle.Fill
        nameLabel.TextAlign = System.Drawing.ContentAlignment.BottomLeft
        nameLabel.Font = System.Drawing.Font("Segoe UI", 20, System.Drawing.FontStyle.Bold)
        topPanel.Controls.Add(nameLabel, 1, 0)

        infoLabel = WinForms.Label()
        infoLabel.Text = "Lumens: — | CCT: — | CRI: —"
        infoLabel.Dock = WinForms.DockStyle.Fill
        infoLabel.TextAlign = System.Drawing.ContentAlignment.TopLeft
        infoLabel.Font = System.Drawing.Font("Segoe UI", 10)
        topPanel.Controls.Add(infoLabel, 1, 1)

        imageBox = WinForms.PictureBox()
        imageBox.SizeMode = WinForms.PictureBoxSizeMode.Zoom
        imageBox.Dock = WinForms.DockStyle.Fill
        imageBox.BackColor = System.Drawing.Color.White
        topPanel.Controls.Add(imageBox, 0, 0)
        topPanel.SetRowSpan(imageBox, 2)

        grid = WinForms.DataGridView()
        grid.Dock = WinForms.DockStyle.Fill
        grid.ReadOnly = True
        grid.MultiSelect = False
        grid.SelectionMode = DataGridViewSelectionMode.FullRowSelect
        grid.AllowUserToAddRows = False
        grid.AllowUserToResizeRows = False
        grid.RowHeadersVisible = False
        grid.AutoSizeColumnsMode = WinForms.DataGridViewAutoSizeColumnsMode.Fill
        grid.BackgroundColor = System.Drawing.Color.White
        grid.ColumnHeadersDefaultCellStyle.Font = System.Drawing.Font("Segoe UI", 10, System.Drawing.FontStyle.Bold)
        grid.ColumnHeadersHeightSizeMode = DataGridViewColumnHeadersHeightSizeMode.EnableResizing
        grid.ColumnHeadersHeight = 40
        grid.CellBorderStyle = WinForms.DataGridViewCellBorderStyle.SingleHorizontal
        grid.GridColor = System.Drawing.Color.LightGray

        for col in columns:
            grid.Columns.Add(col, col)



        # populate
        ies_rows = load_ies_rows()
        for row_list, original_name, fullpath in ies_rows:
            display_row = row_list[:]
            display_row[0] = name_case_display(row_list[0])
            idx = grid.Rows.Add(display_row)
            grid.Rows[idx].Tag = (original_name, fullpath, os.path.splitext(os.path.basename(fullpath))[0])

        grid.Columns[0].Width = 80



        def on_select(sender, args):
            if grid.SelectedRows.Count > 0:
                orig_name, fullpath, _base = grid.SelectedRows[0].Tag
                selected_path[0] = fullpath
                selected_name[0] = orig_name
                form.Close()


        def on_reload(sender, args):
            reload_flag[0] = True
            form.Close()


        def update_image(sender, args):
            if grid.SelectedRows.Count > 0:
                original_name, fullpath, base_no_ext = grid.SelectedRows[0].Tag
                png_path = os.path.join(ies_folder, base_no_ext + ".png")


                if imageBox.Image is not None:
                    try:
                        old = imageBox.Image
                        imageBox.Image = None
                        old.Dispose()
                    except:
                        pass

                imageBox.Image = safe_load_image(png_path)

                display_name = name_case_display(original_name)
                lumens = grid.SelectedRows[0].Cells[1].Value
                cct = grid.SelectedRows[0].Cells[3].Value
                cri = grid.SelectedRows[0].Cells[4].Value
                nameLabel.Text = display_name
                infoLabel.Text = "Lumens: {} | CCT: {} | CRI: {}".format(lumens, cct, cri)

        grid.SelectionChanged += update_image



        # Buttons row
        buttonPanel = TableLayoutPanel()
        buttonPanel.Dock = DockStyle.Fill
        buttonPanel.RowCount = 1
        buttonPanel.ColumnCount = 3
        buttonPanel.RowStyles.Add(RowStyle(SizeType.Percent, 100))
        buttonPanel.ColumnStyles.Add(ColumnStyle(SizeType.Percent, 80))
        buttonPanel.ColumnStyles.Add(ColumnStyle(SizeType.Absolute, 1))
        buttonPanel.ColumnStyles.Add(ColumnStyle(SizeType.Percent, 20))
        buttonPanel.Padding = Padding(8, 6, 8, 6)

        selectBtn = WinForms.Button()
        selectBtn.Text = "Select"
        selectBtn.MinimumSize = Size(120, 28)
        selectBtn.AutoSize = False
        selectBtn.Dock = DockStyle.Fill
        selectBtn.Margin = Padding(0, 0, 2, 0)
        selectBtn.Click += on_select
        buttonPanel.Controls.Add(selectBtn, 0, 0)

        reloadBtn = WinForms.Button()
        reloadBtn.Text = "Reload"
        reloadBtn.MinimumSize = Size(120, 28)
        reloadBtn.AutoSize = False
        reloadBtn.Dock = DockStyle.Fill
        reloadBtn.Margin = Padding(2, 0, 0, 0)
        reloadBtn.Click += on_reload
        buttonPanel.Controls.Add(reloadBtn, 2, 0)



        # assemble form
        layout.Controls.Add(topPanel, 0, 0)
        layout.Controls.Add(grid, 0, 1)
        layout.Controls.Add(buttonPanel, 0, 2)
        form.Controls.Add(layout)



        # Preselect first row
        if grid.Rows.Count > 0:
            try:
                grid.ClearSelection()
                grid.Rows[0].Selected = True
            except:
                pass

        form.ShowDialog()

    return selected_path[0], selected_name[0]



if run:
    _ies_path, _ies_name = show_ies_selector()
else:
    _ies_path, _ies_name = None, None
# ---------- end python_3_script_4 ----------
python_3_script_5 = Python3Script(
    folder=panel_4,
    ies_path=python_3_script_4.ies_path,
    ies_name=python_3_script_4.ies_name,
    r=Slider(1, range=0..1),
    g=Slider(1, range=0..1),
    b=Slider(1, range=0..1),
    run=Toggle(True))  # -> out, rad_files, dat_files, cmdline, log
# ---------- python_3_script_5: Python ----------
ghenv.Component.Message = """Kybele 0.1 Beta
IES to Rad"""

import os, shlex, subprocess, glob, re


def fail(msg):
    raise ValueError(msg)


def norm_path(p):
    return os.path.abspath(p).replace("\\", "/")


def replace_all_dat_tokens(lines, dat_full):
    out = []
    for ln in lines:
        if ".dat" not in ln.lower():
            out.append(ln)
            continue

        new_ln = ln
        for q in ("'", '"'):
            i = 0
            while True:
                start = new_ln.find(q, i)
                if start == -1:
                    break
                end = new_ln.find(q, start + 1)
                if end == -1:
                    break
                inner = new_ln[start + 1:end]
                if inner.strip().lower().endswith(".dat"):
                    new_ln = new_ln[:start + 1] + dat_full + new_ln[end:]
                    i = start + 1 + len(dat_full)
                else:
                    i = end + 1

        if ".dat" in new_ln.lower():
            tail_nl = "\n" if new_ln.endswith("\n") else ""
            parts = new_ln.strip().split()
            changed = False
            for j, t in enumerate(parts):
                if t.lower().endswith(".dat"):
                    parts[j] = '"%s"' % dat_full
                    changed = True
            if changed:
                new_ln = " ".join(parts) + tail_nl

        out.append(new_ln)
    return out


def atomic_write_lines(path, lines):
    tmp = path + ".tmp"
    with open(tmp, "w", encoding="utf-8", newline="\n") as f:
        f.writelines(lines)
    os.replace(tmp, path)


def as_float(x, default=None):
    try:
        return float(x)
    except:
        return default


# normalized r, g, b
def normalize_rgb(r, g, b):
    coeff_r = 0.265
    coeff_g = 0.67
    coeff_b = 0.065

    wr = r * coeff_r
    wg = g * coeff_g
    wb = b * coeff_b
    total = wr + wg + wb

    if total <= 0:
        return 1.0, 1.0, 1.0, 1.0, 1.0

    nr = wr / total
    ng = wg / total
    nb = wb / total
    scale = 1.0 / total
    return nr, ng, nb, scale, total



# replace the rgb line
def replace_rgb_line(lines, nr, ng, nb):
    out = []
    replaced = False
    rgb_line_pattern = re.compile(
        r'^\s*3\s+[-+]?\d*\.?\d+(?:[eE][-+]?\d+)?\s+[-+]?\d*\.?\d+(?:[eE][-+]?\d+)?\s+[-+]?\d*\.?\d+(?:[eE][-+]?\d+)?\s*$'
    )

    new_rgb_line = "3 {:.12g} {:.12g} {:.12g}\n".format(nr, ng, nb)

    for ln in lines:
        if (not replaced) and rgb_line_pattern.match(ln):
            out.append(new_rgb_line)
            replaced = True
        else:
            out.append(ln)

    return out, replaced




# Grasshopper inputs
_ies_path   = locals().get("_ies_path", None)
_ies_name   = locals().get("_ies_name", None)
_r          = locals().get("_r", 1.0)
_g          = locals().get("_g", 1.0)
_b          = locals().get("_b", 1.0)
_multiplier = locals().get("_multiplier", None)
_folder     = locals().get("_folder", None)
_datfile    = locals().get("_datfile", None)
_run        = bool(locals().get("_run", False))


if not _ies_path or not os.path.isfile(_ies_path):
    fail("Provide a valid IES file path for '_ies_path'.")

_folder = _folder or os.path.join(os.path.expanduser("~"), "radiance_out")
os.makedirs(_folder, exist_ok=True)

# write luminaire files outside _folder
_parent_folder = os.path.dirname(_folder.rstrip("\\/"))
_luminaire_folder = os.path.join(_parent_folder, "Luminaire_files")
os.makedirs(_luminaire_folder, exist_ok=True)

stem = _ies_name.strip() if (_ies_name and isinstance(_ies_name, str)) \
       else os.path.splitext(os.path.basename(_ies_path))[0]


# Read RGB inputs safely
r = as_float(_r, 1.0)
g = as_float(_g, 1.0)
b = as_float(_b, 1.0)


# Compute normalized RGB
normalized_r, normalized_g, normalized_b, rgb_scale, weighted_sum = normalize_rgb(r, g, b)



# Build ies2rad command
cmd = ["ies2rad", "-o", stem, "-t", "default"]

if isinstance(_multiplier, (int, float)) and _multiplier not in (None, 0):
    cmd += ["-m", str(float(_multiplier))]
cmd += [_ies_path]


_cmdline = " ".join(shlex.quote(c) for c in cmd)
_rad_files = []
_dat_files = []



# output parameter
out_lines = []
out_lines.append(_cmdline)
out_lines.append("Luminaire folder: " + _luminaire_folder)
out_lines.append("Normalized RGB values: R={:.12g}, G={:.12g}, B={:.12g}".format(
    normalized_r, normalized_g, normalized_b
))

_log = ""

print(_cmdline)
print("Luminaire folder:", _luminaire_folder)
print("Normalized RGB values: R={:.12g}, G={:.12g}, B={:.12g}".format(
    normalized_r, normalized_g, normalized_b
))



# run
if _run:
    before = set(os.listdir(_luminaire_folder))

    proc = subprocess.run(
        cmd,
        cwd=_luminaire_folder,
        stdout=subprocess.PIPE,
        stderr=subprocess.PIPE,
        text=True
    )
    _log = (proc.stdout or "") + (("\n" + proc.stderr) if proc.stderr else "")

    if proc.returncode != 0:
        fail("ies2rad failed.\nCommand:\n{}\n\nLog:\n{}".format(_cmdline, _log))

    after = set(os.listdir(_luminaire_folder))
    new = list(after - before)

    _rad_files = [os.path.join(_luminaire_folder, f) for f in new if f.lower().endswith(".rad")]
    _dat_files = [os.path.join(_luminaire_folder, f) for f in new if f.lower().endswith(".dat")]

    if not _rad_files:
        _rad_files = glob.glob(os.path.join(_luminaire_folder, stem + "*.rad"))
    if not _dat_files:
        _dat_files = glob.glob(os.path.join(_luminaire_folder, stem + "*.dat"))



    # Choose dat path
    dat_full = None
    if _datfile and isinstance(_datfile, str) and os.path.isfile(_datfile):
        dat_full = norm_path(_datfile)
    elif _dat_files:
        dat_full = norm_path(_dat_files[0])
    else:
        _log += "\n[info] No .dat provided/found; .rad files left unchanged."



    # Rewrite each .rad file:
    for each_file in _rad_files:
        with open(each_file, "r", encoding="utf-8", errors="ignore") as f:
            lines = f.readlines()

        if dat_full:
            lines = replace_all_dat_tokens(lines, dat_full)

        lines, rgb_replaced = replace_rgb_line(lines, normalized_r, normalized_g, normalized_b)

        atomic_write_lines(each_file, lines)

        if rgb_replaced:
            msg = "normalized r g b values added"
            out_lines.append(msg)
            out_lines.append("overwrote: " + each_file)
            print(msg)
            print("overwrote:", each_file)
        else:
            msg = "warning: rgb line was not found in " + each_file
            out_lines.append(msg)
            print(msg)



    # Put info into _log
    _log += "\nLuminaire folder: " + _luminaire_folder
    _log += "\nNormalized RGB values: R={:.12g}, G={:.12g}, B={:.12g}".format(
        normalized_r, normalized_g, normalized_b
    )

else:
    _log = "Waiting for '_run' trigger. Command prepared but not executed.\n" + _cmdline
    _log += "\nLuminaire folder: " + _luminaire_folder
    _log += "\nNormalized RGB values: R={:.12g}, G={:.12g}, B={:.12g}".format(
        normalized_r, normalized_g, normalized_b
    )



# Output for the 'out' parameter
out = out_lines
# ---------- end python_3_script_5 ----------
panel_18 = Panel(python_3_script_4.ies_name)
panel_19 = Panel(python_3_script_5.out)
panel_20 = Panel(python_3_script_5.dat_files)
construct_point_2 = ConstructPoint(XCoordinate=Slider(8, range=0..10), YCoordinate=0, ZCoordinate=Slider(4, range=0..10))
list_length = ListLength(List=flatten(move_2.Geometry))
lighting_geometry = Python3Script(
    points=flatten(move_2.Geometry),
    rotationX=Slider(0, range=0..100),
    rotationY=Slider(0, range=0..100),
    rotationZ=Slider(0, range=0..100),
    rad_files=python_3_script_5.rad_files)  # -> out, flatten(lighting_geometry); inputs points: list of Point3d, rad_files: list
# ---------- lighting_geometry: Python ----------
ghenv.Component.Message = """Kybele 0.1 Beta
Lighting Geometry"""



import os
import Rhino

try:
    from Grasshopper.Kernel.Types import GH_Point, GH_Number, GH_String
except:
    GH_Point = GH_Number = GH_String = None



def flatten_any(x):
    # GH DataTree
    try:
        bc = getattr(x, "BranchCount", None)
        if bc is not None:
            cnt = x.BranchCount if isinstance(bc, int) else x.BranchCount()
            flat = []
            for i in range(cnt):
                flat.extend(list(x.Branch(i)))
            return flat
    except:
        pass
    # list/tuple
    try:
        _ = len(x); return list(x)
    except:
        return [x]

def coerce_point(obj):
    if obj is None: return None
    if isinstance(obj, Rhino.Geometry.Point3d): return obj
    if GH_Point and isinstance(obj, GH_Point):
        try: return obj.Value
        except: pass
    # tuple-like
    try: return Rhino.Geometry.Point3d(float(obj[0]), float(obj[1]), float(obj[2]))
    except: pass
    # object with X/Y/Z
    try: return Rhino.Geometry.Point3d(float(obj.X), float(obj.Y), float(obj.Z))
    except: return None

def coerce_float(obj):
    if obj is None: return None
    if isinstance(obj, (int, float)): return float(obj)
    if GH_Number and isinstance(obj, GH_Number):
        try: return float(obj.Value)
        except: pass
    try: return float(obj)
    except: return None

def coerce_str(obj):
    if obj is None: return None
    if isinstance(obj, str): return obj
    if GH_String and isinstance(obj, GH_String):
        try: return str(obj.Value)
        except: pass
    try: return str(obj)
    except: return None

def ensure_float_list(x, n, default=0.0):
    raw = [r for r in flatten_any(x) if r is not None]
    if len(raw) == 0: return [default]*n
    if len(raw) == 1:
        v = coerce_float(raw[0]); v = default if v is None else v
        return [float(v)]*n
    if len(raw) != n:
        raise ValueError("Rotation list length {} must match number of points {}."
                         .format(len(raw), n))
    out = []
    for r in raw:
        v = coerce_float(r)
        out.append(default if v is None else float(v))
    return out

def ensure_path_list(rad_files_input, n):
    """Return list of N quoted, normalized absolute paths.
       If 1 input, broadcast; if N inputs, use as-is; else error."""
    raw = [coerce_str(s) for s in flatten_any(rad_files_input)]
    raw = [s.strip() for s in raw if s and s.strip() != ""]
    if len(raw) == 0:
        raise ValueError("Provide _rad_files (one path or a list of N paths).")
    paths_src = raw if len(raw) == n else (raw* n if len(raw) == 1 else None)
    if paths_src is None:
        raise ValueError("Number of _rad_files ({}) must be 1 or {} to match points."
                         .format(len(raw), n))
    paths = []
    missing = []
    for r in paths_src:
        p_abs = os.path.abspath(r).replace("\\", "/")
        paths.append('"{}"'.format(p_abs))
        if not os.path.isfile(p_abs):
            missing.append(p_abs)
    return paths, missing

# main
out = ""
_lighting_geometry = []

try:
    # Points
    pts = []
    for item in flatten_any(_points):
        p = coerce_point(item)
        if p is not None: pts.append(p)
    n = len(pts)

    if n == 0:
        out = ("No points detected.\n"
               "• Plug Point(s) into _points (flatten if needed).\n"
               "• Set _rad_files to one path (broadcast) or N paths.")
    else:
        rx = ensure_float_list(_rotationX, n, 0.0)
        ry = ensure_float_list(_rotationY, n, 0.0)
        rz = ensure_float_list(_rotationZ, n, 0.0)


        rad_paths, missing = ensure_path_list(_rad_files, n)

        for i, p in enumerate(pts):
            parts = ["!xform"]
            if abs(rx[i]) > 1e-12: parts.append("-rx {:.6f}".format(rx[i]))
            if abs(ry[i]) > 1e-12: parts.append("-ry {:.6f}".format(ry[i]))
            if abs(rz[i]) > 1e-12: parts.append("-rz {:.6f}".format(rz[i]))
            parts.append("-t {x:.6f} {y:.6f} {z:.6f}".format(x=p.X, y=p.Y, z=p.Z))
            parts.append(rad_paths[i])  # one path per point
            _lighting_geometry.append(" ".join(parts))

        warn = ""
        if missing:
            warn = "WARNING: {} path(s) not found:\n  - {}\n".format(len(missing), "\n  - ".join(missing))

        example = _lighting_geometry[0] if _lighting_geometry else "(none)"
        out = "{}OK: {} line(s). Example → {}".format(warn, len(_lighting_geometry), example)

except Exception as e:
    out = "ERROR: {}".format(e)
# ---------- end lighting_geometry ----------
lighting_geometry_2 = Python3Script(
    points=flatten(construct_point_2),
    rotationX=Slider(40, range=0..100),
    rotationY=Slider(25, range=0..100),
    rotationZ=Slider(10, range=0..100),
    rad_files=python_3_script_5.rad_files)  # -> out, flatten(lighting_geometry); inputs points: list of Point3d, rad_files: list
# ---------- lighting_geometry_2: Python ----------
ghenv.Component.Message = """Kybele 0.1 Beta
Lighting Geometry"""


import os
import Rhino

try:
    from Grasshopper.Kernel.Types import GH_Point, GH_Number, GH_String
except:
    GH_Point = GH_Number = GH_String = None

# utils
def flatten_any(x):
    # GH DataTree
    try:
        bc = getattr(x, "BranchCount", None)
        if bc is not None:
            cnt = x.BranchCount if isinstance(bc, int) else x.BranchCount()
            flat = []
            for i in range(cnt):
                flat.extend(list(x.Branch(i)))
            return flat
    except:
        pass
    # list/tuple
    try:
        _ = len(x); return list(x)
    except:
        return [x]

def coerce_point(obj):
    if obj is None: return None
    if isinstance(obj, Rhino.Geometry.Point3d): return obj
    if GH_Point and isinstance(obj, GH_Point):
        try: return obj.Value
        except: pass
    # tuple-like
    try: return Rhino.Geometry.Point3d(float(obj[0]), float(obj[1]), float(obj[2]))
    except: pass
    # object with X/Y/Z
    try: return Rhino.Geometry.Point3d(float(obj.X), float(obj.Y), float(obj.Z))
    except: return None

def coerce_float(obj):
    if obj is None: return None
    if isinstance(obj, (int, float)): return float(obj)
    if GH_Number and isinstance(obj, GH_Number):
        try: return float(obj.Value)
        except: pass
    try: return float(obj)
    except: return None

def coerce_str(obj):
    if obj is None: return None
    if isinstance(obj, str): return obj
    if GH_String and isinstance(obj, GH_String):
        try: return str(obj.Value)
        except: pass
    try: return str(obj)
    except: return None

def ensure_float_list(x, n, default=0.0):
    raw = [r for r in flatten_any(x) if r is not None]
    if len(raw) == 0: return [default]*n
    if len(raw) == 1:
        v = coerce_float(raw[0]); v = default if v is None else v
        return [float(v)]*n
    if len(raw) != n:
        raise ValueError("Rotation list length {} must match number of points {}."
                         .format(len(raw), n))
    out = []
    for r in raw:
        v = coerce_float(r)
        out.append(default if v is None else float(v))
    return out

def ensure_path_list(rad_files_input, n):
    """Return list of N quoted, normalized absolute paths.
       If 1 input, broadcast; if N inputs, use as-is; else error."""
    raw = [coerce_str(s) for s in flatten_any(rad_files_input)]
    raw = [s.strip() for s in raw if s and s.strip() != ""]
    if len(raw) == 0:
        raise ValueError("Provide _rad_files (one path or a list of N paths).")
    paths_src = raw if len(raw) == n else (raw* n if len(raw) == 1 else None)
    if paths_src is None:
        raise ValueError("Number of _rad_files ({}) must be 1 or {} to match points."
                         .format(len(raw), n))
    paths = []
    missing = []
    for r in paths_src:
        p_abs = os.path.abspath(r).replace("\\", "/")
        paths.append('"{}"'.format(p_abs))
        if not os.path.isfile(p_abs):
            missing.append(p_abs)
    return paths, missing

# main
out = ""
_lighting_geometry = []

try:
    # Points
    pts = []
    for item in flatten_any(_points):
        p = coerce_point(item)
        if p is not None: pts.append(p)
    n = len(pts)

    if n == 0:
        out = ("No points detected.\n"
               "• Plug Point(s) into _points (flatten if needed).\n"
               "• Set _rad_files to one path (broadcast) or N paths.")
    else:
        rx = ensure_float_list(_rotationX, n, 0.0)
        ry = ensure_float_list(_rotationY, n, 0.0)
        rz = ensure_float_list(_rotationZ, n, 0.0)


        rad_paths, missing = ensure_path_list(_rad_files, n)

        for i, p in enumerate(pts):
            parts = ["!xform"]
            if abs(rx[i]) > 1e-12: parts.append("-rx {:.6f}".format(rx[i]))
            if abs(ry[i]) > 1e-12: parts.append("-ry {:.6f}".format(ry[i]))
            if abs(rz[i]) > 1e-12: parts.append("-rz {:.6f}".format(rz[i]))
            parts.append("-t {x:.6f} {y:.6f} {z:.6f}".format(x=p.X, y=p.Y, z=p.Z))
            parts.append(rad_paths[i])  # one path per point
            _lighting_geometry.append(" ".join(parts))

        warn = ""
        if missing:
            warn = "WARNING: {} path(s) not found:\n  - {}\n".format(len(missing), "\n  - ".join(missing))

        example = _lighting_geometry[0] if _lighting_geometry else "(none)"
        out = "{}OK: {} line(s). Example → {}".format(warn, len(_lighting_geometry), example)

except Exception as e:
    out = "ERROR: {}".format(e)
# ---------- end lighting_geometry_2 ----------
merge = Merge(Data1=lighting_geometry.lighting_geometry, Data2=lighting_geometry_2.lighting_geometry)  # -> flatten(Result)
write_luminaries_file = Python3Script(folder=panel_4, lighting_geometry=flatten(merge), write=Toggle(True))  # -> out, lum_rad_path; inputs lighting_geometry: list
# ---------- write_luminaries_file: Python ----------
ghenv.Component.Message = """Kybele 0.1 Beta
Compile Luminaries"""



import os


def flatten_any(x):
    try:
        from ghpythonlib import treehelpers
        return list(treehelpers.flatten(x))
    except:
        pass

    try:
        bc = getattr(x, "BranchCount", None)
        if bc is not None:
            cnt = x.BranchCount if isinstance(bc, int) else x.BranchCount()
            flat = []
            for i in range(cnt):
                flat.extend(list(x.Branch(i)))
            return flat
    except:
        pass

    try:
        _ = len(x); return list(x)
    except:
        return [x]

def as_str_list(x):
    out = []
    for v in flatten_any(x):
        if v is None: 
            continue
        s = str(v).strip()
        if s:
            out.append(s)
    return out

def norm_folder(path_like):
    if not path_like:
        raise ValueError("No _folder provided.")
    p = os.path.abspath(str(path_like)).strip()
    if not p:
        raise ValueError("Empty _folder path.")
    return p

# main
lum_rad_path, out = None, ""

try:
    if _write:
        lines = as_str_list(_lighting_geometry)
        if not lines:
            raise ValueError("No xform lines in _lighting_geometry.")

        folder = norm_folder(_folder)
        parent_folder = os.path.dirname(folder.rstrip("\\/"))
        luminaire_folder = os.path.join(parent_folder, "Luminaire_files")

        if not os.path.isdir(luminaire_folder):
            raise ValueError("Luminaire_files folder not found:\n{}".format(luminaire_folder))

        fname = "luminaries.rad"
        lum_rad_path = os.path.join(luminaire_folder, fname)

        with open(lum_rad_path, "w", newline="\n") as f:
            f.write("# Auto-generated luminaire placement file\n")
            f.write("# Created by GH Python component: Electric lighting\n\n")
            for l in lines:
                if not l.endswith("\n"):
                    l += "\n"
                f.write(l)

        sample = lines[0] if lines else "(none)"
        out = "Wrote {} line(s) to:\n{}\nExample: {}".format(len(lines), lum_rad_path, sample)
    else:
        out = "Toggle _write to generate luminaries.rad."

except Exception as e:
    out = "ERROR: {}".format(e)
# ---------- end write_luminaries_file ----------
panel_21 = Panel(merge)
panel_22 = Panel(write_luminaries_file.lum_rad_path)

# ----
# Model Preparation
model = HBModel(faces=flatten([face.faces, face_2.faces, face_5.faces, face_3.faces, face_4.faces]), name="Greenhouse1")  # -> out, model; plug-in component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
vizwiref = HBVisualizeWireframe(hb_objs=flatten(model.model))  # -> geo; plug-in component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
panel_23 = Panel(model.model)
custom_preview_2 = CustomPreview(Geometry=vizwiref, Material=ColourSwatch(SwatchColor=RGB(168, 168, 168)))

# ----
# Analysis Grid
# Define the sensor grid resolution and
# height for daylight analysis.
# The model is in meters.
# In the example aboe, the grid points are
# spaced every 0.3m and
# raised from the floor 1.2 meters
# (assumed average plant surface)
number_slider_3 = Slider(0.3, range=0..20)
# CONVERSION FACTOR
# FROM ILLUMINANCE
# TO PPFD
number_slider_4 = Slider(1.2, range=0..20)
genpts = LBGeneratePointGrid(geometry=geometry_pipeline_2, grid_size=number_slider_3, offset_dist=number_slider_4)  # -> points, vectors, face_areas, mesh; plug-in component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
sensorgrid = HBSensorGrid(positions=genpts.points)  # -> grid; plug-in component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
assigngridsviews = HBAssignGridsAndViews(model=model.model, grids=flatten(sensorgrid))  # -> model; plug-in component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
panel_24 = Panel(genpts.points)

# ----
# Spectral Data
number_slider_5 = Slider(1, range=1..10)
python_3_script_6 = Python3Script(run=Button(), wavelength_interval=Slider(1, range=1..10))  # -> out, conversion_factor; inputs wavelength_interval: Int32
# ---------- python_3_script_6: Python ----------
ghenv.Component.Message = """Kybele 0.1 Beta
Spectral Data Selection"""




import os, csv

from System import EventHandler
from System.Windows.Forms import (
    Form, Button, Label, TextBox, OpenFileDialog,
    FlowLayoutPanel, DockStyle, DialogResult, Padding, FlowDirection,
    FormStartPosition, AutoScaleMode, LinkLabel, LinkArea
)
from System.Drawing import Size, Color, SizeF


try:
    _LAST_FACTOR
    _LAST_LABEL
except NameError:
    _LAST_FACTOR = None
    _LAST_LABEL  = None


H  = 6.62607015e-34
C  = 2.99792458e8
NA = 6.02214076e23

WL_MIN, WL_MAX, WL_STEP = 380, 780, _wavelength_interval
WL_LIST = list(range(WL_MIN, WL_MAX + _wavelength_interval, WL_STEP))



OPN1_1NM = [
0.0000390000,0.0000428264,0.0000469146,0.0000515896,0.0000571764,0.0000640000,0.0000723442,0.0000822122,0.0000935082,0.0001061361,
0.0001200000,0.0001349840,0.0001514920,0.0001702080,0.0001918160,0.0002170000,0.0002469067,0.0002812400,0.0003185200,0.0003572667,
0.0003960000,0.0004337147,0.0004730240,0.0005178760,0.0005722187,0.0006400000,0.0007245600,0.0008255000,0.0009411600,0.0010698800,
0.0012100000,0.0013620910,0.0015307520,0.0017203680,0.0019353230,0.0021800000,0.0024548000,0.0027640000,0.0031178000,0.0035264000,
0.0040000000,0.0045462400,0.0051593200,0.0058292800,0.0065461600,0.0073000000,0.0080865070,0.0089087200,0.0097676800,0.0106644300,
0.0116000000,0.0125731700,0.0135827200,0.0146296800,0.0157150900,0.0168400000,0.0180073600,0.0192144800,0.0204539200,0.0217182400,
0.0230000000,0.0242946100,0.0256102400,0.0269585700,0.0283512500,0.0298000000,0.0313108300,0.0328836800,0.0345211200,0.0362257100,
0.0380000000,0.0398466700,0.0417680000,0.0437660000,0.0458426700,0.0480000000,0.0502436800,0.0525730400,0.0549805600,0.0574587200,
0.0600000000,0.0626019700,0.0652775200,0.0680420800,0.0709110900,0.0739000000,0.0770160000,0.0802664000,0.0836668000,0.0872328000,
0.0909800000,0.0949175500,0.0990458400,0.1033674000,0.1078846000,0.1126000000,0.1175320000,0.1226744000,0.1279928000,0.1334528000,
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]

def opn1_at_nm(wl):
    return OPN1_1NM[wl - 380]

def to_float(x, default=0.0):
    if x is None: return default
    if isinstance(x, (int, float)): return float(x)
    s = str(x).strip().replace(",", "")
    if not s: return default
    try: return float(s)
    except: return default

def best_header_match(headers, words):
    ws = [w.lower() for w in words]
    for h in headers or []:
        hl = h.lower()
        if all(w in hl for w in ws):
            return h
    return None

def compute_cf_from_csv(path):
    """Read CSV (wavelength + spectral power), forward-fill onto WL_LIST, compute cf = s_lx/s_par."""
    with open(path, "r", encoding="utf-8-sig", newline="") as f:
        rdr = csv.DictReader(f)
        headers = list(rdr.fieldnames or [])
        wl_col = best_header_match(headers, ["wavelength"]) or best_header_match(headers, ["nm"]) or (headers[0] if headers else None)
        sp_col = (best_header_match(headers, ["spectral","power"]) or
                  best_header_match(headers, ["power"]) or
                  best_header_match(headers, ["spectral_power"]) or
                  best_header_match(headers, ["w","m2","nm"]) or
                  (headers[1] if headers and len(headers) > 1 else wl_col))

        raw = {}
        for row in rdr:
            wl = int(round(to_float(row.get(wl_col, None), 0.0)))
            sp = to_float(row.get(sp_col, None), 0.0)
            if WL_MIN <= wl <= WL_MAX:
                raw[wl] = sp


    spectral_power = {}
    last = None
    for wl in WL_LIST:
        if wl in raw:
            last = raw[wl]
        spectral_power[wl] = last if last is not None else 0.0



    # sums
    s_par = 0.0
    s_lx  = 0.0
    for wl in WL_LIST:
        equal_par = 1.0 if 400 <= wl <= 700 else 0.0
        par_spec  = (wl * equal_par * 1e-3) / (H * C * NA)
        opn1      = opn1_at_nm(wl)
        sp        = float(spectral_power.get(wl, 0.0))
        s_par += par_spec * sp
        s_lx  += opn1 * sp

    cf = (s_par / (s_lx*683)) if s_par != 0.0 else 0.0
    return s_par, s_lx, cf



STANDARD_SOURCES = [
    ("CIE-D55",     0.017833),
    ("CIE-D65",     0.018043),
    ("CIE-D75",     0.018345),
    ("CIE-HPS-1",   0.011640),
    ("CIE-HPS-5",   0.016180),
    ("CIE-LED-BH1", 0.013633),
    ("CIE-LED-V2",  0.017691)
]
DEFAULT_FACTOR = 0.018043



class ConversionFactorUI(Form):
    def __init__(self, last_factor=None, last_label=None):
        Form.__init__(self)

        self.SuspendLayout()
        self.AutoScaleMode = AutoScaleMode.Dpi
        self.AutoScaleDimensions = SizeF(96.0, 96.0)
        self.ClientSize = Size(560, 680)
        self.MinimumSize = Size(560, 420)
        self.StartPosition = FormStartPosition.CenterScreen
        self.Text = "Select Conversion Factor"
        self.BackColor = Color.White

        self.selected_label  = last_label
        self.selected_factor = last_factor if last_factor is not None else DEFAULT_FACTOR

        # Header
        self.header = LinkLabel()
        self.header.Text = "Choose a source for the illuminance to PAR conversion factor"
        self.header.AutoSize = True
        self.header.Dock = DockStyle.Top
        self.header.Padding = Padding(10, 10, 10, 0)
        self.header.LinkArea = LinkArea(0, 0)
        self.Controls.Add(self.header)

        # Main wrapper
        self.wrapper = FlowLayoutPanel()
        self.wrapper.Dock = DockStyle.Fill
        self.wrapper.FlowDirection = FlowDirection.TopDown
        self.wrapper.WrapContents = False
        self.wrapper.AutoScroll = True
        self.wrapper.Padding = Padding(10, 5, 10, 10)
        self.Controls.Add(self.wrapper)

        # Standard Sources
        self.add_group_title("Standard Sources")
        self.std_panel = FlowLayoutPanel()
        self.std_panel.FlowDirection = FlowDirection.TopDown
        self.std_panel.WrapContents = False
        self.std_panel.AutoSize = True
        self.wrapper.Controls.Add(self.std_panel)

        for name, val in STANDARD_SOURCES:
            btn = Button()
            btn.Text = f"{name}   =   {val:.6f}"
            btn.Height = 44
            btn.Margin = Padding(5, 4, 5, 4)
            btn.Tag = (name, val)
            btn.Click += EventHandler(self.pick_standard)
            self.std_panel.Controls.Add(btn)

        # Custom Spectra (CSV)
        self.add_group_title("Custom Spectra (CSV)")
        self.custom_panel = FlowLayoutPanel()
        self.custom_panel.FlowDirection = FlowDirection.TopDown
        self.custom_panel.WrapContents = False
        self.custom_panel.AutoSize = True
        self.wrapper.Controls.Add(self.custom_panel)

        self.custom_hint = Label()
        self.custom_hint.Text = (
            "Load a CSV or enter the conversion factor.\n"
            "Tip: if the CSV contains the pre calculated factor, open it to view and then paste the value here."
        )
        self.custom_hint.AutoSize = True
        self.custom_hint.Margin = Padding(5, 0, 5, 6)
        self.custom_panel.Controls.Add(self.custom_hint)

        self.open_btn = Button()
        self.open_btn.Text = "Open CSV…"
        self.open_btn.Height = 40
        self.open_btn.Click += EventHandler(self.open_csv_and_compute)
        self.custom_panel.Controls.Add(self.open_btn)

        self.factor_row = FlowLayoutPanel()
        self.factor_row.FlowDirection = FlowDirection.LeftToRight
        self.factor_row.AutoSize = True
        self.factor_row.Margin = Padding(5, 6, 5, 6)
        self.custom_panel.Controls.Add(self.factor_row)

        self.factor_lbl = Label()
        self.factor_lbl.Text = "Factor:"
        self.factor_lbl.Width = 60
        self.factor_lbl.AutoSize = False
        self.factor_row.Controls.Add(self.factor_lbl)

        self.factor_box = TextBox()
        self.factor_box.Width = 140
        self.factor_box.Text = f"{self.selected_factor:.6f}"
        self.factor_row.Controls.Add(self.factor_box)

        self.use_custom_btn = Button()
        self.use_custom_btn.Text = "Use this factor"
        self.use_custom_btn.Height = 22
        self.use_custom_btn.Width = 150
        self.use_custom_btn.Click += EventHandler(self.use_custom)
        self.factor_row.Controls.Add(self.use_custom_btn)

        # Footer
        self.selection_lbl = Label()
        self.selection_lbl.AutoSize = True
        self.selection_lbl.Padding = Padding(10, 6, 10, 6)
        self.update_selection_label()
        self.wrapper.Controls.Add(self.selection_lbl)

        self.ok_btn = Button()
        self.ok_btn.Text = "Set Factor and Close"
        self.ok_btn.Height = 44
        self.ok_btn.Margin = Padding(5, 8, 5, 10)
        self.ok_btn.Click += EventHandler(self.confirm_and_close)
        self.wrapper.Controls.Add(self.ok_btn)

        # Resize
        self.Resize += EventHandler(self.resize_fullwidth)
        self.Resize += EventHandler(self.fit_header_width)
        self.wrapper.SizeChanged += EventHandler(self.resize_fullwidth)

        # layout
        self.fit_header_width(None, None)
        self.resize_fullwidth(None, None)
        self.ResumeLayout(False)
        self.PerformLayout()
        self.Shown += lambda *_: (self.CenterToScreen(), self.Invalidate(True))

    # sizing
    def usable_wrapper_width(self):
        return max(
            100,
            self.wrapper.ClientSize.Width - (self.wrapper.Padding.Left + self.wrapper.Padding.Right)
        )

    def fit_header_width(self, sender, e):
        self.header.MaximumSize = Size(self.usable_wrapper_width(), 0)

    def add_group_title(self, text):
        lbl = Label()
        lbl.Text = text
        lbl.AutoSize = True
        lbl.Padding = Padding(5, 10, 5, 6)
        self.wrapper.Controls.Add(lbl)

    def resize_fullwidth(self, sender, e):
        usable = self.usable_wrapper_width()
        for pnl in (self.std_panel, self.custom_panel):
            pnl.Width = usable
            for c in pnl.Controls:
                if isinstance(c, Button) and c is not self.use_custom_btn:
                    c.Width = max(10, usable - 10)
        self.open_btn.Width = max(10, usable - 10)
        self.ok_btn.Width   = usable
        self.fit_header_width(None, None)

    def update_selection_label(self):
        name = self.selected_label if self.selected_label else "Selected"
        self.selection_lbl.Text = f"{name}:  {self.selected_factor:.6f}"

    # events
    def pick_standard(self, sender, e):
        name, val = sender.Tag
        self.selected_label = name
        self.selected_factor = float(val)
        self.factor_box.Text = f"{self.selected_factor:.6f}"
        self.update_selection_label()

    def open_csv_and_compute(self, sender, e):
        dlg = OpenFileDialog()
        dlg.Filter = "CSV files (*.csv)|*.csv|All files (*.*)|*.*"
        if dlg.ShowDialog() == DialogResult.OK:
            try:
                s_par, s_lx, cf = compute_cf_from_csv(dlg.FileName)
                self.selected_label  = os.path.basename(dlg.FileName)
                self.selected_factor = float(cf)
                self.factor_box.Text = f"{self.selected_factor:.6f}"
                self.update_selection_label()
            except Exception as ex:
                print("CSV parse/compute error:", ex)

    def use_custom(self, sender, e):
        try:
            val = float(self.factor_box.Text)
            self.selected_factor = val
            self.selected_label = "Custom (CSV)"
            self.update_selection_label()
        except:
            pass

    def confirm_and_close(self, sender, e):
        self.DialogResult = DialogResult.OK
        self.Close()


_conversion_factor = _LAST_FACTOR if _LAST_FACTOR is not None else None

if _run:
    ui  = ConversionFactorUI(last_factor=_LAST_FACTOR, last_label=_LAST_LABEL)
    res = ui.ShowDialog()
    if res == DialogResult.OK:
        _conversion_factor = ui.selected_factor
        _LAST_FACTOR = ui.selected_factor
        _LAST_LABEL  = ui.selected_label
else:
    _conversion_factor = _LAST_FACTOR
# ---------- end python_3_script_6 ----------
python_3_script_7 = Python3Script(load_spectral_data=Button(), wavelength_interval=Slider(1, range=1..10))  # -> out, conversion_factor; inputs wavelength_interval: Int32
# ---------- python_3_script_7: Python ----------
ghenv.Component.Message = """Kybele 0.1 Beta
Load Spectral Data"""

import csv, os
import scriptcontext as sc

import System
from System import EventHandler
import System.Windows.Forms as WinForms
from System.Windows.Forms import (
    Form, Panel, Button, Label, TextBox, OpenFileDialog, SaveFileDialog,
    DataGridView, DataGridViewAutoSizeColumnsMode, DataGridViewSelectionMode,
    DockStyle, AnchorStyles, DataGridViewCellBorderStyle, TableLayoutPanel,
    ColumnStyle, SizeType, Padding
)
from System.Drawing import Size, Point, Font, FontStyle, Color

def _push_update():
    try:
        ghenv.Component.ExpireSolution(True)
    except:
        pass


H  = 6.62607015e-34
C  = 2.99792458e8
NA = 6.02214076e23


WL_MIN, WL_MAX = 380, 780
try:
    WL_STEP = int(_wavelength_interval)
except:
    WL_STEP = 1
if WL_STEP <= 0:
    WL_STEP = 1


WL_LIST = []
w = WL_MIN
while w <= WL_MAX:
    WL_LIST.append(w)
    w += WL_STEP
if WL_LIST[-1] != WL_MAX and WL_MAX - WL_LIST[-1] < WL_STEP:

    pass


OPN1_1NM = [
0.0000390000,0.0000428264,0.0000469146,0.0000515896,0.0000571764,0.0000640000,0.0000723442,0.0000822122,0.0000935082,0.0001061361,
0.0001200000,0.0001349840,0.0001514920,0.0001702080,0.0001918160,0.0002170000,0.0002469067,0.0002812400,0.0003185200,0.0003572667,
0.0003960000,0.0004337147,0.0004730240,0.0005178760,0.0005722187,0.0006400000,0.0007245600,0.0008255000,0.0009411600,0.0010698800,
0.0012100000,0.0013620910,0.0015307520,0.0017203680,0.0019353230,0.0021800000,0.0024548000,0.0027640000,0.0031178000,0.0035264000,
0.0040000000,0.0045462400,0.0051593200,0.0058292800,0.0065461600,0.0073000000,0.0080865070,0.0089087200,0.0097676800,0.0106644300,
0.0116000000,0.0125731700,0.0135827200,0.0146296800,0.0157150900,0.0168400000,0.0180073600,0.0192144800,0.0204539200,0.0217182400,
0.0230000000,0.0242946100,0.0256102400,0.0269585700,0.0283512500,0.0298000000,0.0313108300,0.0328836800,0.0345211200,0.0362257100,
0.0380000000,0.0398466700,0.0417680000,0.0437660000,0.0458426700,0.0480000000,0.0502436800,0.0525730400,0.0549805600,0.0574587200,
0.0600000000,0.0626019700,0.0652775200,0.0680420800,0.0709110900,0.0739000000,0.0770160000,0.0802664000,0.0836668000,0.0872328000,
0.0909800000,0.0949175500,0.0990458400,0.1033674000,0.1078846000,0.1126000000,0.1175320000,0.1226744000,0.1279928000,0.1334528000,
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]

def opn1_at_nm(wl):
    return OPN1_1NM[wl - WL_MIN]

def to_float(x, default=0.0):
    if x is None: return default
    if isinstance(x, (int, float)): return float(x)
    s = str(x).strip().replace(",", "")
    if not s: return default
    try: return float(s)
    except: return default

def best_header_match(headers, words):
    ws = [w.lower() for w in words]
    for h in headers:
        hl = h.lower()
        if all(w in hl for w in ws):
            return h
    return None


class SpectralForm(Form):
    def __init__(self, on_update=None):
        Form.__init__(self)
        self._on_update = on_update
        self.Text = "Spectral Data"
        self.Size = Size(1180, 620)
        self.MinimumSize = Size(900, 620)

        # TOP
        self.top = Panel()
        self.top.Dock = DockStyle.Top
        self.top.BackColor = Color.White
        self.top.Height = 250
        self.top.Padding = Padding(10, 10, 10, 10)

        self.lbl_header = Label()
        self.lbl_header.Text = "SPECTRAL DATA"
        self.lbl_header.Font = Font("Segoe UI", 14, FontStyle.Bold)
        self.lbl_header.AutoSize = True
        self.lbl_header.Location = Point(40, 10)

        self.btn_load = Button()
        self.btn_load.Text = "Load Spectral Data"
        self.btn_load.Location = Point(40, 100)
        self.btn_load.Font = Font("Segoe UI", 9, FontStyle.Bold)
        self.btn_load.Height = 30
        self.btn_load.Dock = DockStyle.Top
        self.btn_load.Margin = Padding(0, 36, 0, 10)
        self.btn_load.Click += EventHandler(self.on_load_spectral)

        self.lbl_calc = Label()
        self.lbl_calc.Text = "Conversion Factor Calculation"
        self.lbl_calc.Font = Font("Segoe UI", 10, FontStyle.Regular)
        self.lbl_calc.AutoSize = True
        self.lbl_calc.Location = Point(10, 60)

        self.txt_cf = TextBox()
        self.txt_cf.ReadOnly = True
        self.txt_cf.Font = Font("Segoe UI", 11, FontStyle.Bold)
        self.txt_cf.Location = Point(10, 85)
        self.txt_cf.Size = Size(220, 28)

        self.btn_update = Button()
        self.btn_update.Text = "Update Conversion Factor"
        self.btn_update.Location = Point(240, 85)
        self.btn_update.Size = Size(220, 30)
        self.btn_update.Click += EventHandler(self.update_conversion)

        # 30/70 split row
        self.splitRow = TableLayoutPanel()
        self.splitRow.ColumnCount = 2
        self.splitRow.RowCount = 1
        self.splitRow.Dock = DockStyle.Bottom
        self.splitRow.AutoSize = False
        self.splitRow.Height = 35
        self.splitRow.Margin = Padding(0, 0, 0, 0)
        self.splitRow.Padding = Padding(0)
        self.splitRow.ColumnStyles.Clear()
        self.splitRow.ColumnStyles.Add(ColumnStyle(SizeType.Percent, 30.0))
        self.splitRow.ColumnStyles.Add(ColumnStyle(SizeType.Percent, 70.0))

        self.btn_save = Button()
        self.btn_save.Text = "Save as CSV File"
        self.btn_save.Dock = DockStyle.Top
        self.btn_save.Height = 30
        self.btn_save.Click += EventHandler(self.save_as_csv)

        self.btn_setclose = Button()
        self.btn_setclose.Text = "Set conversion factor and close"
        self.btn_setclose.Dock = DockStyle.Top
        self.btn_setclose.Height = 30
        self.btn_setclose.Click += EventHandler(self.set_and_close)

        self.splitRow.Controls.Add(self.btn_save, 0, 0)
        self.splitRow.Controls.Add(self.btn_setclose, 1, 0)

        self.lbl_file = Label()
        self.lbl_file.Text = "Calculated: (No file loaded)"
        self.lbl_file.AutoSize = True
        self.lbl_file.Location = Point(10, 125)

        self.lbl_sum_par = Label()
        self.lbl_sum_par.Text = "Sum of Calculated PAR: -"
        self.lbl_sum_par.AutoSize = True
        self.lbl_sum_par.Location = Point(10, 145)

        self.lbl_sum_lx = Label()
        self.lbl_sum_lx.Text = "Sum of Calculated Lx: -"
        self.lbl_sum_lx.AutoSize = True
        self.lbl_sum_lx.Location = Point(10, 165)

        self.top.Controls.Add(self.splitRow)
        self.top.Controls.Add(self.btn_load)
        self.top.Controls.Add(self.lbl_header)
        self.top.Controls.Add(self.lbl_calc)
        self.top.Controls.Add(self.txt_cf)
        self.top.Controls.Add(self.btn_update)
        self.top.Controls.Add(self.lbl_file)
        self.top.Controls.Add(self.lbl_sum_par)
        self.top.Controls.Add(self.lbl_sum_lx)

        # GRID
        self.bottom = Panel()
        self.bottom.Dock = DockStyle.Fill

        self.grid = DataGridView()
        self.grid.Dock = DockStyle.Fill
        self.grid.AutoSizeColumnsMode = DataGridViewAutoSizeColumnsMode.Fill
        self.grid.SelectionMode = DataGridViewSelectionMode.FullRowSelect

        grey = Color.Gainsboro
        self.grid.DefaultCellStyle.SelectionBackColor = grey
        self.grid.DefaultCellStyle.SelectionForeColor = Color.Black
        self.grid.AlternatingRowsDefaultCellStyle.SelectionBackColor = grey
        self.grid.AlternatingRowsDefaultCellStyle.SelectionForeColor = Color.Black

        self.grid.EnableHeadersVisualStyles = False
        self.grid.ColumnHeadersDefaultCellStyle.SelectionBackColor = grey
        self.grid.ColumnHeadersDefaultCellStyle.SelectionForeColor = Color.Black

        self.grid.AllowUserToAddRows = False
        self.grid.AllowUserToDeleteRows = False
        self.grid.ReadOnly = True
        self.grid.RowHeadersVisible = False
        self.grid.EnableHeadersVisualStyles = False
        self.grid.ColumnHeadersDefaultCellStyle.Font = Font("Segoe UI", 10, FontStyle.Bold)
        self.grid.GridColor = Color.LightGray
        self.grid.CellBorderStyle = DataGridViewCellBorderStyle.SingleHorizontal
        self.grid.ColumnHeadersBorderStyle = WinForms.DataGridViewHeaderBorderStyle.Single

        self.bottom.Controls.Add(self.grid)
        self.Controls.Add(self.bottom)
        self.Controls.Add(self.top)

        # data
        self.rows = []
        self.spectral_power = {}
        self.loaded_path = None
        self.init_rows()
        self.refresh_grid()
        self.update_conversion(None, None)

 
    def init_rows(self):
        self.rows = []
        for wl in WL_LIST:
            equal_par = 1.0 if 400 <= wl <= 700 else 0.0
            par_spec = (wl * equal_par * 1e-3) / (H * C * NA)
            self.rows.append({
                "Wavelength (nm)": wl,
                "Equal PAR": equal_par,
                "PAR Spectral": par_spec,
                "OPN1": opn1_at_nm(wl),
                "Spectral Power (W/m2/nm1)": 0.0,
                "Calculated PAR": 0.0,
                "Calculated Lx": 0.0
            })

    def refresh_grid(self):
        for r in self.rows:
            wl = r["Wavelength (nm)"]
            sp = float(self.spectral_power.get(wl, 0.0))
            r["Spectral Power (W/m2/nm1)"] = sp
            r["Calculated PAR"] = r["PAR Spectral"] * sp
            r["Calculated Lx"]  = r["OPN1"] * sp

        from System.Data import DataTable
        dt = DataTable("Grid")
        cols = ["Wavelength (nm)", "Equal PAR", "PAR Spectral", "OPN1",
                "Spectral Power (W/m2/nm1)", "Calculated PAR", "Calculated Lx"]
        for c in cols: dt.Columns.Add(c)
        for r in self.rows:
            row = dt.NewRow()
            for c in cols: row[c] = r[c]
            dt.Rows.Add(row)
        self.grid.DataSource = dt

    def on_load_spectral(self, sender, args):
        dlg = OpenFileDialog()
        dlg.Title = "Select spectral CSV (wavelength + spectral power)"
        dlg.Filter = "CSV files (*.csv)|*.csv|All files (*.*)|*.*"
        if dlg.ShowDialog() != WinForms.DialogResult.OK:
            return
        try:
            with open(dlg.FileName, "r", encoding="utf-8-sig", newline="") as f:
                rdr = csv.DictReader(f)
                headers = list(rdr.fieldnames or [])
                wl_col = best_header_match(headers, ["wavelength"]) or best_header_match(headers, ["nm"]) or headers[0]
                sp_col = (best_header_match(headers, ["spectral","power"]) or
                          best_header_match(headers, ["power"]) or
                          best_header_match(headers, ["spectral_power"]) or
                          best_header_match(headers, ["w","m2","nm"]) or
                          (headers[1] if len(headers) > 1 else headers[0]))
                raw = {}
                for row in rdr:
                    wl = int(round(to_float(row.get(wl_col, None), 0.0)))
                    sp = to_float(row.get(sp_col, None), 0.0)
                    raw[wl] = sp

                filled, last = {}, None
                for wl in WL_LIST:
                    if wl in raw:
                        last = raw[wl]
                    filled[wl] = last if last is not None else 0.0
                self.spectral_power = filled
                self.loaded_path = dlg.FileName
                self.lbl_file.Text = "Calculated: {}".format(os.path.basename(self.loaded_path))
            self.refresh_grid()
            self.update_conversion(None, None)
        except Exception as e:
            WinForms.MessageBox.Show("Failed to read CSV:\n{}".format(e))

    def sums(self):
        s_par, s_lx = 0.0, 0.0
        for r in self.rows:
            wl = r["Wavelength (nm)"]
            sp = float(self.spectral_power.get(wl, 0.0))
            s_par += r["PAR Spectral"] * sp
            s_lx  += r["OPN1"] * sp
        return s_par, s_lx

    def update_conversion(self, sender, args):
        s_par, s_lx = self.sums()
        cf = (s_par / (s_lx*683)) if s_par != 0.0 else 0.0
        self.txt_cf.Text = "{:.9f}".format(cf)
        self.lbl_sum_par.Text = "Sum of Calculated PAR: {:.6f}".format(s_par)
        self.lbl_sum_lx.Text  = "Sum of Calculated Lx: {:.6f}".format(s_lx)
        sc.sticky["__PARCF_SUMS__"] = (s_par, s_lx, cf)
        self.refresh_grid()
        _push_update()

    def save_as_csv(self, sender, args):
        if not self.loaded_path:
            WinForms.MessageBox.Show("Please load a spectral CSV first.")
            return
        base = os.path.basename(self.loaded_path)
        name, ext = os.path.splitext(base)
        out_path = os.path.join(os.path.dirname(self.loaded_path), name + "_calculated.csv")
        cols = ["Wavelength (nm)", "Equal PAR", "PAR Spectral", "OPN1",
                "Spectral Power (W/m2/nm1)", "Calculated PAR", "Calculated Lx"]
        try:
            with open(out_path, "w", encoding="utf-8", newline="") as f:
                w = csv.writer(f)
                w.writerow(cols)
                for r in self.rows:
                    w.writerow([r[c] for c in cols])
                s_par, s_lx = self.sums()
                cf = (s_lx / s_par) if s_par != 0.0 else 0.0
                w.writerow([])
                w.writerow(["Calculated file", os.path.basename(self.loaded_path)])
                w.writerow(["Sum of Calculated PAR", s_par])
                w.writerow(["Sum of Calculated Lx", s_lx])
                w.writerow(["Conversion Factor (Lx/PAR)", cf])
            WinForms.MessageBox.Show('Saved:\n{}'.format(out_path))
        except Exception as e:
            WinForms.MessageBox.Show("Failed to save CSV:\n{}".format(e))

    def set_and_close(self, sender, args):
        self.update_conversion(None, None)
        _push_update()
        self.Close()


key = "__SPECTRAL_CF_FORM__"
if _load_spectral_data:
    frm = sc.sticky.get(key, None)
    if frm is None or frm.IsDisposed:
        frm = SpectralForm(on_update=_push_update)
        sc.sticky[key] = frm
        frm.Show()
    else:
        frm.Activate()

s_par, s_lx, cf = sc.sticky.get("__PARCF_SUMS__", (0.0, 0.0, 0.0))
_conversion_factor = float(cf)
# ---------- end python_3_script_7 ----------
python_3_script_8 = Python3Script(run=Button(), wavelength_interval=number_slider_5)  # -> out, conversion_factor; inputs wavelength_interval: Int32
# ---------- python_3_script_8: Python ----------
ghenv.Component.Message = """Kybele 0.1 Beta
Spectral Data Selection"""




import os, csv

from System import EventHandler
from System.Windows.Forms import (
    Form, Button, Label, TextBox, OpenFileDialog,
    FlowLayoutPanel, DockStyle, DialogResult, Padding, FlowDirection,
    FormStartPosition, AutoScaleMode, LinkLabel, LinkArea
)
from System.Drawing import Size, Color, SizeF


try:
    _LAST_FACTOR
    _LAST_LABEL
except NameError:
    _LAST_FACTOR = None
    _LAST_LABEL  = None


H  = 6.62607015e-34
C  = 2.99792458e8
NA = 6.02214076e23

WL_MIN, WL_MAX, WL_STEP = 380, 780, _wavelength_interval
WL_LIST = list(range(WL_MIN, WL_MAX + _wavelength_interval, WL_STEP))


OPN1_1NM = [
0.0000390000,0.0000428264,0.0000469146,0.0000515896,0.0000571764,0.0000640000,0.0000723442,0.0000822122,0.0000935082,0.0001061361,
0.0001200000,0.0001349840,0.0001514920,0.0001702080,0.0001918160,0.0002170000,0.0002469067,0.0002812400,0.0003185200,0.0003572667,
0.0003960000,0.0004337147,0.0004730240,0.0005178760,0.0005722187,0.0006400000,0.0007245600,0.0008255000,0.0009411600,0.0010698800,
0.0012100000,0.0013620910,0.0015307520,0.0017203680,0.0019353230,0.0021800000,0.0024548000,0.0027640000,0.0031178000,0.0035264000,
0.0040000000,0.0045462400,0.0051593200,0.0058292800,0.0065461600,0.0073000000,0.0080865070,0.0089087200,0.0097676800,0.0106644300,
0.0116000000,0.0125731700,0.0135827200,0.0146296800,0.0157150900,0.0168400000,0.0180073600,0.0192144800,0.0204539200,0.0217182400,
0.0230000000,0.0242946100,0.0256102400,0.0269585700,0.0283512500,0.0298000000,0.0313108300,0.0328836800,0.0345211200,0.0362257100,
0.0380000000,0.0398466700,0.0417680000,0.0437660000,0.0458426700,0.0480000000,0.0502436800,0.0525730400,0.0549805600,0.0574587200,
0.0600000000,0.0626019700,0.0652775200,0.0680420800,0.0709110900,0.0739000000,0.0770160000,0.0802664000,0.0836668000,0.0872328000,
0.0909800000,0.0949175500,0.0990458400,0.1033674000,0.1078846000,0.1126000000,0.1175320000,0.1226744000,0.1279928000,0.1334528000,
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]

def opn1_at_nm(wl):
    return OPN1_1NM[wl - 380]

def to_float(x, default=0.0):
    if x is None: return default
    if isinstance(x, (int, float)): return float(x)
    s = str(x).strip().replace(",", "")
    if not s: return default
    try: return float(s)
    except: return default

def best_header_match(headers, words):
    ws = [w.lower() for w in words]
    for h in headers or []:
        hl = h.lower()
        if all(w in hl for w in ws):
            return h
    return None

def compute_cf_from_csv(path):
    """Read CSV (wavelength + spectral power), forward-fill onto WL_LIST, compute cf = s_lx/s_par."""
    with open(path, "r", encoding="utf-8-sig", newline="") as f:
        rdr = csv.DictReader(f)
        headers = list(rdr.fieldnames or [])
        wl_col = best_header_match(headers, ["wavelength"]) or best_header_match(headers, ["nm"]) or (headers[0] if headers else None)
        sp_col = (best_header_match(headers, ["spectral","power"]) or
                  best_header_match(headers, ["power"]) or
                  best_header_match(headers, ["spectral_power"]) or
                  best_header_match(headers, ["w","m2","nm"]) or
                  (headers[1] if headers and len(headers) > 1 else wl_col))

        raw = {}
        for row in rdr:
            wl = int(round(to_float(row.get(wl_col, None), 0.0)))
            sp = to_float(row.get(sp_col, None), 0.0)
            if WL_MIN <= wl <= WL_MAX:
                raw[wl] = sp

    # forward-fill
    spectral_power = {}
    last = None
    for wl in WL_LIST:
        if wl in raw:
            last = raw[wl]
        spectral_power[wl] = last if last is not None else 0.0

    # sums
    s_par = 0.0
    s_lx  = 0.0
    for wl in WL_LIST:
        equal_par = 1.0 if 400 <= wl <= 700 else 0.0
        par_spec  = (wl * equal_par * 1e-3) / (H * C * NA)
        opn1      = opn1_at_nm(wl)
        sp        = float(spectral_power.get(wl, 0.0))
        s_par += par_spec * sp
        s_lx  += opn1 * sp

    cf = (s_par / (s_lx*683)) if s_par != 0.0 else 0.0
    return s_par, s_lx, cf


STANDARD_SOURCES = [
    ("CIE-D55",     0.017833),
    ("CIE-D65",     0.018043),
    ("CIE-D75",     0.018345),
    ("CIE-HPS-1",   0.011640),
    ("CIE-HPS-5",   0.016180),
    ("CIE-LED-BH1", 0.013633),
    ("CIE-LED-V2",  0.017691)
]
DEFAULT_FACTOR = 0.018043




class ConversionFactorUI(Form):
    def __init__(self, last_factor=None, last_label=None):
        Form.__init__(self)

        self.SuspendLayout()
        self.AutoScaleMode = AutoScaleMode.Dpi
        self.AutoScaleDimensions = SizeF(96.0, 96.0)
        self.ClientSize = Size(560, 680)
        self.MinimumSize = Size(560, 420)
        self.StartPosition = FormStartPosition.CenterScreen
        self.Text = "Select Conversion Factor"
        self.BackColor = Color.White

        self.selected_label  = last_label
        self.selected_factor = last_factor if last_factor is not None else DEFAULT_FACTOR

        # Header
        self.header = LinkLabel()
        self.header.Text = "Choose a source for the illuminance to PAR conversion factor"
        self.header.AutoSize = True
        self.header.Dock = DockStyle.Top
        self.header.Padding = Padding(10, 10, 10, 0)
        self.header.LinkArea = LinkArea(0, 0)
        self.Controls.Add(self.header)

        # Main wrapper
        self.wrapper = FlowLayoutPanel()
        self.wrapper.Dock = DockStyle.Fill
        self.wrapper.FlowDirection = FlowDirection.TopDown
        self.wrapper.WrapContents = False
        self.wrapper.AutoScroll = True
        self.wrapper.Padding = Padding(10, 5, 10, 10)
        self.Controls.Add(self.wrapper)

        # Standard Sources
        self.add_group_title("Standard Sources")
        self.std_panel = FlowLayoutPanel()
        self.std_panel.FlowDirection = FlowDirection.TopDown
        self.std_panel.WrapContents = False
        self.std_panel.AutoSize = True
        self.wrapper.Controls.Add(self.std_panel)

        for name, val in STANDARD_SOURCES:
            btn = Button()
            btn.Text = f"{name}   =   {val:.6f}"
            btn.Height = 44
            btn.Margin = Padding(5, 4, 5, 4)
            btn.Tag = (name, val)
            btn.Click += EventHandler(self.pick_standard)
            self.std_panel.Controls.Add(btn)

        # Custom Spectra (CSV)
        self.add_group_title("Custom Spectra (CSV)")
        self.custom_panel = FlowLayoutPanel()
        self.custom_panel.FlowDirection = FlowDirection.TopDown
        self.custom_panel.WrapContents = False
        self.custom_panel.AutoSize = True
        self.wrapper.Controls.Add(self.custom_panel)

        self.custom_hint = Label()
        self.custom_hint.Text = (
            "Load a CSV or enter the conversion factor.\n"
            "Tip: if the CSV contains the pre calculated factor, open it to view and then paste the value here."
        )
        self.custom_hint.AutoSize = True
        self.custom_hint.Margin = Padding(5, 0, 5, 6)
        self.custom_panel.Controls.Add(self.custom_hint)

        self.open_btn = Button()
        self.open_btn.Text = "Open CSV…"
        self.open_btn.Height = 40
        self.open_btn.Click += EventHandler(self.open_csv_and_compute)
        self.custom_panel.Controls.Add(self.open_btn)

        self.factor_row = FlowLayoutPanel()
        self.factor_row.FlowDirection = FlowDirection.LeftToRight
        self.factor_row.AutoSize = True
        self.factor_row.Margin = Padding(5, 6, 5, 6)
        self.custom_panel.Controls.Add(self.factor_row)

        self.factor_lbl = Label()
        self.factor_lbl.Text = "Factor:"
        self.factor_lbl.Width = 60
        self.factor_lbl.AutoSize = False
        self.factor_row.Controls.Add(self.factor_lbl)

        self.factor_box = TextBox()
        self.factor_box.Width = 140
        self.factor_box.Text = f"{self.selected_factor:.6f}"
        self.factor_row.Controls.Add(self.factor_box)

        self.use_custom_btn = Button()
        self.use_custom_btn.Text = "Use this factor"
        self.use_custom_btn.Height = 22
        self.use_custom_btn.Width = 150
        self.use_custom_btn.Click += EventHandler(self.use_custom)
        self.factor_row.Controls.Add(self.use_custom_btn)

        # Footer
        self.selection_lbl = Label()
        self.selection_lbl.AutoSize = True
        self.selection_lbl.Padding = Padding(10, 6, 10, 6)
        self.update_selection_label()
        self.wrapper.Controls.Add(self.selection_lbl)

        self.ok_btn = Button()
        self.ok_btn.Text = "Set Factor and Close"
        self.ok_btn.Height = 44
        self.ok_btn.Margin = Padding(5, 8, 5, 10)
        self.ok_btn.Click += EventHandler(self.confirm_and_close)
        self.wrapper.Controls.Add(self.ok_btn)

        # Resize
        self.Resize += EventHandler(self.resize_fullwidth)
        self.Resize += EventHandler(self.fit_header_width)
        self.wrapper.SizeChanged += EventHandler(self.resize_fullwidth)

        # layout
        self.fit_header_width(None, None)
        self.resize_fullwidth(None, None)
        self.ResumeLayout(False)
        self.PerformLayout()
        self.Shown += lambda *_: (self.CenterToScreen(), self.Invalidate(True))

    # sizing
    def usable_wrapper_width(self):
        return max(
            100,
            self.wrapper.ClientSize.Width - (self.wrapper.Padding.Left + self.wrapper.Padding.Right)
        )

    def fit_header_width(self, sender, e):
        self.header.MaximumSize = Size(self.usable_wrapper_width(), 0)

    def add_group_title(self, text):
        lbl = Label()
        lbl.Text = text
        lbl.AutoSize = True
        lbl.Padding = Padding(5, 10, 5, 6)
        self.wrapper.Controls.Add(lbl)

    def resize_fullwidth(self, sender, e):
        usable = self.usable_wrapper_width()
        for pnl in (self.std_panel, self.custom_panel):
            pnl.Width = usable
            for c in pnl.Controls:
                if isinstance(c, Button) and c is not self.use_custom_btn:
                    c.Width = max(10, usable - 10)
        self.open_btn.Width = max(10, usable - 10)
        self.ok_btn.Width   = usable
        self.fit_header_width(None, None)

    def update_selection_label(self):
        name = self.selected_label if self.selected_label else "Selected"
        self.selection_lbl.Text = f"{name}:  {self.selected_factor:.6f}"

    # events
    def pick_standard(self, sender, e):
        name, val = sender.Tag
        self.selected_label = name
        self.selected_factor = float(val)
        self.factor_box.Text = f"{self.selected_factor:.6f}"
        self.update_selection_label()

    def open_csv_and_compute(self, sender, e):
        dlg = OpenFileDialog()
        dlg.Filter = "CSV files (*.csv)|*.csv|All files (*.*)|*.*"
        if dlg.ShowDialog() == DialogResult.OK:
            try:
                s_par, s_lx, cf = compute_cf_from_csv(dlg.FileName)
                self.selected_label  = os.path.basename(dlg.FileName)
                self.selected_factor = float(cf)
                self.factor_box.Text = f"{self.selected_factor:.6f}"
                self.update_selection_label()
            except Exception as ex:
                print("CSV parse/compute error:", ex)

    def use_custom(self, sender, e):
        try:
            val = float(self.factor_box.Text)
            self.selected_factor = val
            self.selected_label = "Custom (CSV)"
            self.update_selection_label()
        except:
            pass

    def confirm_and_close(self, sender, e):
        self.DialogResult = DialogResult.OK
        self.Close()



_conversion_factor = _LAST_FACTOR if _LAST_FACTOR is not None else None

if _run:
    ui  = ConversionFactorUI(last_factor=_LAST_FACTOR, last_label=_LAST_LABEL)
    res = ui.ShowDialog()
    if res == DialogResult.OK:
        _conversion_factor = ui.selected_factor
        _LAST_FACTOR = ui.selected_factor
        _LAST_LABEL  = ui.selected_label
else:
    _conversion_factor = _LAST_FACTOR
# ---------- end python_3_script_8 ----------
panel_25 = Panel(python_3_script_6.conversion_factor)
panel_26 = Panel(python_3_script_8.conversion_factor)
panel_27 = Panel(python_3_script_7.conversion_factor)

# ----
# Point In Time Illuminance
# -ab 1 -ad 256 -aa 0.2 -ar 32 -lr 4 -lw 1e-3
# 4
# Spectral Materials
# Spectral Glazing Materials
# GenSky Matrix for Spectral Annual Simulation
lb_falsestarttoggle_7 = LBFalseStartToggle(True)
modeltorad = HBModelToRadFolder(model=assigngridsviews, folder=panel, write=lb_falsestarttoggle_7)  # -> out, folder; plug-in component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
panel_28 = Panel(modeltorad.folder)
select_hour_index = Button()
python_3_script_9 = Python3Script(run=select_hour_index)  # -> hour_index
# ---------- python_3_script_9: Python ----------
from System.Windows.Forms import (
    Form, MonthCalendar, Panel, Label, ComboBox, Button,
    RadioButton, FormBorderStyle, FormStartPosition, ComboBoxStyle,
    MessageBox
)
from System.Drawing import Point, Size, Font, FontStyle, ContentAlignment, Color
from System import DateTime
import scriptcontext as sc
import Rhino

# Sticky key
key = 'selected_hour_index'

if _run:

    class CalendarForm(Form):
        def __init__(self):
            Form.__init__(self)
            
            self.Text = "Select Date and Hour"
            self.Size = Size(353, 420)
            self.BackColor = Color.White
            self.StartPosition = self.StartPosition.CenterScreen
            self.FormBorderStyle = self.FormBorderStyle.FixedDialog
            self.MaximizeBox = False
            self.MinimizeBox = False

            # Calendar
            self.calendar = MonthCalendar()
            self.calendar.Location = Point(10, 10)
            self.calendar.MaxSelectionCount = 1
            self.calendar.ShowToday = False
            self.calendar.ShowTodayCircle = False
            self.Controls.Add(self.calendar)

            # month label
            self.calendar.DateChanged += self.update_month_label
            # Block Feb 29
            self.calendar.DateChanged += self.block_feb_29

            # YEAR
            self.header_cover = Panel()
            self.header_cover.Size = Size(200, 30)
            self.header_cover.Location = Point(70, 35)
            self.header_cover.BackColor = Color.White
            self.Controls.Add(self.header_cover)
            self.header_cover.BringToFront()

            # Custom Label month
            self.month_label = Label()
            self.month_label.Text = self.calendar.SelectionStart.ToString("MMMMMMM")
            self.month_label.Location = Point(90, 32)
            self.month_label.Size = Size(150, 30)
            self.month_label.Font = Font("Segoe UI", 10, FontStyle.Bold)
            self.month_label.BackColor = Color.White
            self.month_label.TextAlign = ContentAlignment.MiddleCenter
            self.Controls.Add(self.month_label)
            self.month_label.BringToFront()

            # Hour Label
            self.hour_label = Label()
            self.hour_label.Text = "Hour:"
            self.hour_label.Location = Point(20, 270)
            self.Controls.Add(self.hour_label)

            # Hour Dropdown
            self.hour_combo = ComboBox()
            self.hour_combo.Location = Point(120, 265)
            self.hour_combo.Size = Size(200, 24)
            self.hour_combo.DropDownStyle = ComboBoxStyle.DropDownList
            for i in range(1, 13):
                self.hour_combo.Items.Add(str(i))
            self.hour_combo.SelectedIndex = 0
            self.Controls.Add(self.hour_combo)

            # AM Radio
            self.am_radio = RadioButton()
            self.am_radio.Text = "AM"
            self.am_radio.Font = Font("Segoe UI", 7)
            self.am_radio.Location = Point(120, 300)
            self.am_radio.Checked = True
            self.Controls.Add(self.am_radio)

            # PM Radio
            self.pm_radio = RadioButton()
            self.pm_radio.Text = "PM"
            self.pm_radio.Font = Font("Segoe UI", 7)
            self.pm_radio.Location = Point(230, 300)
            self.Controls.Add(self.pm_radio)

            # OK Button
            self.ok_button = Button()
            self.ok_button.Text = "OK"
            self.ok_button.Size = Size(310, 30)
            self.ok_button.Location = Point(10, 330)
            self.ok_button.Click += self.on_ok_click
            self.Controls.Add(self.ok_button)

        def update_month_label(self, sender, args):
            self.month_label.Text = self.calendar.SelectionStart.ToString("MMMM")

        # prevent selecting Feb 29
        def block_feb_29(self, sender, args):
            d = self.calendar.SelectionStart
            if d.Month == 2 and d.Day == 29:
                MessageBox.Show("February 29 is not supported in this workflow.", "Invalid date")
                safe = DateTime(d.Year, 2, 28)
                self.calendar.SetDate(safe)

        def on_ok_click(self, sender, args):
            date = self.calendar.SelectionStart

            # Validate
            if date.Month == 2 and date.Day == 29:
                MessageBox.Show("February 29 is not supported in this workflow.", "Invalid date")
                return

            hour = int(self.hour_combo.SelectedItem)
            if self.pm_radio.Checked and hour != 12:
                hour += 12
            if self.am_radio.Checked and hour == 12:
                hour = 0

            dt = DateTime(date.Year, date.Month, date.Day, hour, 0, 0)
            # Map hours
            h = dt.Hour  # 0..23
            offset_hour = (h + 23) % 24
            index = (dt.DayOfYear - 1) * 24 + offset_hour
            sc.sticky[key] = index
            self.Close()

    form = CalendarForm()
    form.ShowDialog()

# Output
hour_index = sc.sticky.get(key, None)
# ---------- end python_3_script_9 ----------
hour_of_the_year = Panel(python_3_script_9)
lb_falsestarttoggle_8 = LBFalseStartToggle(True)
python_3_script_10 = Python3Script(folder=modeltorad.folder, epw_file=panel_6, hour_index=python_3_script_9, run=lb_falsestarttoggle_8)  # -> out, sky_path; inputs folder: String, hour_index: Int32
# ---------- python_3_script_10: Python ----------
import os

_sky_path = None

if _run:
    if not _folder:
        raise ValueError("Set a valid folder path for _folder.")
    root = str(_folder)
    os.makedirs(root, exist_ok=True)

    if not _epw_file or not os.path.isfile(_epw_file):
        raise ValueError("Set a valid EPW path for _epw_file.")

    with open(_epw_file, "r") as f:
        lines = f.readlines()

    if len(lines) < 9:
        raise ValueError("EPW file seems incomplete or malformed.")

 
    # Format: LOCATION,City,State,Country,Source,WMO,Lat,Lon,TZ,Elev
    header = lines[0].strip().split(",")
    if len(header) < 10:
        raise ValueError("EPW header line 1 is malformed.")

    lat = float(header[6])  # latitude
    lon_epw = float(header[7])  # longitude
    lon = -1 * lon_epw
    print(f"longitude: {lon}")
    tz  = float(header[8])  # time zone

    meridian = -15.0 * tz
    data_lines = [ln for ln in lines[8:] if ln.strip()]

    if _hour_index < 0 or _hour_index >= len(data_lines):
        raise ValueError(
            "Hour index out of range. Valid range: 0 to {}".format(len(data_lines) - 1)
        )

    row = data_lines[_hour_index].strip().split(",")

    month = int(row[1])
    day   = int(row[2])
    hour  = int(row[3])
    minute = int(row[4])

    time_decimal = hour - 0.5 + minute / 60.0

    # Radiation columns (EPW):
    # 13: Global Horizontal Radiation (Wh/m2)
    # 14: Direct Normal Radiation (Wh/m2)
    # 15: Diffuse Horizontal Radiation (Wh/m2)
    def safe_float(s, default=0.0):
        s = s.strip()
        if not s or s in ("9999", "999999"):
            return default
        return float(s)

    dni = safe_float(row[14])  # Direct Normal Radiation
    dhi = safe_float(row[15])  # Diffuse Horizontal Radiation

    ground_reflectance = 0.2

    # sky.rad
    gendaylit_line = (
        "!gendaylit {m} {d} {t:.2f} "
        "-a {lat:.6f} -o {lon:.6f} -m {mer:.1f} "
        "-W {dni:.3f} {dhi:.3f} -g {g:.3f}"
    ).format(
        m=month,
        d=day,
        t=time_decimal,
        lat=lat,
        lon=lon,
        mer=meridian,
        dni=dni,
        dhi=dhi,
        g=ground_reflectance,
    )

    sky_block = """skyfunc glow sky_glow
0
0
4 1.000 1.000 1.000 0
sky_glow source sky
0
0
4 0 0 1 180

skyfunc glow ground_glow
0
0
4 1.000 1.000 1.000 0
ground_glow source ground
0
0
4 0 0 -1 180
"""

    sky_text = gendaylit_line + "\n\n" + sky_block

    # --- Write sky.rad ---
    sky_path = os.path.join(root, "sky.rad")
    with open(sky_path, "w") as f:
        f.write(sky_text)

    _sky_path = sky_path
    print("Sky file written to:", _sky_path)
    print("gendaylit line:")
    print(gendaylit_line)
# ---------- end python_3_script_10 ----------
panel_29 = Panel(python_3_script_10.sky_path)
lb_falsestarttoggle_9 = LBFalseStartToggle(True)
details = ValueList({"very low": 1, "low": 2, "mid": 3, "high": 4, "very high": 5}, selected="very high")
write_batch_file = Python3Script(folder=modeltorad.folder, details=details, sky_path=python_3_script_10.sky_path, run=lb_falsestarttoggle_9)  # -> out, result_file
# ---------- write_batch_file: Python ----------
ghenv.Component.Message = 'Kybele 1.0.0 PIT'


import os
from pathlib import Path
import subprocess
import traceback


error = None

try:
    if not _folder:
        raise ValueError("Set _folder.")
    if _run:
        print("Running...")
    else:
        print("Waiting for _run = True")

except Exception as e:
    error = str(e)
    print("ERROR:", error)
    print(traceback.format_exc())

if error:
    ghenv.Component.Message = "Kybele 1.0.0\nERROR"


# Path
batch_file = str(_folder) + r"\run_simulation.bat"
# print(batch_file)
# print(str(_folder))

try:
    sky_file = os.path.basename(_sky_path)
    print(sky_file)
except Exception as e:
    print("Error:", e)



# oconv command
oconv_cmd = f"oconv model\\scene\\envelope.mat model\\scene\\envelope.rad {sky_file} > model.oct"


# specify pts path
pts_path = str(_folder) + r"\model\grid"


# loop to find pts file
for filename in os.listdir(pts_path):
    if filename.endswith(".pts"):
        old_path = os.path.join(pts_path, filename)
        new_path = os.path.join(pts_path, "0.pts")
        os.rename(old_path, new_path)
        print(f"Renamed {filename} to 0.pts")
        break 


# rtrace command
very_low_details = "-ab 1 -ad 256 -aa 0.2 -ar 32 -lr 4 -lw 1e-3"
low_details = "-ab 2 -ad 384  -aa 0.18 -ar 40  -lr 5 -lw 8e-4"
mid_details = "-ab 2 -ad 768  -aa 0.12 -ar 56  -lr 6 -lw 2e-4"
high_details = "-ab 2 -ad 768  -aa 0.12 -ar 56  -lr 6 -lw 2e-4"
very_high_details = "-ab 3 -ad 1024 -aa 0.10 -ar 64  -lr 6 -lw 1e-4"


if _custom_parameter:
    rtrace_cmd = f"rtrace -I -h {_custom_parameter} model.oct < model\\grid\\0.pts > raw.txt"
elif _details == 1 or _details == "very low":
    rtrace_cmd = f"rtrace -I -h {very_low_details} model.oct < model\\grid\\0.pts > raw.txt"
elif _details == 2 or _details == "low":
    rtrace_cmd = f"rtrace -I -h {low_details} model.oct < model\\grid\\0.pts > raw.txt"
elif _details == 3 or _details == "mid":
    rtrace_cmd = f"rtrace -I -h {mid_details} model.oct < model\\grid\\0.pts > raw.txt"
elif _details == 4 or _details == "high":
    rtrace_cmd = f"rtrace -I -h {high_details} model.oct < model\\grid\\0.pts > raw.txt"
elif _details == 5 or _details == "very_high":
    rtrace_cmd = f"rtrace -I -h {very_high_details} model.oct < model\\grid\\0.pts > raw.txt"
else:
    rtrace_cmd = "rtrace -I -h {mid_details} 8 model.oct < model\\grid\\0.pts > raw.txt"
print(rtrace_cmd)




# Commands
commands = [
    "echo Running Radiance Simulation",
    oconv_cmd,
    rtrace_cmd,
    "echo Done!"
]


# Write
if _run:
    try:
        with open(batch_file, "w") as f:
            for cmd in commands:
                f.write(cmd + "\n")
        print(f"Batch file saved: {batch_file}")

        batch_name = os.path.basename(batch_file)
        subprocess.run(["cmd.exe", "/c", f"{batch_name}"], cwd=f"{_folder}", check=False)

        try:
            _result_path = os.path.join(_folder, "raw.txt")
            if os.path.isfile(_result_path) and os.path.getsize(_result_path) > 0:
                _result_file = _result_path
            else:
                print("Valid Result file is missing")
        except Exception as e:
            print(f"Error: ", e)

    except Exception as e:
        print('Error: ', e)
# ---------- end write_batch_file ----------
result = Python3Script(result_file=write_batch_file.result_file, run=Toggle(True))  # -> out, illuminance
# ---------- result: Python ----------
ghenv.Component.Message = 'Kybele 1.0.0'


import os, re

_illuminance = []

if _run:
    try:
        if os.path.isfile(_result_file):
            raw_path = _result_file
            with open(raw_path, "r") as f:
                for line in f:
                    s = line.strip()
                    if not s or s.startswith(("#", "!")):
                        continue

                    parts = re.split(r"[,\s]+", s)
                    if len(parts) < 3:
                        continue

                    try:
                        r, g, b = float(parts[0]), float(parts[1]), float(parts[2])
                    except ValueError:
                        continue

                    
                    rgb_factor = 0.265 * r + 0.670 * g + 0.065 * b
                    ill = 179.0 * rgb_factor
                    _illuminance.append(ill)

            print(_illuminance)
    except Exception as e:
        print("Error: ", e)
# ---------- end result ----------
panel_30 = Panel(result.illuminance)
illuminance_min = Slider(20000, range=0..120000)
illuminance_max = Slider(120000, range=0..120000)
# Electric Lighting Simulation
# 1
# 4
# 5
# 2
# Spectral Glazing Materials
# 4
# 1
# 4
# 3
number_slider_6 = Slider(0.298, range=0..1)
number_slider_7 = Slider(1, range=0..1)
colrange = LBColorRange(index=Slider(2, range=0..26))  # -> colors; plug-in component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
pln = Plane(Plane(origin=(1.966829709, -1.371383996, 0), x=(0.7880107536, -0.6156614753, 0), y=(0.6156614753, 0.7880107536, 0)))
legendpar = LBLegendParameters(
    min=illuminance_min,
    max=illuminance_max,
    colors=colrange,
    continuous_leg=Toggle(True),
    num_decimals=Toggle(False),
    vert_or_horiz=Toggle(True))  # -> leg_par; plug-in component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
panel_31 = Panel("""Point In Time 
Illuminance(lux)""")
# Enable preview to
# visualize Illuminance
heatmap = LBSpatialHeatmap(values=result.illuminance, mesh=genpts.mesh, legend_par=legendpar, legend_title=panel_31)  # -> mesh, legend, title, colors, legend_par, vis_set; plug-in component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

# ----
# Point In Time Render
# 3
lb_falsestarttoggle_10 = LBFalseStartToggle(True)
modeltorad_2 = HBModelToRadFolder(model=assigngridsviews, folder=panel_2, write=lb_falsestarttoggle_10)  # -> out, folder; plug-in component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
panel_32 = Panel(modeltorad_2.folder)
point_2 = Point(<point referenced from the Rhino model>)
point_3 = Point(<point referenced from the Rhino model>)
python_3_script_11 = Python3Script(camera_position=point_2, position=point_3, height=Slider(1.25, range=0..10), camera_type="fisheye_hemispherical")  # -> out, view_parameters; inputs camera_position: Point3d, position: Point3d
# ---------- python_3_script_11: Python ----------
ghenv.Component.Message = """Kybele 0.1 Beta
View Settings"""



import Rhino
import math

_view_parameters = None

if _camera_position is not None and _position is not None:
    cam = Rhino.Geometry.Point3d(_camera_position)
    cam.Z += _height if _height is not None else 0.0

    target = Rhino.Geometry.Point3d(_position)


    vd = target - cam
    if vd.IsZero:
        vd = Rhino.Geometry.Vector3d(0, 0, -1)
    vd.Unitize()

    vu = Rhino.Geometry.Vector3d(0, 0, 1)


    cam_type = (_camera_type or "fisheye_hemispherical").strip().lower()

    view_type_flag = "-vth"
    vh = 180.0
    vv = 180.0

    if cam_type in ("fisheye_hemispherical", "hemispherical", "fisheye"):
        view_type_flag = "-vth"
        vh = 180.0
        vv = 180.0
    elif cam_type in ("fisheye_angular", "angular"):

        view_type_flag = "-vta"
        vh = 180.0
        vv = 180.0
    elif cam_type in ("perspective", "vtv"):

        view_type_flag = "-vtv"
        vh = 60.0
        vv = 60.0
    elif cam_type in ("parallel", "orthographic", "vtl"):

        view_type_flag = "-vtl"
        vh = 60.0
        vv = 60.0
    elif cam_type in ("cylindrical", "vtc"):
        view_type_flag = "-vtc"
        vh = 360.0
        vv = 90.0
    elif cam_type in ("spherical", "vts"):
        view_type_flag = "-vts"
        vh = 360.0
        vv = 180.0
    elif cam_type in ("two_point", "two point perspective", "2pt"):

        view_type_flag = "-vtv"
        vh = 60.0
        vv = 60.0

    # view string
    _view_parameters = "{vt} -vp {vpx:.4f} {vpy:.4f} {vpz:.4f} -vd {vdx:.4f} {vdy:.4f} {vdz:.4f} -vu {vux:.4f} {vuy:.4f} {vuz:.4f} -vh {vh:.3f} -vv {vv:.3f}".format(
        vt=view_type_flag,
        vpx=cam.X, vpy=cam.Y, vpz=cam.Z,
        vdx=vd.X, vdy=vd.Y, vdz=vd.Z,
        vux=vu.X, vuy=vu.Y, vuz=vu.Z,
        vh=vh, vv=vv
    )
# ---------- end python_3_script_11 ----------
panel_33 = Panel(python_3_script_11.view_parameters)
select_hour_index_2 = Button()
python_3_script_12 = Python3Script(run=select_hour_index_2)  # -> hour_index; same code as python_3_script_9
panel_34 = Panel(python_3_script_12)
python_3_script_13 = Python3Script(
    folder=modeltorad_2.folder,
    epw_path=panel_6,
    hour_index=python_3_script_12,
    ground_reflectance=Slider(0.2, range=0..1),
    run=Toggle(True))  # -> out, gendaylit_line, sky_file
# ---------- python_3_script_13: Python ----------
ghenv.Component.Message = """Kybele 0.1 Beta
Write Sky File"""


import os


try:
    gr = float(_ground_reflectance)
except:
    gr = 0.2

try:
    _run = bool(_run)
except:
    _run = False

sky_file = None
gendaylit_line = None

if _epw_path and _hour_index is not None and _folder:
    epw_path = os.path.abspath(_epw_path)
    work_folder = os.path.abspath(_folder)

    if not os.path.isfile(epw_path):
        raise Exception("EPW file not found: {0}".format(epw_path))

    if not os.path.isdir(work_folder):
        raise Exception("Working folder does not exist: {0}".format(work_folder))


    with open(epw_path, 'r') as f:
        lines = f.readlines()

    if len(lines) < 8:
        raise Exception("EPW file looks too short: {0} lines".format(len(lines)))


    loc_fields = lines[0].strip().split(',')
    if loc_fields[0].upper() != "LOCATION":
        raise Exception("First line of EPW is not LOCATION; got: {0}".format(loc_fields[0]))

    try:
        lat = float(loc_fields[6])
        lon = float(loc_fields[7])
        time_zone_offset  = float(loc_fields[8])
    except Exception as e:
        raise Exception("Failed to parse lat/lon/timezone from LOCATION line: {0}".format(e))


    meridian = time_zone_offset * 15.0


    data_start = 8
    idx = data_start + int(_hour_index)

    if idx >= len(lines):
        raise Exception("Hour index {0} out of range; EPW has only {1} lines."
                        .format(_hour_index, len(lines) - data_start))

    row = lines[idx].strip().split(',')


    try:
        year  = int(row[0])
        month = int(row[1])
        day   = int(row[2])
        hour  = int(row[3])
        minute = int(row[4])

        dni = float(row[14])
        dhi = float(row[15])
    except Exception as e:
        raise Exception("Failed to parse core weather fields from data row: {0}".format(e))


    if dni >= 9999.0 or dni < 0.0:
        dni = 0.0
    if dhi >= 9999.0 or dhi < 0.0:
        dhi = 0.0


    time_decimal = float(hour)


    gendaylit_line = "!gendaylit {m} {d} {t:.2f} -a {lat:.6f} -o {lon:.6f} -m {mer:.1f} -W {dni:.3f} {dhi:.3f} -g {g:.3f}".format(
        m=month,
        d=day,
        t=time_decimal,
        lat=lat,
        lon=lon,
        mer=meridian,
        dni=dni,
        dhi=dhi,
        g=gr
    )


    sky_lines = []
    sky_lines.append(gendaylit_line)
    sky_lines.append("")

    # Sky glow
    sky_lines.append("skyfunc glow sky_glow")
    sky_lines.append("0")
    sky_lines.append("0")
    sky_lines.append("4 1.000 1.000 1.000 0")
    sky_lines.append("sky_glow source sky")
    sky_lines.append("0")
    sky_lines.append("0")
    sky_lines.append("4 0 0 1 180")
    sky_lines.append("")

    # Ground glow
    sky_lines.append("skyfunc glow ground_glow")
    sky_lines.append("0")
    sky_lines.append("0")
    sky_lines.append("4 1.000 1.000 1.000 0")
    sky_lines.append("ground_glow source ground")
    sky_lines.append("0")
    sky_lines.append("0")
    sky_lines.append("4 0 0 -1 180")
    sky_lines.append("")


    sky_name = "sky_{:04d}.rad".format(int(_hour_index))
    sky_path = os.path.join(work_folder, sky_name)

    if _run:
        with open(sky_path, 'w') as sf:
            sf.write("\n".join(sky_lines))

        sky_file = sky_path
    else:
        sky_file = "(toggle _run=True to write) " + sky_path
# ---------- end python_3_script_13 ----------
panel_35 = Panel(python_3_script_13.sky_file)
lb_falsestarttoggle_11 = LBFalseStartToggle(True)
details_2 = ValueList({"very low": 1, "low": 2, "mid": 3, "high": 4, "very high": 5}, selected="high")
python_3_script_14 = Python3Script(
    folder=modeltorad_2.folder,
    sky_file=python_3_script_13.sky_file,
    image_resolution=Slider(1920, range=0..1920),
    view_parameters=python_3_script_11.view_parameters,
    details=details_2,
    run=lb_falsestarttoggle_11)  # -> out, batch_path, image_path
# ---------- python_3_script_14: Python ----------
ghenv.Component.Message = """Kybele 0.1 Beta
Point In Time Luminance Render"""

import os
import re
from pathlib import Path
import shutil
import subprocess
import sys


# paths
_root = str(_folder)
batch_file = os.path.join(_root, "run_annual_simulation.bat")

# root
os.makedirs(_root, exist_ok=True)



# rename the pts file
grid_dir = os.path.join(_root, "model", "grid")
os.makedirs(grid_dir, exist_ok=True)

pts_candidates = [f for f in os.listdir(grid_dir) if f.lower().endswith(".pts")]
if "0.pts" not in pts_candidates and pts_candidates:
    old_path = os.path.join(grid_dir, pts_candidates[0])
    new_path = os.path.join(grid_dir, "0.pts")
    try:
        os.replace(old_path, new_path)
        print(f"Renamed {pts_candidates[0]} -> 0.pts")
    except Exception as e:
        print(f"Warning: could not rename {pts_candidates[0]} to 0.pts ({e})")



# copy envelope files
def copy_to_root(file_name, folder_path):
    full_path = os.path.join(_root, folder_path, file_name)
    root_path = os.path.join(_root, file_name)
    if not os.path.isfile(full_path):
        raise FileNotFoundError(f"{file_name} not found at {full_path}")
    shutil.copy2(full_path, root_path)


copy_to_root("envelope.rad", "model\scene")
copy_to_root("envelope.mat", "model\scene")
copy_to_root("envelope.blk", "model\scene")
copy_to_root("0.pts", "model\grid")



# lum_rad_path
try:
    lum_rad_path
except NameError:
    lum_rad_path = None

if lum_rad_path and os.path.isfile(lum_rad_path):
    lum_folder = os.path.dirname(lum_rad_path)
    for f in os.listdir(lum_folder):
        src = os.path.join(lum_folder, f)
        dst = os.path.join(_root, f)
        if os.path.isfile(src):
            shutil.copy2(src, dst)



# Defaults
try:
    _run
except NameError:
    _run = False

try:
    _sky_file
except NameError:
    _sky_file = None

try:
    _luminaires
except NameError:
    _luminaires = None




# details
try:
    v = _details
except NameError:
    v = 3 # default = mid


# normalize
q = 3
if isinstance(v, int):
    q = v
elif isinstance(v, float):
    q = int(v)
elif isinstance(v, str):
    s = v.strip().lower().replace(" ", "_").replace("-", "_")
    map_str_to_q = {
        "1": 1, "very_low": 1, "verylow": 1, "very low": 1,
        "2": 2, "low": 2,
        "3": 3, "mid": 3, "medium": 3,
        "4": 4, "high": 4,
        "5": 5, "very_high": 5, "veryhigh": 5, "very high": 5,
    }
    if s in map_str_to_q:
        q = map_str_to_q[s]
    else:
        try:
            q = int(s)
        except:
            q = 3
else:
    q = 3

# clamp quality
if q < 1: q = 1
if q > 5: q = 5

_image_path = None
_batch_path = None



# quality presets: preview + main
preview_presets = {
    1: "-ps 8 -pt 0.30 -pj 0.7 -dj 0.3 -ds 0.5 -dt 0.7 -dc 0.3 "
       "-dr 1 -dp 128 -st 0.5 -ab 1 -ad 64  -as 16  -ar 32  -aa 0.30 "
       "-lr 2 -lw 0.010 -av 0 0 0",
    2: "-ps 6 -pt 0.25 -pj 0.7 -dj 0.4 -ds 0.4 -dt 0.6 -dc 0.4 "
       "-dr 1 -dp 128 -st 0.4 -ab 2 -ad 96  -as 24  -ar 48  -aa 0.25 "
       "-lr 3 -lw 0.005 -av 0 0 0",
    3: "-ps 4 -pt 0.20 -pj 0.7 -dj 0.5 -ds 0.3 -dt 0.5 -dc 0.5 "
       "-dr 2 -dp 256 -st 0.3 -ab 2 -ad 160 -as 40  -ar 64  -aa 0.22 "
       "-lr 4 -lw 0.003 -av 0 0 0",
    4: "-ps 4 -pt 0.15 -pj 0.8 -dj 0.6 -ds 0.25 -dt 0.4 -dc 0.6 "
       "-dr 2 -dp 256 -st 0.25 -ab 3 -ad 256 -as 64  -ar 80  -aa 0.18 "
       "-lr 5 -lw 0.002 -av 0 0 0",
    5: "-ps 3 -pt 0.10 -pj 0.9 -dj 0.7 -ds 0.2 -dt 0.3 -dc 0.7 "
       "-dr 3 -dp 512 -st 0.20 -ab 3 -ad 384 -as 96  -ar 96  -aa 0.15 "
       "-lr 6 -lw 0.001 -av 0 0 0"
}

main_presets = {
    1: "-ps 6 -pt 0.25 -pj 0.6 -dj 0.4 -ds 0.30 "
       "-ab 1 -ad 128 -as 32  -ar 48  -aa 0.25 "
       "-lr 4 -lw 0.005 -av 0 0 0",
    2: "-ps 5 -pt 0.20 -pj 0.7 -dj 0.5 -ds 0.25 "
       "-ab 2 -ad 192 -as 48  -ar 64  -aa 0.22 "
       "-lr 4 -lw 0.003 -av 0 0 0",
    3: "-ps 4 -pt 0.15 -pj 0.8 -dj 0.5 -ds 0.25 "
       "-ab 2 -ad 320 -as 80  -ar 96  -aa 0.18 "
       "-lr 5 -lw 0.002 -av 0 0 0",
    4: "-ps 3 -pt 0.12 -pj 0.85 -dj 0.6 -ds 0.20 "
       "-ab 3 -ad 512 -as 128 -ar 128 -aa 0.14 "
       "-lr 6 -lw 0.0015 -av 0 0 0",
    5: "-ps 3 -pt 0.07 -pj 0.9 -dj 0.6 -ds 0.16 "
       "-ab 3 -ad 1024 -as 256 -ar 192 -aa 0.08 "
       "-lr 6 -lw 0.001 -av 0 0 0"
}

preview_opts = preview_presets[q]
main_opts = main_presets[q]




# Main logic
if _folder and _view_parameters and _image_resolution and _sky_file:
    folder = os.path.abspath(_folder)
    if not os.path.isdir(folder):
        raise Exception("Folder does not exist: {0}".format(folder))


    # sky file
    sky_path = _sky_file
    if not os.path.isabs(sky_path):
        sky_path = os.path.join(folder, sky_path)
    if not os.path.isfile(sky_path):
        raise Exception("Sky file not found: {0}".format(sky_path))

    sky_basename = os.path.basename(sky_path)



    # extract hour index
    m = re.search(r'(\d+)', sky_basename)
    if not m:
        raise Exception("Could not find an hour index in sky file name: {0}".format(sky_basename))
    hour = int(m.group(1))



    # envelope files
    env_mat = os.path.join(folder, "envelope.mat")
    env_rad = os.path.join(folder, "envelope.rad")

    missing = []
    if not os.path.isfile(env_mat):
        missing.append("envelope.mat")
    if not os.path.isfile(env_rad):
        missing.append("envelope.rad")

    if missing:
        raise Exception("Missing required file(s) in folder {0}: {1}"
                        .format(folder, ", ".join(missing)))



    # luminaires file
    lum_basename = None
    if lum_rad_path and os.path.isfile(lum_rad_path):
        lum_basename = os.path.basename(lum_rad_path)



    # names per hour
    base_name = "IMG_{:04d}".format(hour)
    amb_name = "IMG.amb"
    preview_unf = base_name + "_preview.unf"
    high_unf = base_name + "_0.unf"
    temp_hdr = "temp_{:04d}.hdr".format(hour)
    final_hdr = "Luminance_{:04d}.hdr".format(hour)
    octree_for_rpict = "model_{:04d}.oct".format(hour)



    # resolutions
    final_res = int(_image_resolution)
    high_res = final_res * 2
    preview_res = 64

    bat_name = "run_rpict_{:04d}.bat".format(hour)
    bat_path = os.path.join(folder, bat_name)



    # oconv
    oconv_files = ["envelope.mat", "envelope.rad", sky_basename]
    if lum_basename:
        oconv_files.append(lum_basename)

    oconv_args = " ".join(['"{0}"'.format(f) for f in oconv_files])

    lines = []
    lines.append("@echo off")
    lines.append("REM Radiance rpict batch for hour {h}, quality {q}".format(h=hour, q=q))
    lines.append("REM Root folder: \"{f}\"".format(f=folder))
    lines.append("REM Sky file: \"{s}\"".format(s=sky_basename))
    lines.append("REM Envelope files: envelope.mat, envelope.rad")
    if lum_basename:
        lines.append("REM Luminaires file: \"{l}\"".format(l=lum_basename))
    lines.append("")
    lines.append("cd /d \"{f}\"".format(f=folder))
    lines.append("")

    lines.append("REM 0) Build octree with sky (and luminaires) for this hour")
    lines.append(
        "oconv {files} > \"{full_oct}\"".format(
            files=oconv_args,
            full_oct=octree_for_rpict
        )
    )
    lines.append("")


    lines.append(
        "rpict -t 10 {view} -x {xres} -y {yres} -af {amb} {opts} \"{oct}\" > {preview}"
        .format(
            view=_view_parameters,
            xres=preview_res,
            yres=preview_res,
            amb=amb_name,
            opts=preview_opts,
            oct=octree_for_rpict,
            preview=preview_unf
        )
    )
    lines.append("del {0}".format(preview_unf))
    lines.append("")


    lines.append(
        "rpict -t 10 {view} -x {xres} -y {yres} -af {amb} {opts} -e error_{h}.log \"{oct}\" > {outunf}"
        .format(
            view=_view_parameters,
            xres=high_res,
            yres=high_res,
            amb=amb_name,
            opts=main_opts,
            h=hour,
            oct=octree_for_rpict,
            outunf=high_unf
        )
    )
    lines.append("")


    lines.append("pcompos -a 1 {inunf} > {temp}".format(inunf=high_unf, temp=temp_hdr))

    view_header = "VIEW= {view} -x {x} -y {y}".format(
        view=_view_parameters,
        x=final_res,
        y=final_res
    )

    lines.append(
        "pfilt -r 0.6 -x /2 -y /2 {temp} | getinfo -a \"{vhdr}\" > {final}"
        .format(
            temp=temp_hdr,
            vhdr=view_header,
            final=final_hdr
        )
    )
    lines.append("del {0}".format(temp_hdr))
    lines.append("del {0}".format(high_unf))
    lines.append("")
    lines.append("echo Done. Output: {final}".format(final=final_hdr))
    lines.append("")



    # write batch file
    with open(bat_path, "w") as f:
        f.write("\n".join(lines))

    _batch_path = bat_path
    _image_path = os.path.join(folder, final_hdr)



    # cmd
    if _run:
        try:
            subprocess.Popen(
                ["cmd.exe", "/c", bat_path],
                creationflags=getattr(subprocess, "CREATE_NEW_CONSOLE", 0)
            )
        except Exception as e:
            print("Failed to launch batch file:", e)
# ---------- end python_3_script_14 ----------
lb_falsestarttoggle_12 = LBFalseStartToggle(True)
python_3_script_15 = Python3Script(image_path=python_3_script_14.image_path, run=lb_falsestarttoggle_12)  # -> out, a; inputs image_path: String
# ---------- python_3_script_15: Python ----------
import System
import clr, os

clr.AddReference("System")
clr.AddReference("System.Drawing")
clr.AddReference("System.Windows.Forms")

import System.IO            as IO
import System.Threading     as T
import System.Drawing       as D
import System.Drawing.Drawing2D  as D2
import System.Drawing.Imaging    as DI
from System.Windows.Forms import (
    Form, Panel, Button,
    SaveFileDialog, DialogResult, MessageBox,
    Application, MouseButtons, DockStyle, FlatStyle,
    AutoScaleMode
)
from System.Diagnostics import Process, ProcessStartInfo

if "_iv_form"   not in globals(): _iv_form   = None
if "_iv_thread" not in globals(): _iv_thread = None




# DPI awareness
def _set_dpi_aware():
    try:
        import ctypes
        ctypes.windll.shcore.SetProcessDpiAwareness(1)
    except Exception:
        try:
            import ctypes
            ctypes.windll.user32.SetProcessDPIAware()
        except Exception:
            pass

_set_dpi_aware()





# Zoom-pan panel
class ZoomPanel(Panel):
    def __init__(self):
        Panel.__init__(self)
        self.bitmap      = None
        self._zoom       = 1.0
        self._ox         = 0.0
        self._oy         = 0.0
        self._drag       = None
        self._user_zoom  = False
        self.DoubleBuffered = True
        self.BackColor      = D.Color.White
        self.MouseWheel       += self._on_wheel
        self.MouseDown        += self._on_down
        self.MouseMove        += self._on_move
        self.MouseUp          += self._on_up
        self.MouseDoubleClick += self._on_dbl
        self.Paint            += self._on_paint
        self.Resize           += self._on_resize



    def set_bitmap(self, bmp):
        self.bitmap     = bmp
        self._user_zoom = False
        if bmp is not None:
            self._fit()
        self.Invalidate()



    def _fit(self):
        if self.bitmap is None or self.Width <= 0 or self.Height <= 0:
            return
        self._zoom = min(self.Width  / float(self.bitmap.Width),
                         self.Height / float(self.bitmap.Height)) * 0.97
        self._ox = (self.Width  - self.bitmap.Width  * self._zoom) / 2.0
        self._oy = (self.Height - self.bitmap.Height * self._zoom) / 2.0



    def _on_resize(self, s, e):
        if self.bitmap is not None and not self._user_zoom:
            self._fit()
            self.Invalidate()



    def _on_wheel(self, s, e):
        self._user_zoom = True
        f = 1.15 if e.Delta > 0 else 1.0 / 1.15
        self._ox   = e.X - f * (e.X - self._ox)
        self._oy   = e.Y - f * (e.Y - self._oy)
        self._zoom *= f
        self.Invalidate()



    def _on_down(self, s, e):
        if e.Button == MouseButtons.Left:
            self._drag = (e.X, e.Y, self._ox, self._oy)



    def _on_move(self, s, e):
        if self._drag and e.Button == MouseButtons.Left:
            self._user_zoom = True
            x0, y0, ox0, oy0 = self._drag
            self._ox = ox0 + (e.X - x0)
            self._oy = oy0 + (e.Y - y0)
            self.Invalidate()



    def _on_up(self, s, e):
        self._drag = None

    def _on_dbl(self, s, e):
        self._user_zoom = False
        self._fit()
        self.Invalidate()



    def _on_paint(self, s, e):
        g = e.Graphics
        g.Clear(D.Color.White)
        if self.bitmap is None:
            return
        g.InterpolationMode = D2.InterpolationMode.HighQualityBicubic
        w = int(self.bitmap.Width  * self._zoom)
        h = int(self.bitmap.Height * self._zoom)
        g.DrawImage(self.bitmap, int(self._ox), int(self._oy), w, h)




# Main form
class ImageViewerForm(Form):

    def __init__(self):
        Form.__init__(self)
        self.Text             = "HDR Image Viewer"
        self.Size             = D.Size(900, 780)
        self.MinimumSize      = D.Size(400, 360)
        self.BackColor        = D.Color.White
        self.AutoScaleMode    = AutoScaleMode.Dpi
        self.AutoScaleDimensions = D.SizeF(96.0, 96.0)

        self._bitmap   = None
        self._img_path = None

        self._build_ui()

    # UI 
    def _build_ui(self):
        bar = Panel()
        bar.Dock      = DockStyle.Bottom
        bar.Height    = 44
        bar.BackColor = D.Color.FromArgb(245, 245, 245)
        bar.Paint    += lambda s, e: e.Graphics.DrawLine(
            D.Pens.LightGray, 0, 0, bar.Width, 0)
        self.Controls.Add(bar)



        right_wrap = Panel()
        right_wrap.Dock      = DockStyle.Right
        right_wrap.Width     = 150
        right_wrap.BackColor = D.Color.FromArgb(245, 245, 245)
        bar.Controls.Add(right_wrap)


        self._btn_save = Button()
        self._btn_save.Text      = "Save PNG"
        self._btn_save.Size      = D.Size(130, 30)
        self._btn_save.Location  = D.Point(10, 7)
        self._btn_save.FlatStyle = FlatStyle.Flat
        self._btn_save.FlatAppearance.BorderColor = D.Color.FromArgb(180, 180, 180)
        self._btn_save.BackColor = D.Color.White
        self._btn_save.ForeColor = D.Color.FromArgb(50, 50, 50)
        self._btn_save.Font      = D.Font("Segoe UI", 9)
        self._btn_save.Click    += self._on_save
        right_wrap.Controls.Add(self._btn_save)


        self._zpanel = ZoomPanel()
        self._zpanel.Dock = DockStyle.Fill
        self.Controls.Add(self._zpanel)

    # public
    def load_image_async(self, path):
        self._img_path = path
        T.ThreadPool.QueueUserWorkItem(self._worker_load, path)



    # worker
    def _worker_load(self, state):
        path = str(state)
        try:
            if not os.path.isfile(path):
                self._safe_invoke(lambda: MessageBox.Show(
                    "_image_path is not a valid image file:\n{}".format(path),
                    "Invalid Path"))
                return

            ext = os.path.splitext(path)[1].lower()

            if ext not in (".hdr", ".pic", ".tif", ".tiff",
                           ".png", ".jpg", ".jpeg"):
                self._safe_invoke(lambda: MessageBox.Show(
                    "_image_path is not a valid HDR image.\n"
                    "Supported: .hdr  .pic  .tif  .png  .jpg\n\n"
                    "Got: {}".format(path),
                    "Invalid Image"))
                return

            load_path = path
            if ext in (".hdr", ".pic"):
                load_path = self._convert_hdr(path)
                if load_path is None:
                    self._safe_invoke(lambda: MessageBox.Show(
                        "HDR conversion failed.\n"
                        "Ensure Radiance (ra_tiff) is in the system PATH.",
                        "Error"))
                    return

            bmp = self._load_bitmap_unlocked(load_path)
            if bmp is None:
                self._safe_invoke(lambda: MessageBox.Show(
                    "Failed to read image:\n{}".format(load_path), "Error"))
                return

            self._safe_invoke(lambda: self._finish_load(bmp))

        except Exception as ex:
            msg = str(ex)
            self._safe_invoke(
                lambda: MessageBox.Show("Load error:\n" + msg, "Error"))

    def _finish_load(self, bmp):
        if self._bitmap is not None:
            self._bitmap.Dispose()
        self._bitmap = bmp
        self._zpanel.set_bitmap(bmp)
        self.Text = "HDR Image Viewer  -  {}x{} px".format(bmp.Width, bmp.Height)

    def _convert_hdr(self, hdr_path):
        import time, glob

        folder = os.path.dirname(hdr_path)
        stem   = os.path.splitext(os.path.basename(hdr_path))[0]
        prefix = os.path.join(folder, stem + "_kv_")
        try:
            for old in glob.glob(prefix + "*.tif"):
                try:    os.remove(old)
                except: pass
        except: pass

        # Unique name
        ts       = int(time.time() * 1000)
        tif_path = prefix + str(ts) + ".tif"

        psi = ProcessStartInfo()
        psi.FileName        = "cmd.exe"
        psi.Arguments       = '/c ra_tiff "{}" "{}"'.format(hdr_path, tif_path)
        psi.CreateNoWindow  = True
        psi.UseShellExecute = False
        p = Process()
        p.StartInfo = psi
        p.Start()
        p.WaitForExit()

        return tif_path if os.path.isfile(tif_path) else None

    @staticmethod
    def _load_bitmap_unlocked(path):
        try:
            raw = IO.File.ReadAllBytes(path)
            ms  = IO.MemoryStream(raw)
            tmp = D.Bitmap(ms)

            # Pixel-for-pixel copy
            bmp = D.Bitmap(tmp.Width, tmp.Height,
                           DI.PixelFormat.Format32bppArgb)
            g = D.Graphics.FromImage(bmp)
            g.DrawImage(
                tmp,
                D.Rectangle(0, 0, tmp.Width, tmp.Height),
                D.Rectangle(0, 0, tmp.Width, tmp.Height),
                D.GraphicsUnit.Pixel
            )
            g.Dispose()
            tmp.Dispose()
            ms.Dispose()

            return bmp
        except Exception:
            return None



    # save
    def _on_save(self, s, e):
        if self._bitmap is None:
            MessageBox.Show("No image loaded.", "Info")
            return
        sfd = SaveFileDialog()
        sfd.Filter = "PNG Image|*.png"
        sfd.Title  = "Save as PNG"
        if self._img_path:
            stem = os.path.splitext(os.path.basename(self._img_path))[0]
            sfd.FileName = stem + ".png"
        if sfd.ShowDialog() == DialogResult.OK:
            try:
                self._bitmap.Save(sfd.FileName, DI.ImageFormat.Png)
                MessageBox.Show(
                    "Successfully saved to:\n" + sfd.FileName,
                    "Saved")
            except Exception as ex:
                MessageBox.Show("Save failed:\n" + str(ex), "Error")

    # thread helper
    def _safe_invoke(self, fn):
        try:
            if self.IsHandleCreated and not self.IsDisposed:
                self.Invoke(System.Action(fn))
        except Exception:
            pass




# STA thread launcher
def _run_form_thread():
    global _iv_form
    try:
        Application.EnableVisualStyles()
        _iv_form = ImageViewerForm()
        Application.Run(_iv_form)
    finally:
        _iv_form = None

def _ensure_viewer():
    global _iv_form, _iv_thread
    alive = (_iv_form   is not None and
             not _iv_form.IsDisposed and
             _iv_thread is not None and
             _iv_thread.IsAlive)
    if alive:
        return
    _iv_thread = T.Thread(T.ThreadStart(_run_form_thread))
    _iv_thread.SetApartmentState(T.ApartmentState.STA)
    _iv_thread.IsBackground = True
    _iv_thread.Name         = "ImageViewer-STA"
    _iv_thread.Start()
    for _ in range(30):
        T.Thread.Sleep(100)
        if _iv_form is not None and _iv_form.IsHandleCreated:
            break




# Grasshopper entry
_iv_form   = globals().get("_iv_form",   None)
_iv_thread = globals().get("_iv_thread", None)

if _run and _image_path:
    _ensure_viewer()
    if _iv_form and not _iv_form.IsDisposed:
        _iv_form.load_image_async(str(_image_path))
else:
    if _iv_form and not _iv_form.IsDisposed:
        try:
            _iv_form.Invoke(System.Action(_iv_form.Close))
        except Exception:
            pass
        _iv_form   = None
        _iv_thread = None
# ---------- end python_3_script_15 ----------
panel_36 = Panel(python_3_script_15.out)

# ----
# Annual Simulation
# EXTRACT POINT IN TIME (PIT)
# ILLUMINANCE
# 1
# Preview me to see point in time illuminance
# results over the grid!
# Unpreview to see other heat maps!
# Use the button below to select
# date, time, and hour (PIT)
# for illuminance
# Point In Time
# (one point-in-time, all sensors)
# A window will open to run Radiance.
# It is running for the entire year (365x24 hours).
# Depending on the complexity of the model,
# it may take few minutes.
# Sensor
# (one sensor, annual data)
# Select a sensor
# and run (click button)
# to see the illuminance
# for the entire year
# for this sensor
# Sensor Marker
# You can adjust the
# illuminance intervals here.
lb_falsestarttoggle_13 = LBFalseStartToggle(True)
modeltorad_3 = HBModelToRadFolder(model=assigngridsviews, folder=panel_3, write=lb_falsestarttoggle_13)  # -> out, folder; plug-in component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
panel_37 = Panel(modeltorad_3.folder)
lb_falsestarttoggle_14 = LBFalseStartToggle(True)
details_3 = ValueList({"very low": 1, "low": 2, "mid": 3, "high": 4, "very high": 5}, selected="very high")
annual_batch_file = Python3Script(
    folder=modeltorad_3.folder,
    weather_file=panel_6,
    details=details_3,
    sky_sub_div=Slider(1, range=0..1),
    sensor_points=flatten(genpts.points),
    run=lb_falsestarttoggle_14)  # -> out, result_path; inputs sensor_points: list
#   port details: 0 = Low 1 = Medium 2 = High
# ---------- annual_batch_file: Python ----------
ghenv.Component.Message = """Kybele 0.1 Beta
Annual Simulation"""

import os, shutil, subprocess


SPLIT_TRIGGER = 10
N_PARTS = 4
_result_path = None




# paths
_root = str(_folder)
os.makedirs(_root, exist_ok=True)

batch_single = os.path.join(_root, "run_annual_single.bat")


def write_bat(path, lines):
    with open(path, "w", newline="\n") as f:
        for ln in lines:
            f.write(ln + "\n")


def copy_to_root(file_name, folder_path):
    full_path = os.path.join(_root, folder_path, file_name)
    root_path = os.path.join(_root, file_name)
    if not os.path.isfile(full_path):
        raise FileNotFoundError(f"{file_name} not found at {full_path}")
    shutil.copy2(full_path, root_path)


def set_n_in_details(details_str, new_n):
    parts = str(details_str).split()
    for i, p in enumerate(parts):
        if p == "-n" and i + 1 < len(parts):
            parts[i+1] = str(int(new_n))
            return " ".join(parts)
    return " ".join(parts + ["-n", str(int(new_n))])


# split 0.pts
def split_pts_file(src_pts, out_dir, n_parts=4):
    with open(src_pts, "r") as f:
        lines = f.readlines()
    total = len(lines)
    if total == 0:
        raise ValueError("0.pts is empty.")

    base = total // n_parts
    rem = total % n_parts

    pts_paths = []
    counts = []
    start = 0
    for i in range(n_parts):
        extra = 1 if i < rem else 0
        end = start + base + extra
        part_path = os.path.join(out_dir, f"0_part{i}.pts")
        with open(part_path, "w", newline="\n") as pf:
            pf.writelines(lines[start:end])
        pts_paths.append(part_path)
        counts.append(end - start)
        start = end
    return pts_paths, counts




# weather copy
if not _weather_file or not os.path.isfile(_weather_file):
    raise ValueError("Set a valid EPW path for _weather_file.")

root_weather = os.path.join(_root, os.path.basename(_weather_file))
shutil.copy2(_weather_file, root_weather)
name_weather = os.path.basename(root_weather)
print("Copied weather:", root_weather)



# 0.pts in root
grid_dir = os.path.join(_root, "model", "grid")
os.makedirs(grid_dir, exist_ok=True)

pts_candidates = [f for f in os.listdir(grid_dir) if f.lower().endswith(".pts")]
if "0.pts" not in [p.lower() for p in pts_candidates] and pts_candidates:
    os.replace(os.path.join(grid_dir, pts_candidates[0]), os.path.join(grid_dir, "0.pts"))



copy_to_root("0.pts", r"model\grid")
copy_to_root("envelope.rad", r"model\scene")
copy_to_root("envelope.mat", r"model\scene")
copy_to_root("envelope.blk", r"model\scene")



# skyglow and groundglow
sky_glow = os.path.join(_root, "skyglow.rad")
sky_glow_text = """#@rfluxmtx u=+Y h=u
void glow ground_glow
0
0
4 1.000 1.000 1.000 0

ground_glow source ground
0
0
4 0 0 -1 180

#@rfluxmtx u=+Y h=r1
void glow sky_glow
0
0
4 1.000 1.000 1.000 0

sky_glow source sky
0
0
4 0 0 1 180
"""
with open(sky_glow, "w", newline="\n") as f:
    f.write(sky_glow_text)




# sky sub division
_m = 4 if (_sky_sub_div == 4) else 1
cpu_total = os.cpu_count() or 12

# sensor count = number of lines in 0.pts
with open(os.path.join(_root, "0.pts"), "r") as f:
    sensor_num = sum(1 for _ in f)

if sensor_num <= 0:
    raise ValueError("0.pts has 0 sensors.")

split_mode = sensor_num > SPLIT_TRIGGER
print("sensor_num:", sensor_num, "split_mode:", split_mode)





# MF presets from _details
details_input = _details
details_str = str(details_input).strip().lower()
try:
    details_int = int(details_input)
except:
    details_int = None

if details_int == 4 or details_str == "high":
    MF_value, cnt_value, ab_value, lw_value = 5, 3625, 0, 1e-3
elif details_int == 5 or details_str == "very high":
    MF_value, cnt_value, ab_value, lw_value = 6, 5221, 0, 1e-3
elif details_int == 3 or details_str == "mid":
    MF_value, cnt_value, ab_value, lw_value = 4, 2321, 0, 1e-3
elif details_int == 2 or details_str == "low":
    MF_value, cnt_value, ab_value, lw_value = 3, 1297, 0, 5e-3
else:
    MF_value, cnt_value, ab_value, lw_value = 2, 577, 0, 1e-2




# rfluxmtx quality string
if _custom_parameter not in (None, ""):
    details_base = str(_custom_parameter).strip()
else:
    if details_int == 1:
        details_base = f"-lw 0.01  -ab 1 -ad 256  -n {cpu_total}"
    elif details_int == 2:
        details_base = f"-lw 0.005 -ab 2 -ad 512  -n {cpu_total}"
    elif details_int == 3:
        details_base = f"-lw 0.002 -ab 2 -ad 1024 -n {cpu_total}"
    elif details_int == 4:
        details_base = f"-lw 0.0015 -ab 3 -ad 1536 -n {cpu_total}"
    elif details_int == 5:
        details_base = f"-lw 0.001 -ab 3 -ad 2048 -n {cpu_total}"
    else:
        details_base = f"-lw 0.002 -ab 2 -ad 1024 -n {cpu_total}"





# per-part max -n
cpu_total = os.cpu_count() or 1

n_chunk = max(1, cpu_total // N_PARTS)

details_single = set_n_in_details(details_base, cpu_total)
details_split  = set_n_in_details(details_base, n_chunk)

print("cpu_total:", cpu_total)
print("n_chunk:", n_chunk)
print("details_split:", details_split)





# build and launch
if _run:
    if not split_mode:
        single_lines = [
            "echo Annual RUN (single -> part0)",
            f"epw2wea {name_weather} Weather_0.wea",
            f"gendaymtx -m {_m} Weather_0.wea > Weather_0.smx",
            "oconv envelope.mat envelope.rad > amodel_0.oct",
            f"rfluxmtx -I+ -y {sensor_num} {details_single} - skyglow.rad -i amodel_0.oct < 0.pts > illum_0.mtx",
            "dctimestep illum_0.mtx Weather_0.smx | rmtxop -fa -t -c 47.4 119.9 11.6 - > annualR_part0.ill",

            "oconv envelope.blk envelope.rad > bmodel_0.oct",
            f"rfluxmtx -I+ -y {sensor_num} {details_single} - skyglow.rad -i bmodel_0.oct < 0.pts > billum_0.mtx",
            f"gendaymtx -m {_m} -d Weather_0.wea > Weatherd_0.smx",
            "dctimestep billum_0.mtx Weatherd_0.smx | rmtxop -fa -t -c 47.4 119.9 11.6 - > annualRd_part0.ill",

            "echo void light solar 0 0 3 1e6 1e6 1e6 > suns_0.rad",
            f"cnt {cnt_value} | rcalc -e MF:{MF_value} -f reinsrc.cal -e Rbin=recno -o \"solar source sun 0 0 4 ${{Dx}} ${{Dy}} ${{Dz}} 0.533\" >> suns_0.rad",
            "oconv -f envelope.blk envelope.rad suns_0.rad > sunCoefficientsDDS_0.oct",
            f"rcontrib -I+ -ab {ab_value} -y {sensor_num} -n {cpu_total} -ad 64 -lw {lw_value} -dc 1 -dt 0 -dj 0 -fa -e MF:{MF_value} -f reinhart.cal -b rbin -bn Nrbins -m solar sunCoefficientsDDS_0.oct < 0.pts > cdsDDS_0.mtx",
            f"gendaymtx -5 0.533 -d -m {MF_value} Weather_0.wea > WeathersunM{MF_value}_0.smx",
            f"dctimestep cdsDDS_0.mtx WeathersunM{MF_value}_0.smx | rmtxop -faf -t -c 47.4 119.9 11.6 - > annualRs_part0.ill",

            "rmtxop annualR_part0.ill + -s -1 annualRd_part0.ill + annualRs_part0.ill > annualRfinal_part0.ill",
            "echo Done single part0"
        ]
        write_bat(batch_single, single_lines)

        # run
        subprocess.Popen(["cmd.exe", "/c", "start", "cmd", "/c", os.path.basename(batch_single)], cwd=_root)

        # output
        _result_path = _root





    else:
        # split pts
        part_pts_paths, part_counts = split_pts_file(os.path.join(_root, "0.pts"), _root, N_PARTS)
        for i in range(N_PARTS):
            rows_i = part_counts[i]
            pts_i  = os.path.basename(part_pts_paths[i])
            bat_i  = os.path.join(_root, f"run_part{i}.bat")



            # unique names per part and avoid collisions
            Weather_wea = f"Weather_{i}.wea"
            Weather_smx = f"Weather_{i}.smx"
            Weatherd_smx = f"Weatherd_{i}.smx"
            Weathersun_smx = f"WeathersunM{MF_value}_{i}.smx"
            amodel = f"amodel_{i}.oct"
            bmodel = f"bmodel_{i}.oct"
            suns = f"suns_{i}.rad"
            sunoct = f"sunCoefficientsDDS_{i}.oct"

            illum = f"illum_part{i}.mtx"
            billum = f"billum_part{i}.mtx"
            cds = f"cdsDDS_part{i}.mtx"

            lines = [
                f"echo Annual RUN (part {i})",
                f"epw2wea {name_weather} {Weather_wea}",

                f"gendaymtx -m {_m} {Weather_wea} > {Weather_smx}",
                f"oconv envelope.mat envelope.rad > {amodel}",
                f"rfluxmtx -I+ -y {rows_i} {details_split} - skyglow.rad -i {amodel} < {pts_i} > {illum}",
                f"dctimestep {illum} {Weather_smx} | rmtxop -fa -t -c 47.4 119.9 11.6 - > annualR_part{i}.ill",

                f"oconv envelope.blk envelope.rad > {bmodel}",
                f"rfluxmtx -I+ -y {rows_i} {details_split} - skyglow.rad -i {bmodel} < {pts_i} > {billum}",
                f"gendaymtx -m {_m} -d {Weather_wea} > {Weatherd_smx}",
                f"dctimestep {billum} {Weatherd_smx} | rmtxop -fa -t -c 47.4 119.9 11.6 - > annualRd_part{i}.ill",

                f"echo void light solar 0 0 3 1e6 1e6 1e6 > {suns}",
                f"cnt {cnt_value} | rcalc -e MF:{MF_value} -f reinsrc.cal -e Rbin=recno -o \"solar source sun 0 0 4 ${{Dx}} ${{Dy}} ${{Dz}} 0.533\" >> {suns}",
                f"oconv -f envelope.blk envelope.rad {suns} > {sunoct}",
                f"rcontrib -I+ -ab {ab_value} -y {rows_i} -n {n_chunk} -ad 64 -lw {lw_value} -dc 1 -dt 0 -dj 0 -fa -e MF:{MF_value} -f reinhart.cal -b rbin -bn Nrbins -m solar {sunoct} < {pts_i} > {cds}",
                f"gendaymtx -5 0.533 -d -m {MF_value} {Weather_wea} > {Weathersun_smx}",
                f"dctimestep {cds} {Weathersun_smx} | rmtxop -fa -t -c 47.4 119.9 11.6 - > annualRs_part{i}.ill",

                f"rmtxop annualR_part{i}.ill + -s -1 annualRd_part{i}.ill + annualRs_part{i}.ill > annualRfinal_part{i}.ill",
                f"echo Done part {i}"
            ]
            write_bat(bat_i, lines)
            subprocess.Popen(["cmd.exe", "/c", "start", "cmd", "/c", os.path.basename(bat_i)], cwd=_root)
        _result_path = _root
    print("RUN complete: parts launched. _result_path set to:", _result_path)
else:
    _result_path = _root
# ---------- end annual_batch_file ----------
panel_38 = Panel(annual_batch_file.result_path)
lb_falsestarttoggle_15 = LBFalseStartToggle(True)
panel_39 = Panel("C:\kybele_UW_Greenhouse\annual_illuminance")
python_3_script_16 = Python3Script(result_path=annual_batch_file.result_path, build=lb_falsestarttoggle_15)  # -> out, result, sensors, hours, status
# ---------- python_3_script_16: Python ----------
ghenv.Component.Message = """Kybele 0.1 Beta
Load Annual Result"""

import os, io, re, struct, json, time

_result = None
sensors = hours = 0
status = ""

N_PARTS = 4 



# helpers
NUM_LINE = re.compile(r'^[\s\+\-\.0-9eE]+$')

def parse_dims_from_header(path):
    nrows = ncols = ncomp = None
    with io.open(path, "r", encoding="ascii", errors="ignore") as f:
        for line in f:
            s = line.strip()

            # stop if numeric data begins
            if s and NUM_LINE.match(s):
                break

            if s.startswith("NROWS="):
                try:
                    nrows = int(s.split("=",1)[1].strip())
                except:
                    pass

            elif s.startswith("NCOLS="):
                try:
                    ncols = int(s.split("=",1)[1].strip())
                except:
                    pass

            elif s.startswith("NCOMP="):
                try:
                    ncomp = int(s.split("=",1)[1].strip())
                except:
                    pass

    return nrows, ncols, ncomp





# find the result files
def find_part_files(folder):
    parts = {}
    for name in os.listdir(folder):
        low = name.lower()
        if not low.endswith(".ill"):
            continue
        m = re.search(r"_part(\d+)\.ill$", low)
        if not m:
            continue
        try:
            idx = int(m.group(1))
        except:
            continue
        parts[idx] = os.path.join(folder, name)
    return parts





# merge columns
def write_merged_ill(out_path, part_paths_ordered):
    # read header from part0, and dims
    p0 = part_paths_ordered[0]
    nrows, ncols_part, ncomp = parse_dims_from_header(p0)
    if not ncols_part:
        raise ValueError("Could not read NCOLS from part0 header.")
    total_cols = ncols_part * len(part_paths_ordered)


    # capture header lines from part0 up to first blank line
    header_lines = []
    with io.open(p0, "r", encoding="ascii", errors="ignore") as f:
        for line in f:
            if not line.strip():
                break
            header_lines.append(line.rstrip("\n"))


    # patch NCOLS line
    patched = []
    for hl in header_lines:
        if hl.strip().startswith("NCOLS="):
            patched.append("NCOLS={}".format(total_cols))
        else:
            patched.append(hl)


    # open output
    out_dir = os.path.dirname(out_path)
    if out_dir and not os.path.isdir(out_dir):
        os.makedirs(out_dir, exist_ok=True)


    # open all part files and skip headers to data section
    fs = []
    try:
        for p in part_paths_ordered:
            f = io.open(p, "r", encoding="ascii", errors="ignore", buffering=1024*1024)
            for line in f:
                if not line.strip():
                    break
            fs.append(f)

        with io.open(out_path, "w", encoding="ascii", newline="\n", buffering=1024*1024) as out:
            # write header with blank line
            for hl in patched:
                out.write(hl + "\n")
            out.write("\n")


            def next_data_line(fh):
                for line in fh:
                    s = line.strip()
                    if not s:
                        continue
                    if NUM_LINE.match(s):
                        return s
                return None

            rows_written = 0
            while True:
                if nrows is not None and rows_written >= nrows:
                    break

                lines = []
                for fh in fs:
                    s = next_data_line(fh)
                    if s is None:
                        return rows_written, total_cols, ncomp, nrows
                    lines.append(s)

                # concatenate
                out.write(" ".join(lines) + "\n")
                rows_written += 1

            return rows_written, total_cols, ncomp, nrows
    finally:
        for f in fs:
            try: f.close()
            except: pass




# main
if not _result_path or not isinstance(_result_path, str):
    status = "Provide a valid folder path that contains annualRfinal_part0..part3.ill"
else:
    folder = _result_path
    if not os.path.isdir(folder):
        status = "Provide a valid folder path (not a file path)."
    else:
        # target merged .ill
        merged_ill = os.path.join(folder, "annualRfinal.ill")
        raw = os.path.splitext(merged_ill)[0] + ".f32"
        meta = os.path.splitext(merged_ill)[0] + ".meta.json"

        if not _build:
            _result = raw if os.path.isfile(raw) else None
            if _result and os.path.isfile(meta):
                try:
                    m = json.load(open(meta, "r"))
                    sensors, hours = m.get("sensors", 0), m.get("hours", 0)
                    status = "Cache exists"
                except:
                    status = "Cache exists (meta unreadable)"
            else:
                status = "No cache yet — set _build True"
        else:
            try:
                parts = find_part_files(folder)

                missing = [i for i in range(N_PARTS) if i not in parts]
                if missing:
                    raise ValueError("Missing part files: {}. Expected _part0.._part3.ill in folder.".format(missing))

                ordered_paths = [parts[i] for i in range(N_PARTS)]
                rows_written, total_cols, ncomp, nrows_header = write_merged_ill(merged_ill, ordered_paths)
                nrows, ncols, ncomp2 = parse_dims_from_header(merged_ill)


                out = open(raw, "wb")
                rows = 0
                inferred_cols = None


                with io.open(merged_ill, "r", encoding="ascii", errors="ignore") as f:
                    in_data = False
                    for line in f:
                        s = line.strip()
                        if not in_data:
                            if not s:
                                in_data = True
                            continue
                        if not s or not NUM_LINE.match(s):
                            continue
                        parts_line = s.split()
                        if inferred_cols is None:
                            inferred_cols = len(parts_line)
                        for tok in parts_line:
                            try:
                                out.write(struct.pack("<f", float(tok)))
                            except:
                                pass
                        rows += 1
                out.close()


                hours = int(nrows if nrows else rows)
                sensors = int(ncols if ncols else (inferred_cols or 0))


                json.dump({
                    "ill_folder": folder,
                    "ill_path": merged_ill,
                    "raw_path": raw,
                    "sensors": int(sensors),
                    "hours": int(hours),
                    "order": "row-major hours x sensors (each row = hour)",
                    "ncomp": int(ncomp2 or 1),
                    "parts_used": [os.path.basename(p) for p in ordered_paths],
                    "merged_rows_written": int(rows_written),
                    "built": time.strftime("%Y-%m-%d %H:%M:%S")
                }, open(meta, "w"), indent=2)

                _result = raw
                status = "Merged + Cached: {} sensors × {} hours".format(sensors, hours)
                ghenv.Component.Message = "Build Annual Cache\nOK"

            except Exception as e:
                status = "Error: " + repr(e)
                ghenv.Component.Message = "Build Annual Cache\nERROR"
# ---------- end python_3_script_16 ----------
panel_40 = Panel(python_3_script_16.result)
panel_41 = Panel(python_3_script_16.status)
select_hour_index_3 = Button()
sensor = Slider(4, range=0..1000)
python_3_script_17 = Python3Script(run=select_hour_index_3)  # -> hour_index; same code as python_3_script_9
run = Button()
result_2 = Python3Script(result=python_3_script_16.result, mode="hour", index=python_3_script_17, run=Toggle(True))  # -> out, result, status; inputs result: String, index: Int32
# ---------- result_2: Python ----------
ghenv.Component.Message = """Kybele 0.1 Beta
Illuminance"""

import os, json
from array import array



result = []
nrows = ncols = 0
meta = {}
status = ""

def meta_path_for(cache_path):
    base, ext = os.path.splitext(cache_path)
    return base + ".meta.json"

def read_meta(path):
    with open(path, "r") as f:
        m = json.load(f)
    sensors = int(m.get("sensors", 0))
    hours   = int(m.get("hours", 0))
    ncomp   = int(m.get("ncomp", 1))
    return m, sensors, hours, ncomp

def load_f32(cache_path, expected_count):
    a = array('f')
    with open(cache_path, "rb") as f:
        a.fromfile(f, os.path.getsize(cache_path) // 4)
    if expected_count is not None and len(a) != expected_count:
        return a, "Size mismatch: got %d floats, expected %d" % (len(a), expected_count)
    return a, ""

if _run:
    if not _result or not isinstance(_result, str) or not os.path.isfile(_result):
        status = "Provide _result = path to .f32 cache"
    else:
        meta_path = meta_path_for(_result)
        if not os.path.isfile(meta_path):
            status = "Meta not found beside cache: %s" % meta_path
        else:
            try:
                meta, sensors, hours, ncomp = read_meta(meta_path)
                if sensors <= 0 or hours <= 0:
                    raise ValueError("Invalid dims in meta: sensors=%s, hours=%s" % (sensors, hours))
                if ncomp != 1:
                    raise ValueError("ncomp=%d not supported (expect illuminance single-component)" % ncomp)
                nrows, ncols = hours, sensors

                # load data
                expected = sensors * hours
                data, warn = load_f32(_result, expected)
                if not data:
                    raise ValueError("Failed to read cache")
                # choose mode
                mode = (_mode or "sensor").strip().lower() if isinstance(_mode, str) else "sensor"
                if mode not in ("sensor", "hour"):
                    mode = "sensor"

                idx = int(_index) if _index is not None else -1
                if mode == "sensor":
                    if idx < 0 or idx >= sensors:
                        raise IndexError("Sensor index out of range [0..%d]" % (sensors-1))
                    result = list(data[idx::sensors])[:hours]
                    status = "OK: sensor %d → %d hour values%s" % (idx, len(result), (" | " + warn) if warn else "")
                else:
                    if idx < 0 or idx >= hours:
                        raise IndexError("Hour index out of range [0..%d]" % (hours-1))
                    start = idx * sensors
                    end   = start + sensors
                    result = list(data[start:end])
                    if len(result) != sensors:
                        raise ValueError("Row width mismatch at hour %d" % idx)
                    status = "OK: hour %d → %d sensor values%s" % (idx, len(result), (" | " + warn) if warn else "")

            except Exception as e:
                status = "Error: %r" % e
# ---------- end result_2 ----------
result_3 = Python3Script(result=python_3_script_16.result, mode="sensor", index=sensor, run=Toggle(True))  # -> out, result, status; inputs result: String, index: Int32
# ---------- result_3: Python ----------
ghenv.Component.Message = """Kybele 0.1 Beta
Illuminance"""


import os, json
from array import array



result = []
nrows = ncols = 0
meta = {}
status = ""

def meta_path_for(cache_path):
    base, ext = os.path.splitext(cache_path)
    return base + ".meta.json"

def read_meta(path):
    with open(path, "r") as f:
        m = json.load(f)
    sensors = int(m.get("sensors", 0))
    hours   = int(m.get("hours", 0))
    ncomp   = int(m.get("ncomp", 1))
    return m, sensors, hours, ncomp

def load_f32(cache_path, expected_count):
    a = array('f')
    with open(cache_path, "rb") as f:
        a.fromfile(f, os.path.getsize(cache_path) // 4)
    if expected_count is not None and len(a) != expected_count:
        return a, "Size mismatch: got %d floats, expected %d" % (len(a), expected_count)
    return a, ""



if _run:
    if not _result or not isinstance(_result, str) or not os.path.isfile(_result):
        status = "Provide _result = path to .f32 cache"
    else:
        meta_path = meta_path_for(_result)
        if not os.path.isfile(meta_path):
            status = "Meta not found beside cache: %s" % meta_path
        else:
            try:
                meta, sensors, hours, ncomp = read_meta(meta_path)
                if sensors <= 0 or hours <= 0:
                    raise ValueError("Invalid dims in meta: sensors=%s, hours=%s" % (sensors, hours))
                if ncomp != 1:
                    raise ValueError("ncomp=%d not supported (expect illuminance single-component)" % ncomp)
                nrows, ncols = hours, sensors

                # load data
                expected = sensors * hours
                data, warn = load_f32(_result, expected)
                if not data:
                    raise ValueError("Failed to read cache")
                # choose mode
                mode = (_mode or "sensor").strip().lower() if isinstance(_mode, str) else "sensor"
                if mode not in ("sensor", "hour"):
                    mode = "sensor"

                idx = int(_index) if _index is not None else -1
                if mode == "sensor":
                    if idx < 0 or idx >= sensors:
                        raise IndexError("Sensor index out of range [0..%d]" % (sensors-1))
                    result = list(data[idx::sensors])[:hours]
                    status = "OK: sensor %d → %d hour values%s" % (idx, len(result), (" | " + warn) if warn else "")
                else:
                    if idx < 0 or idx >= hours:
                        raise IndexError("Hour index out of range [0..%d]" % (hours-1))
                    start = idx * sensors
                    end   = start + sensors
                    result = list(data[start:end])
                    if len(result) != sensors:
                        raise ValueError("Row width mismatch at hour %d" % idx)
                    status = "OK: hour %d → %d sensor values%s" % (idx, len(result), (" | " + warn) if warn else "")

            except Exception as e:
                status = "Error: %r" % e
# ---------- end result_3 ----------
number_slider_8 = Slider(1, range=0..1)
grid_mode = Slider(1, range=0..3)
concatenate = Concatenate(
    Fragment_A="""Point-in-time Illuminance from Daylight
hour: """,
    Fragment_B=python_3_script_17,
    A=""" (out of 8760 annual hours)
Lux""")
toggle = BooleanToggle(True)
colrange_2 = LBColorRange(index=Slider(2, range=0..26))  # -> colors; plug-in component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
pln_2 = Plane(Plane(origin=(1.966829709, -1.371383996, 0), x=(0.7880107536, -0.6156614753, 0), y=(0.6156614753, 0.7880107536, 0)))
legendpar_2 = LBLegendParameters(
    min=Slider(20000, range=0..120000),
    max=Slider(120000, range=0..120000),
    colors=colrange_2,
    continuous_leg=Toggle(True),
    num_decimals=Toggle(False),
    text_height=Slider(0.237, range=0..1))  # -> leg_par; plug-in component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
python_3_script_18 = Python3Script(
    result_hourly=result_3.result,
    graph_title="Annual Hourly Illuminance Heat Map ",
    range1=Slider(300, range=0..100000),
    range2=Slider(1000, range=0..100000),
    range3=Slider(10000, range=0..100000),
    range4=Slider(30000, range=0..100000),
    name_range1="ill<300 Lux",
    name_range2="300 lx - 1000 Lux",
    name_range3="1000 lx - 10000 Lux",
    name_range4="10000 lx - 30000 Lux",
    name_range5="30000 Lux < ill",
    run=run,
    grid_mode=grid_mode,
    grid_color=ColourSwatch(SwatchColor=RGB(207, 207, 207)))  # -> out, form; inputs result_hourly: list
# ---------- python_3_script_18: Python ----------
ghenv.Component.Message = """Kybele 0.1 Beta
Annual Plot"""


import System.Windows.Forms as WinForms
import System.Drawing as Drawing
from System.Drawing import Point, Color
from System.Drawing.Drawing2D import SmoothingMode, PixelOffsetMode

# Inputs
if not _run:
    ghenv.Component.Message =  """Kybele 0.1 Beta
Annual Plot"""
else:
    try:
        flat_data = [float(x) for x in _result_hourly if x is not None]
        if len(flat_data) != 8760:
            raise ValueError("Expected 8760 values.")
    except:
        WinForms.MessageBox.Show("PAR_8760 must contain exactly 8760 float values.", "Error")
        raise

    thresholds = [
        float(_range1) if _range1 is not None else 0,
        float(_range2) if _range2 is not None else 10,
        float(_range3) if _range3 is not None else 20,
        float(_range4) if _range4 is not None else 50
    ]

    # Ascending thresholds
    if not (thresholds[0] <= thresholds[1] <= thresholds[2] <= thresholds[3]):
        WinForms.MessageBox.Show("Ranges must be ascending (r1 ≤ r2 ≤ r3 ≤ r4).", "Invalid Ranges")
        raise ValueError("Non-ascending thresholds")

    # Color Setup
    def to_color(val):
        if val is None:
            return Color.LightGray
        if isinstance(val, Color):
            return val
        if isinstance(val, (tuple, list)) and len(val) == 3:
            return Color.FromArgb(int(val[0]), int(val[1]), int(val[2]))
        if isinstance(val, str):
            s = val.strip()
            if ',' in s or ' ' in s:
                s = s.replace('(', '').replace(')', '')
                parts = [p for p in s.replace(',', ' ').split(' ') if p]
                if len(parts) == 3:
                    r, g, b = [int(float(p)) for p in parts]
                    return Color.FromArgb(r, g, b)
            s = s.lstrip('#')
            if len(s) == 6:
                r = int(s[0:2], 16); g = int(s[2:4], 16); b = int(s[4:6], 16)
                return Color.FromArgb(r, g, b)
        raise ValueError("Unsupported color format: use '#rrggbb', (r,g,b), 'r,g,b', or a GH Color.")

    def hex_to_color(hex_str):
        s = hex_str.lstrip('#')
        return Drawing.Color.FromArgb(int(s[0:2], 16), int(s[2:4], 16), int(s[4:6], 16))

    # Grid / inset mode
    mode = int(round(float(_grid_mode))) if _grid_mode is not None else 0
    mode = max(0, min(3, mode))  # clamp to 0..3

    INSET = 0.5
    inset_px     = INSET if mode == 1 else 0.0
    grid_enabled = (mode in (2, 3))
    grid_color   = to_color("#636363") if mode == 3 else \
                   (to_color(_grid_color) if _grid_color else Drawing.Color.LightGray)

    # Bucket 0 color
    first_color = hex_to_color("#808080") if mode == 3 else hex_to_color("#ffffff")

    colors = [
        first_color,                 # imperceptible
        hex_to_color("#f9ebab"),     # perceptible
        hex_to_color("#f0be39"),     # disturbing
        hex_to_color("#e46828"),     # intolerable
        hex_to_color("#d70e17")      # excessive
    ]

    # Classification
    def classify(value):
        if value <= thresholds[0]: return 0
        elif value <= thresholds[1]: return 1
        elif value <= thresholds[2]: return 2
        elif value <= thresholds[3]: return 3
        else: return 4

    # Custom range names
    def _safe_name(val, default):
        return val if (val is not None and str(val).strip() != "") else default

    n1 = _safe_name(globals().get("_name_range1"), "Imperceptible")
    n2 = _safe_name(globals().get("_name_range2"), "Perceptible")
    n3 = _safe_name(globals().get("_name_range3"), "Disturbing")
    n4 = _safe_name(globals().get("_name_range4"), "Intolerable")
    n5 = _safe_name(globals().get("_name_range5"), "Excessive")
    range_names = [n1, n2, n3, n4, n5]


    # Heatmap Form Class
    class PARHeatmapForm(WinForms.Form):
        def __init__(self, data):
            super(PARHeatmapForm, self).__init__()
            self.Text = "Hourly Heat Map"
            self.StartPosition = WinForms.FormStartPosition.CenterScreen
            self.FormBorderStyle = WinForms.FormBorderStyle.Sizable
            self.DoubleBuffered = True
            self.BackColor = Drawing.Color.Gray if mode == 3 else Drawing.Color.White


            self.mode = mode
            self.inset_px = inset_px
            self.grid_enabled = grid_enabled
            self.grid_color = grid_color
            self.colors = colors
            self.range_names = range_names

            self.cell_w = 4
            self.cell_h = 20
            self.cols = 365
            self.rows = 24
            self.title_height = 25
            self.margin_top = 40
            self.margin_right = 130
            self.margin_left = 30
            self.margin_bottom = 200
            self.data = data

            self.ClientSize = Drawing.Size(
                self.margin_left + self.cols * self.cell_w + self.margin_right,
                self.rows * self.cell_h + self.margin_bottom + self.margin_top
            )

            self.Paint += self.on_paint
            self.MouseMove += self.on_mouse_move

            self.save_btn = WinForms.Button()
            self.save_btn.Text = "Export PNG"
            self.save_btn.Height = 30
            self.save_btn.Dock = WinForms.DockStyle.Bottom
            self.save_btn.Margin = WinForms.Padding(0, 10, 0, 10)
            self.save_btn.Click += self.on_export_click
            self.Controls.Add(self.save_btn)

            self.hover_label = WinForms.Label()
            self.hover_label.AutoSize = True
            self.hover_label.Location = Point(120, self.rows * self.cell_h + self.margin_top + 70)
            self.Controls.Add(self.hover_label)

        def on_paint(self, sender, e):
            g = e.Graphics
            g.SmoothingMode = SmoothingMode.Default
            g.PixelOffsetMode = PixelOffsetMode.HighSpeed

            # Shift title
            g.TranslateTransform(self.margin_left, self.margin_top + self.title_height)

            # GDI objects
            bucket_brushes = [Drawing.SolidBrush(c) for c in self.colors]
            grid_pen = Drawing.Pen(self.grid_color) if self.grid_enabled else None

            # Heatmap cells
            inset = float(self.inset_px)
            for i in range(self.rows):
                for j in range(self.cols):
                    idx = j * 24 + i
                    value = self.data[idx]
                    cat = classify(value)
                    brush = bucket_brushes[cat]

                    x = j * self.cell_w
                    y = i * self.cell_h

                    # symmetric inset
                    ix = x + inset
                    iy = y + inset
                    w  = self.cell_w  - 2 * inset
                    h  = self.cell_h  - 2 * inset

                    g.FillRectangle(brush, ix, iy, w, h)

                    if self.grid_enabled:
                        g.DrawRectangle(grid_pen, x, y, self.cell_w, self.cell_h)

            # Month dividers and labels
            month_starts = [0, 31, 59, 90, 120, 151, 181, 212, 243, 273, 304, 334]
            month_names = ["Jan", "Feb", "Mar", "Apr", "May", "Jun",
                           "Jul", "Aug", "Sep", "Oct", "Nov", "Dec"]

            if self.mode == 2:
                month_pen = Drawing.Pens.Gray
            elif self.mode == 3:
                month_pen = Drawing.Pens.Black
            else:
                month_pen = Drawing.Pens.LightGray

            for idx, day in enumerate(month_starts):
                x = day * self.cell_w
                g.DrawLine(month_pen, x, 0, x, self.rows * self.cell_h)
                g.DrawString(month_names[idx], self.Font, Drawing.Brushes.Black,
                             x + 50, self.rows * self.cell_h + 5)

            # Hour labels
            for i in [0, 6, 12, 18, 24]:
                if i <= 24:
                    label = str(i).zfill(2) + ":00"
                    y = i * self.cell_h - 20
                    g.DrawString(label, self.Font, Drawing.Brushes.Black,
                                 self.cols * self.cell_w + 5, y)


            # Legend (counts + labels)
            legend_counts = [0] * 5
            for val in self.data:
                legend_counts[classify(val)] += 1

            total = float(len(self.data))
            percentages = [int(round(c / total * 100)) for c in legend_counts]

            legend_labels = [
                "{}% {}".format(percentages[0], self.range_names[0]),
                "{}% {}".format(percentages[1], self.range_names[1]),
                "{}% {}".format(percentages[2], self.range_names[2]),
                "{}% {}".format(percentages[3], self.range_names[3]),
                "{}% {}".format(percentages[4], self.range_names[4])
            ]

            legend_spacing = 55
            legend_elements = []
            total_width = 0
            for i in range(5):
                label = legend_labels[i]
                label_size = g.MeasureString(label, self.Font)
                element_width = 20 + 5 + int(label_size.Width) + legend_spacing
                legend_elements.append((label, element_width))
                total_width += element_width

            legend_x = (self.cols * self.cell_w - total_width) // 2
            legend_y = self.rows * self.cell_h + self.margin_top + 45

            for i, (label, element_width) in enumerate(legend_elements):
                g.FillRectangle(bucket_brushes[i], legend_x, legend_y, 20, 15)
                g.DrawString(label, self.Font, Drawing.Brushes.Black, legend_x + 25, legend_y)
                legend_x += element_width

            # Reset transform
            g.ResetTransform()

            # Title
            title_font = Drawing.Font(self.Font.FontFamily, 10) # Drawing.FontStyle.Bold
            title = _graph_title or ""
            sz = g.MeasureString(title, title_font)
            g.DrawString(_graph_title, title_font, Drawing.Brushes.Black,
                        self.margin_left + (self.cols * self.cell_w - sz.Width) / 2.0, 10)

            # X-Axis Label
            g.DrawString("Day of Year", self.Font, Drawing.Brushes.Black,
                        self.margin_left + self.cols * self.cell_w // 2 - 30,
                        self.rows * self.cell_h + self.margin_top + 70)

            # Y-Axis Label
            g.TranslateTransform(self.cols * self.cell_w + 90,
                                 self.margin_top + self.rows * self.cell_h // 2 + 30)
            g.RotateTransform(-90)
            g.DrawString("Time of Day", self.Font, Drawing.Brushes.Black, -60, 30)
            g.ResetTransform()

            # GDI objects
            if grid_pen: grid_pen.Dispose()
            for b in bucket_brushes: b.Dispose()

        def on_mouse_move(self, sender, e):
            x, y = e.X, e.Y
            col = (x - self.margin_left) // self.cell_w
            row = (y - self.margin_top - self.title_height) // self.cell_h
            if 0 <= col < 365 and 0 <= row < 24:
                index = col * 24 + row
                val = round(self.data[index], 2)
                self.hover_label.Text = f"Day {col+1}, Hour {row}: {val}"

        def on_export_click(self, sender, args):
            dialog = WinForms.SaveFileDialog()
            dialog.Filter = "PNG Image|*.png"
            dialog.FileName = _graph_title
            if dialog.ShowDialog() == WinForms.DialogResult.OK:
                try:
                    bmp = Drawing.Bitmap(self.ClientSize.Width, self.ClientSize.Height)
                    g = Drawing.Graphics.FromImage(bmp)
                    g.Clear(self.BackColor)
                    paint_args = WinForms.PaintEventArgs(g, self.ClientRectangle)
                    self.on_paint(self, paint_args)
                    bmp.Save(dialog.FileName)
                    WinForms.MessageBox.Show("Saved successfully to:\n" + dialog.FileName)
                except Exception as e:
                    WinForms.MessageBox.Show("Export failed:\n" + str(e), "Error")

    # Show Form
    form = PARHeatmapForm(flat_data)
    form.Show()
# ---------- end python_3_script_18 ----------
panel_42 = Panel(result_2.result)
heatmap_2 = LBSpatialHeatmap(values=result_2.result, mesh=genpts.mesh, legend_par=legendpar_2, legend_title=concatenate)  # -> mesh, legend, title, colors, legend_par, vis_set; plug-in component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
list_item = ListItem(List=genpts.points, Index=sensor, Wrap=True)
point_4 = Point(list_item)
python_3_script_19 = Python3Script(point=point_4)  # -> out, marker
# ---------- python_3_script_19: Python ----------
ghenv.Component.Message = """Kybele 0.1 Beta
Sensor Marker"""

import Rhino.Geometry as rg
import scriptcontext as sc
import System

# input
def coerce_point(x):
    if isinstance(x, rg.Point3d): return x
    if hasattr(x, "Location"):    return x.Location
    if isinstance(x, System.Guid):
        obj = sc.doc.Objects.FindId(x)
        if obj and hasattr(obj, "Geometry") and isinstance(obj.Geometry, rg.Point):
            return obj.Geometry.Location
    return None

_marker = None

C = coerce_point(_point)
if C and _grid_size and _grid_size > 0:
    tol = sc.doc.ModelAbsoluteTolerance
    r   = float(_grid_size) * 0.5

    # sphere
    s_brep = rg.Brep.CreateFromSphere(rg.Sphere(C, r))

    # cutting plane
    up = Up if (Up and Up.IsValid and Up.Length > 0) else rg.Vector3d.ZAxis
    up.Unitize()
    pl = rg.Plane(C, up)

    # finite plane
    side = _grid_size * 10.0
    psrf = rg.PlaneSurface(pl, rg.Interval(-side, side), rg.Interval(-side, side))
    pbrep = psrf.ToBrep()

    # split sphere with plane-brep
    parts = s_brep.Split(pbrep, tol)
    if parts and len(parts) >= 2:
        # the piece
        def score(b):
            c = b.GetBoundingBox(True).Center
            v = c - C
            return rg.Vector3d.Multiply(up, rg.Vector3d(v))
        _marker = max(parts, key=score)
# ---------- end python_3_script_19 ----------
custom_preview_3 = CustomPreview(Geometry=python_3_script_19.marker, Material=ColourSwatch(SwatchColor=RGBA(31, 31, 31, 92)))

# ----
# Electric Lighting Simulation
# Electric Lighting Simulation
# 2
# Combined Illuminance
lb_falsestarttoggle_16 = LBFalseStartToggle(True)
modeltorad_4 = HBModelToRadFolder(model=assigngridsviews, folder=panel_4, write=lb_falsestarttoggle_16)  # -> out, folder; plug-in component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
panel_43 = Panel(modeltorad_4.folder)
lb_falsestarttoggle_17 = LBFalseStartToggle(True)
python_3_script_20 = Python3Script(
    folder=modeltorad_4.folder,
    lum_rad_path=write_luminaries_file.lum_rad_path,
    details=Slider(0, range=0..4),
    electric_lighting=Toggle(True),
    run=lb_falsestarttoggle_17)  # -> out, result_path
# ---------- python_3_script_20: Python ----------
ghenv.Component.Message = """Kybele 0.1 Beta
PIT Electric"""

import os
from pathlib import Path
import subprocess
import shutil

# Path
batch_file = str(_folder) + r"\run_simulation.bat"

cores = os.cpu_count()
print("Total CPU cores:", cores)



if os.path.isfile(lum_rad_path):
    luminaries_file = os.path.basename(lum_rad_path)
else:
    luminaries_file = "luminaries.rad"



# oconv command
if _electric_lighting == True:
    oconv_cmd = f"oconv envelope.mat envelope.rad {luminaries_file} > model.oct"
else:
    oconv_cmd = f"oconv envelope.mat envelope.rad sky.rad > model.oct"

grid_dir = os.path.join(_folder, "model", "grid")
os.makedirs(grid_dir, exist_ok=True)


# rename the pts file
pts_candidates = [f for f in os.listdir(grid_dir) if f.lower().endswith(".pts")]
if "0.pts" not in pts_candidates and pts_candidates:
    old_path = os.path.join(grid_dir, pts_candidates[0])
    new_path = os.path.join(grid_dir, "0.pts")
    try:
        os.replace(old_path, new_path)
        print(f"Renamed {pts_candidates[0]} -> 0.pts")
    except Exception as e:
        print(f"Warning: could not rename {pts_candidates[0]} to 0.pts ({e})")





# copy envelope files
def copy_to_root(file_name, folder_path):
    full_path = os.path.join(_folder, folder_path, file_name)
    root_path = os.path.join(_folder, file_name)
    if not os.path.isfile(full_path):
        raise FileNotFoundError(f"{file_name} not found at {full_path}")
    shutil.copy2(full_path, root_path)

copy_to_root("envelope.rad", "model\scene")
copy_to_root("envelope.mat", "model\scene")
copy_to_root("envelope.blk", "model\scene")
copy_to_root("0.pts", "model\grid")

if os.path.isfile(lum_rad_path):
    luminaire_folder = os.path.dirname(lum_rad_path)
    for file_name in os.listdir(luminaire_folder):
        source_path = os.path.join(luminaire_folder, file_name)
        target_path = os.path.join(_folder, file_name)
        if os.path.isfile(source_path):
            shutil.copy2(source_path, target_path)





# default
rtrace_cmd = "rtrace -I -h -ab 2 -ad 1024 -aa 0.1 -ar 64 -lr 6 -lw 1e-4 model.oct < 0.pts > raw.txt"
amb_flags = "-af amb.cache -aw 0"

# Electric
elec_fast = f"-ab 1 -ad 512  -as 64  -aa 0.18 -ar 48  -lr 4  -lw 3e-4 -ds 0   -dj 0   -dt 0.15 -st 0.20 -n {cores} " + amb_flags


low_details  = f"-ab 1 -ad 512  -as 128  -aa 0.15 -ar 64  -lr 4  -lw 2e-4 -ds 0.5 -dj 0.7 -dt 0.10 -st 0.15 -n {cores}  " + amb_flags
mid_details  = f"-ab 1 -ad 1024 -as 512  -aa 0.10 -ar 96  -lr 8  -lw 1e-4 -ds 0.3 -dj 0.6 -dt 0.07 -st 0.10 -n {cores} " + amb_flags
high_details = f"-ab 1 -ad 4096 -as 1024 -aa 0.07 -ar 128 -lr 8  -lw 8e-5 -ds 0.2 -dj 0.5 -dt 0.05 -st 0.08 -n {cores} " + amb_flags

_custom_details = str(_custom_parameter)




# choose by _details
if _electric_lighting and _details == 0:
    rtrace_cmd = f"rtrace -I -h {elec_fast} model.oct < 0.pts > raw.txt"
elif _details == 1:
    rtrace_cmd = f"rtrace -I -h {mid_details} model.oct < 0.pts > raw.txt"
elif _details == 2:
    rtrace_cmd = f"rtrace -I -h {high_details} model.oct < 0.pts > raw.txt"
elif _details == 3:
    rtrace_cmd = f"rtrace -I -h {_custom_details} model.oct < 0.pts > raw.txt"
else:
    rtrace_cmd = f"rtrace -I -h {low_details} model.oct < 0.pts > raw.txt"

print(rtrace_cmd)




# Commands
commands = [
    "echo Running Radiance Simulation",
    oconv_cmd,
    rtrace_cmd,
    "echo Done!"
]



# Write
if _run:
    try:
        with open(batch_file, "w") as f:
            for cmd in commands:
                f.write(cmd + "\n")
        print(f"Batch file saved: {batch_file}")
        base_name = os.path.basename(batch_file)
        subprocess.run(["cmd.exe", "/c", f"{base_name}"], cwd=f"{_folder}", check=False)

        raw_path = os.path.join(_folder, "raw.txt")
        print(raw_path)
        if os.path.isfile(raw_path):
            _result_path = raw_path
        else:
            print(f"{raw_path} not found")


    except Exception as e:
        print('Error: ', e)
# ---------- end python_3_script_20 ----------
panel_44 = Panel(python_3_script_20.result_path)
python_3_script_21 = Python3Script(result_path=python_3_script_20.result_path, name="electric", run=Toggle(True))  # -> out, result, status
# ---------- python_3_script_21: Python ----------
ghenv.Component.Message = """Kybele 0.1 Beta 
Load Electric PIT"""

import os, re, struct, json, time


_result = None
_status = ""

_folder = os.path.dirname(_result_path)

def read_rgb_lines(path):
    vals = []
    with open(path, "r") as f:
        for line in f:
            s = line.strip()
            if not s or s.startswith(("#","!")):
                continue
            parts = re.split(r"[,\s]+", s)
            if len(parts) < 3:
                continue
            try:
                r, g, b = float(parts[0]), float(parts[1]), float(parts[2])
            except:
                continue

            rgb_factor = 0.265 * r + 0.670 * g + 0.065 * b
            ill = 179.0 * rgb_factor
            vals.append(ill)
    return vals

def write_f32_le(path, floats):
    with open(path, "wb") as out:
        for v in floats:
            out.write(struct.pack("<f", float(v)))

def write_meta(path_base, sensors, hours, src_raw):
    meta = {
        "raw_path": src_raw,
        "raw_type": "rgb->lux (electric PIT)",
        "sensors": int(sensors),
        "hours": int(hours),
        "order": "row-major hours x sensors (each row = hour)",
        "ncomp": 1,
        "built": time.strftime("%Y-%m-%d %H:%M:%S")
    }
    with open(path_base + ".meta.json", "w") as f:
        json.dump(meta, f, indent=2)

if _run:
    try:
        if not _folder or not os.path.isdir(_folder):
            raise ValueError("Provide a valid _folder containing raw.txt")

        raw_path = os.path.join(_folder, "raw.txt")
        if not os.path.isfile(raw_path):
            raise IOError("raw.txt not found at: %s" % raw_path)

        name = (_name or "electricPIT").strip() if isinstance(_name, str) else "electricPIT"
        base = os.path.join(_folder, name)
        f32_path = base + ".f32"


        lux_vals = read_rgb_lines(raw_path)
        if not lux_vals:
            raise ValueError("No valid RGB lines parsed from raw.txt")

        sensors = len(lux_vals)
        hours = 1  


        write_f32_le(f32_path, lux_vals)
        write_meta(base, sensors, hours, raw_path)

        _result = f32_path
        _status = "OK: wrote %d sensor values to %s (hours=%d)" % (sensors, os.path.basename(f32_path), hours)

    except Exception as e:
        _result = None
        _status = "ERROR: %s" % (e,)
else:
    _status = "Set _run=True to build cache"
# ---------- end python_3_script_21 ----------
panel_45 = Panel(python_3_script_21.result)
result_4 = Python3Script(result=python_3_script_21.result, mode="hour", index=0, run=Toggle(True))  # -> out, result, status; inputs result: String, index: Int32
# ---------- result_4: Python ----------
ghenv.Component.Message = """Kybele 0.1 Beta
Illuminance"""

import os, json
from array import array



result = []
nrows = ncols = 0
meta = {}
status = ""

def meta_path_for(cache_path):
    base, ext = os.path.splitext(cache_path)
    return base + ".meta.json"

def read_meta(path):
    with open(path, "r") as f:
        m = json.load(f)

    sensors = int(m.get("sensors", 0))
    hours   = int(m.get("hours", 0))
    ncomp   = int(m.get("ncomp", 1))
    return m, sensors, hours, ncomp

def load_f32(cache_path, expected_count):
    a = array('f')
    with open(cache_path, "rb") as f:
        a.fromfile(f, os.path.getsize(cache_path) // 4)
    if expected_count is not None and len(a) != expected_count:
        return a, "Size mismatch: got %d floats, expected %d" % (len(a), expected_count)
    return a, ""

if _run:
    if not _result or not isinstance(_result, str) or not os.path.isfile(_result):
        status = "Provide _result = path to .f32 cache"
    else:
        meta_path = meta_path_for(_result)
        if not os.path.isfile(meta_path):
            status = "Meta not found beside cache: %s" % meta_path
        else:
            try:
                meta, sensors, hours, ncomp = read_meta(meta_path)
                if sensors <= 0 or hours <= 0:
                    raise ValueError("Invalid dims in meta: sensors=%s, hours=%s" % (sensors, hours))
                if ncomp != 1:
                    raise ValueError("ncomp=%d not supported (expect illuminance single-component)" % ncomp)
                nrows, ncols = hours, sensors

                # load data
                expected = sensors * hours
                data, warn = load_f32(_result, expected)
                if not data:
                    raise ValueError("Failed to read cache")
                # choose mode
                mode = (_mode or "sensor").strip().lower() if isinstance(_mode, str) else "sensor"
                if mode not in ("sensor", "hour"):
                    mode = "sensor"

                idx = int(_index) if _index is not None else -1
                if mode == "sensor":
                    if idx < 0 or idx >= sensors:
                        raise IndexError("Sensor index out of range [0..%d]" % (sensors-1))
                    result = list(data[idx::sensors])[:hours]
                    status = "OK: sensor %d → %d hour values%s" % (idx, len(result), (" | " + warn) if warn else "")
                else:
                    if idx < 0 or idx >= hours:
                        raise IndexError("Hour index out of range [0..%d]" % (hours-1))
                    start = idx * sensors
                    end   = start + sensors
                    result = list(data[start:end])
                    if len(result) != sensors:
                        raise ValueError("Row width mismatch at hour %d" % idx)
                    status = "OK: hour %d → %d sensor values%s" % (idx, len(result), (" | " + warn) if warn else "")

            except Exception as e:
                status = "Error: %r" % e
# ---------- end result_4 ----------
python_3_script_22 = Python3Script(day=result_2.result, elec=result_4.result)  # -> out, flatten(combined)
# ---------- python_3_script_22: Python ----------
ghenv.Component.Message = """Kybele 0.1 Beta
Combined Lighting"""

import System
from Grasshopper.Kernel import GH_RuntimeMessageLevel as RML

_combined = []

def is_tree(x):
    return hasattr(x, "BranchCount") and hasattr(x, "Branch") and hasattr(x, "Path")

def flatten_any(x):
    if x is None: return []
    if is_tree(x):
        L = []
        for bi in range(x.BranchCount):
            br = x.Branch(x.Path(bi))
            for it in br: L.append(it)
        return L
    if isinstance(x, (list, tuple)):
        return list(x)
    return [x]

def to_float(v):
    try: return float(v)
    except:
        try: return float(str(v))
        except: return None

def err(msg):
    ghenv.Component.AddRuntimeMessage(RML.Error, str(msg))

E = flatten_any(_elec)
D = flatten_any(_day)

if not E or not D:
    err("Provide both _elec and _day lists.")
else:
    if len(E) != len(D):
        err("Length mismatch: _elec=%d, _day=%d" % (len(E), len(D)))
    n = min(len(E), len(D))
    for i in range(n):
        e = to_float(E[i])
        d = to_float(D[i])
        _combined.append((e if e is not None else 0.0) + (d if d is not None else 0.0))
# ---------- end python_3_script_22 ----------
panel_46 = Panel(result_4.result)
panel_47 = Panel(python_3_script_22.combined)
concatenate_2 = Concatenate(
    Fragment_A="""Point-in-time Illuminance 
from Daylight + Electric Lighting
hour: """,
    Fragment_B=python_3_script_17,
    A=""" (out of 8760 annual hours)
Lux""")
colrange_3 = LBColorRange(index=Slider(2, range=0..26))  # -> colors; plug-in component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
colrange_4 = LBColorRange(index=Slider(2, range=0..26))  # -> colors; plug-in component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
legendpar_3 = LBLegendParameters(
    min=Slider(10000, range=0..120000),
    max=Slider(120000, range=0..120000),
    colors=colrange_3,
    continuous_leg=Toggle(True),
    num_decimals=Toggle(False),
    text_height=Slider(0.193, range=0..1))  # -> leg_par; plug-in component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
legendpar_4 = LBLegendParameters(
    min=Slider(300, range=0..120000),
    max=Slider(3000, range=0..20000),
    colors=colrange_4,
    continuous_leg=Toggle(True),
    num_decimals=Toggle(False),
    text_height=Slider(0.193, range=0..1))  # -> leg_par; plug-in component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

# ----
# Preview me to see point in time illuminance
# results both from daylight (PIT) and electric lighting!
# Unpreview to see other heat maps!
heatmap_3 = LBSpatialHeatmap(values=python_3_script_22.combined, mesh=genpts.mesh, legend_par=legendpar_3, legend_title=concatenate_2)  # -> mesh, legend, title, colors, legend_par, vis_set; plug-in component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

# ----
# Preview me to see point in time illuminance
# from electric lighting only!
# Unpreview to see other heat maps!
heatmap_4 = LBSpatialHeatmap(
    values=result_4.result,
    mesh=genpts.mesh,
    legend_par=legendpar_4,
    legend_title="""Point-in-time Illuminance from Electric Lighting
Lux""")  # -> mesh, legend, title, colors, legend_par, vis_set; plug-in component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

point_in_time_illuminance = Python3Script(result=python_3_script_21.result, hour_index=0, conversion_factor=python_3_script_6.conversion_factor)  # -> out, flatten(PAR); inputs result: String
# ---------- point_in_time_illuminance: Python ----------
ghenv.Component.Message = """Kybele 0.1 Beta
Hourly PAR"""


import os, json, mmap, struct
import Rhino.Geometry as rg

_PAR = []


def is_tree(x):
    return hasattr(x, "BranchCount") and hasattr(x, "Branch") and hasattr(x, "Path")

def to_float(x):
    try: return float(x)
    except:
        try: return float(str(x))
        except: return None

def parse_factor(val):
    default = 0.0185
    if isinstance(val, (int, float)): return float(val)
    if val is None: return default
    s = str(val).strip().lower()
    if s in ("electric","elec","electriconly","electric_light","electriclighting"): return 0.015
    if s in ("sunonly","sun","sunlight"): return 0.0205
    if s in ("skyonly","sky"): return 0.0135
    try: return float(s)
    except: return default

def lux_to_par(lux, factor):
    return lux * factor 

def meta_path_for(cache_path):
    base, _ = os.path.splitext(cache_path)
    return base + ".meta.json"

def read_meta(meta_path):
    with open(meta_path, "r") as f:
        m = json.load(f)
    S = int(m.get("sensors", 0))
    H = int(m.get("hours", 0))
    C = int(m.get("ncomp", 1))
    if S <= 0 or H <= 0:
        raise ValueError("Invalid dims in meta: sensors=%r hours=%r" % (S, H))
    if C != 1:
        raise ValueError("ncomp=%r not supported (expect illuminance single component)" % C)
    return S, H

def open_memmap_f32_le(path):
    f = open(path, "rb")
    mm = mmap.mmap(f.fileno(), 0, access=mmap.ACCESS_READ)
    return f, mm

def read_hour_row(mm, sensors, hours, h):
    if not (0 <= h < hours):
        raise IndexError("hour_index %d out of range [0..%d]" % (h, hours-1))
    start = h * sensors * 4
    end   = start + sensors * 4
    bs = mm[start:end]
    return list(struct.unpack("<%df" % sensors, bs))


_PAR = []
if isinstance(_result, str) and os.path.isfile(_result) and _hour_index is not None:
    try:
        cache_path = _result
        meta_path  = meta_path_for(cache_path)
        if not os.path.isfile(meta_path):
            raise IOError("Meta file not found: %s" % meta_path)

        S, H = read_meta(meta_path)


        f, mm = open_memmap_f32_le(cache_path)
        try:
            h = int(_hour_index)
            lux_row = read_hour_row(mm, S, H, h)
        finally:
            mm.close(); f.close()


        k = parse_factor(_conversion_factor)
        _PAR = [lux_to_par(v, k) for v in lux_row]

        

    except Exception as e:
        _PAR = []
else:
    _PAR = []
# ---------- end point_in_time_illuminance ----------
panel_48 = Panel(point_in_time_illuminance.PAR)
colrange_5 = LBColorRange(index=Slider(2, range=0..26))  # -> colors; plug-in component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
legendpar_5 = LBLegendParameters(
    min=Slider(100, range=0..101),
    max=Slider(300, range=0..600),
    colors=colrange_5,
    continuous_leg=Toggle(True),
    num_decimals=Toggle(False),
    text_height=Slider(0.193, range=0..1))  # -> leg_par; plug-in component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

# ----
# Use the button below to select
# date, time, and hour (PIT) for PPFD
select_hour_index_4 = Button()

# ----
# Preview me to see point in time PPFD
# results for the electric lighting!
# Unpreview to see other heat maps!
# 
# The ideal value varies by plant and growth stage: Generally,
# Seedling/Clone: 100-300 umol/m2/s
# Vegetative: 200-600 umol/m2/s
# Bloom/Flowering: 500-1050 umol/m2/s
heatmap_5 = LBSpatialHeatmap(
    values=point_in_time_illuminance.PAR,
    mesh=genpts.mesh,
    legend_par=legendpar_5,
    legend_title="""PPFD from Electric Light
umol/m2/s""")  # -> mesh, legend, title, colors, legend_par, vis_set; plug-in component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

# ----
# Use the button below to select
# date for DLI
select_hour_index_5 = Button()

# ----
# How many hours will the
# electric lighting on?
of_hours_with_electric_lighting = Slider(8, range=1..24)

point_in_time_illuminance_2 = Python3Script(result=python_3_script_21.result, hour_index=0, conversion_factor=python_3_script_6.conversion_factor)  # -> out, flatten(DLI), hourly_DLI; inputs result: String, hour_index: Int32
# ---------- point_in_time_illuminance_2: Python ----------
ghenv.Component.Message = """Kybele 0.1 Beta
DLI Hourly"""

import os, json, mmap, struct, System
from Grasshopper import DataTree
from Grasshopper.Kernel.Data import GH_Path
from Grasshopper.Kernel import GH_RuntimeMessageLevel as RML

_DLI = []
_hourly_DLI = DataTree[System.Object]()


def error(msg):
    ghenv.Component.AddRuntimeMessage(RML.Error, str(msg))

def parse_factor(val):
    default = 0.0185
    if isinstance(val, (int, float)): return float(val)
    if val is None: return default
    s = str(val).strip().lower()
    if s in ("electric","elec","electriconly","electric_light","electriclighting"): return 0.015
    if s in ("sunonly","sun","sunlight"): return 0.0205
    if s in ("skyonly","sky"): return 0.0135
    try: return float(s)
    except: return default

def meta_path_for(cache_path):
    base, _ = os.path.splitext(cache_path)
    return base + ".meta.json"

def read_meta(meta_path):
    with open(meta_path, "r") as f:
        m = json.load(f)
    S = int(m.get("sensors", 0))
    H = int(m.get("hours", 0))
    C = int(m.get("ncomp", 1))
    if S <= 0 or H <= 0:
        raise ValueError("Invalid dims in meta: sensors=%r hours=%r" % (S,H))
    if C != 1:
        raise ValueError("ncomp=%r not supported (expect 1 component illuminance)" % C)
    return S, H

def open_memmap_f32_le(path):
    f = open(path, "rb")
    mm = mmap.mmap(f.fileno(), 0, access=mmap.ACCESS_READ)
    return f, mm

def read_sensor_col(mm, sensors, hours, s):
    if not (0 <= s < sensors):
        raise IndexError("sensor_index %d out of range [0..%d]" % (s, sensors-1))
    out = []
    stride = sensors * 4
    offset = s * 4
    unpack_from = struct.unpack_from
    for h in range(hours):
        pos = h * stride + offset
        out.append(unpack_from("<f", mm, pos)[0])
    return out

def hourly_dli_from_lux(lux24, k):
    hourly = []
    total = 0.0
    for v in lux24:
        fv = float(v)
        ppfd = fv * k
        mol  = ppfd * 3600.0 / 1e6
        hourly.append(mol)
        total += mol
    return hourly, total


try:
    if not (isinstance(_result, str) and os.path.isfile(_result)):
        error("Provide _result as a valid path to the .f32 cache file.")
    elif _hour_index is None:
        error("Provide _hour_index (integer hour number).")
    else:
        cache_path = _result
        meta_path  = meta_path_for(cache_path)
        if not os.path.isfile(meta_path):
            error("Meta file not found beside cache: %s" % meta_path)
        else:
            S, H = read_meta(meta_path)
            k = parse_factor(_conversion_factor)
            h = max(0, int(_hour_index))

            f, mm = open_memmap_f32_le(cache_path)
            try:
                for sidx in range(S):
                    path = GH_Path(sidx)
                    lux_vals = read_sensor_col(mm, S, H, sidx)

                    L = len(lux_vals)
                    if L == 0:
                        _DLI.append(None)
                        continue


                    days_available = max(1, L // 24) if L >= 24 else 1
                    day_idx = min(h // 24, days_available - 1)
                    start = day_idx * 24
                    end   = min(start + 24, L)
                    lux24 = lux_vals[start:end]


                    hourly, total = hourly_dli_from_lux(lux24, k)


                    if len(hourly) < 24:
                        hourly += [None] * (24 - len(hourly))


                    for val in hourly:
                        _hourly_DLI.Add(val, path)
                    _DLI.append(total)

            finally:
                mm.close(); f.close()

except Exception as e:
    _DLI = []
    _hourly_DLI = DataTree[System.Object]()
    error("Unhandled error: %s" % e)
# ---------- end point_in_time_illuminance_2 ----------
multiplication = Multiplication(A=point_in_time_illuminance_2.DLI, B=of_hours_with_electric_lighting)
panel_49 = Panel(point_in_time_illuminance_2.DLI)
panel_50 = Panel(multiplication)
concatenate_3 = Concatenate(
    Fragment_A="""DLI from Electric light 
for running   """,
    Fragment_B=of_hours_with_electric_lighting,
    A=""" hours in a day
  mol/m2/day""")
colrange_6 = LBColorRange(index=Slider(2, range=0..26))  # -> colors; plug-in component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
legendpar_6 = LBLegendParameters(
    min=Slider(0, range=0..120000),
    max=Slider(30, range=0..30),
    colors=colrange_6,
    continuous_leg=Toggle(True),
    num_decimals=Toggle(True),
    text_height=Slider(0.193, range=0..1))  # -> leg_par; plug-in component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

# ----
# Preview me to see
# electric lighting DLI
# results over the grid!
# Unpreview to see other heat maps!
# 
# The ideal value varies by plant and growth stage.
heatmap_6 = LBSpatialHeatmap(values=multiplication, mesh=genpts.mesh, legend_par=legendpar_6, legend_title=concatenate_3)  # -> mesh, legend, title, colors, legend_par, vis_set; plug-in component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

# ----
# Turn it to True to open a window to
# see the DLI deficit per day
# and the # of hours to run electric lights
# to satisfy a DLI criteria!
lb_falsestarttoggle_18 = LBFalseStartToggle(True)

# ----
# PHOTOSYNTHETICALLY ACTIVE RADIATION (PAR) and
# PHOTOSYNTHETIC PHOTON FLUX DENSITY (PPFD) over the grid for a select day
# Preview me to see point in time PPFD
# results over the grid!
# Unpreview to see other heat maps!
# 
# The ideal value varies by plant and growth stage: Generally,
# Seedling/Clone: 100-300 umol/m2/s
# Vegetative: 200-600 umol/m2/s
# Bloom/Flowering: 500-1050 umol/m2/s
# ANNUAL PPFD for a sensor
sensor_2 = Slider(109, range=0..428)
python_3_script_23 = Python3Script(run=select_hour_index_4)  # -> hour_index; same code as python_3_script_9
python_3_script_24 = Python3Script(
    result=python_3_script_16.result,
    conversion_factor=python_3_script_8.conversion_factor,
    sensor_index=sensor_2,
    mark=Toggle(True),
    marker_size=Slider(0.52, range=0..10))  # -> out, PAR, sensor_pt, marker; inputs result: String, sensor_index: Int32, sensor_pts: tree, mark: Boolean, marker_size: Double
# ---------- python_3_script_24: Python ----------
ghenv.Component.Message = """Kybele 0.1 Beta
PAR Each Sensor"""

import os, mmap, struct, json
import Rhino.Geometry as rg
import scriptcontext as sc
import System
from Grasshopper.Kernel import GH_RuntimeMessageLevel as RML



def msg_error(t):   ghenv.Component.AddRuntimeMessage(RML.Error,   str(t))
def msg_warn(t):    ghenv.Component.AddRuntimeMessage(RML.Warning, str(t))


# Tree helpers
def is_tree(x):
    return hasattr(x, "BranchCount") and hasattr(x, "Branch") and hasattr(x, "Path")

def flat_items(T):
    L = []
    for bi in range(T.BranchCount):
        br = T.Branch(T.Path(bi))
        for it in br:
            L.append(it)
    return L



# Point and factor
def coerce_point(x):
    if isinstance(x, rg.Point3d): return x
    if hasattr(x, "Location"): return x.Location
    if isinstance(x, (list, tuple)) and len(x) == 3:
        try: return rg.Point3d(float(x[0]), float(x[1]), float(x[2]))
        except: return None
    if isinstance(x, System.Guid):
        obj = sc.doc.Objects.FindId(x)
        if obj and hasattr(obj, "Geometry") and isinstance(obj.Geometry, rg.Point):
            return obj.Geometry.Location
    return None



def parse_factor(val):
    default = 0.0185
    if isinstance(val, (int, float)): return float(val)
    if val is None: return default
    s = str(val).strip().lower()
    if s in ("electric","elec","electriconly","electric_light","electriclighting"): return 0.015
    if s in ("sunonly","sun","sunlight"): return 0.0205
    if s in ("skyonly","sky"): return 0.0135
    try: return float(s)
    except: return default



# cache reader
def read_column_from_cache(cache_path, sensor_index):
    """Reads one column from a Kybele .f32 cache."""
    meta_path = os.path.splitext(cache_path)[0] + ".meta.json"
    if not os.path.isfile(meta_path):
        raise FileNotFoundError("Missing metadata JSON: " + meta_path)

    meta = json.load(open(meta_path, "r"))
    sensors = int(meta.get("sensors", 0))
    hours   = int(meta.get("hours",   0))
    if sensors <= 0 or hours <= 0:
        raise ValueError("Invalid metadata dimensions")

    j = int(sensor_index or 0)
    if not (0 <= j < sensors):
        raise IndexError("sensor_index %d out of range (0..%d)" % (j, sensors-1))

    vals = []
    with open(cache_path, "rb") as f:
        mm = mmap.mmap(f.fileno(), 0, access=mmap.ACCESS_READ)
        stride = sensors * 4
        for h in range(hours):
            off = h * stride + j * 4
            vals.append(struct.unpack_from("<f", mm, off)[0])
        mm.close()
    return vals



# Initialize outputs
_PAR, _marker = [], []
_sensor_pt = None

try:
    # Determine cache path
    cp = _result if '_result' in globals() and _result else None
    if not cp:
        raise FileNotFoundError("Provide a valid _result (.f32).")

    cp = "".join(str(cp).splitlines()).strip()
    if not os.path.isfile(cp):
        raise FileNotFoundError("File not found: " + cp)

    idx = int(_sensor_index)
    factor = parse_factor(_conversion_factor)

    lux_vals = read_column_from_cache(cp, idx)
    _PAR = [v * factor for v in lux_vals]



except Exception as e:
    msg_error(e)
    _PAR = []


# Optional: sensor point and hemisphere marker
if _sensor_pts is not None:
    if is_tree(_sensor_pts):
        pts_flat = flat_items(_sensor_pts)
        if len(pts_flat) > _sensor_index:
            _sensor_pt = coerce_point(pts_flat[_sensor_index])
    elif isinstance(_sensor_pts, (list, tuple)) and len(_sensor_pts) > _sensor_index:
        _sensor_pt = coerce_point(_sensor_pts[_sensor_index])



if _mark and (_sensor_pt is not None) and (_marker_size is not None) and (_marker_size > 0):
    r = float(_marker_size) * 0.5
    sphere_brep = rg.Brep.CreateFromSphere(rg.Sphere(_sensor_pt, r))
    up = _marker_up if (_marker_up and _marker_up.IsValid and _marker_up.Length > 0) else rg.Vector3d.ZAxis
    up.Unitize()
    pl = rg.Plane(_sensor_pt, up)
    side = _marker_size * 10.0
    psrf = rg.PlaneSurface(pl, rg.Interval(-side, side), rg.Interval(-side, side))
    pbrep = psrf.ToBrep()
    tol = sc.doc.ModelAbsoluteTolerance if sc.doc else 1e-6
    parts = sphere_brep.Split(pbrep, tol)
    if parts and len(parts) >= 2:
        def score(b):
            c = b.GetBoundingBox(True).Center
            return rg.Vector3d(c - _sensor_pt) * up
        _marker = [max(parts, key=score)]
else:
    _marker = []
# ---------- end python_3_script_24 ----------
panel_51 = Panel(python_3_script_24.PAR)
point_in_time_illuminance_3 = Python3Script(result=python_3_script_16.result, hour_index=python_3_script_23, conversion_factor=python_3_script_8.conversion_factor)  # -> out, flatten(PAR); inputs result: String
# ---------- point_in_time_illuminance_3: Python ----------
ghenv.Component.Message = """Kybele 0.1 Beta
Hourly PAR"""


import os, json, mmap, struct
import Rhino.Geometry as rg

_PAR = []


def is_tree(x):
    return hasattr(x, "BranchCount") and hasattr(x, "Branch") and hasattr(x, "Path")

def to_float(x):
    try: return float(x)
    except:
        try: return float(str(x))
        except: return None

def parse_factor(val):
    default = 0.0185
    if isinstance(val, (int, float)): return float(val)
    if val is None: return default
    s = str(val).strip().lower()
    if s in ("electric","elec","electriconly","electric_light","electriclighting"): return 0.015
    if s in ("sunonly","sun","sunlight"): return 0.0205
    if s in ("skyonly","sky"): return 0.0135
    try: return float(s)
    except: return default

def lux_to_par(lux, factor):
    return lux * factor 

def meta_path_for(cache_path):
    base, _ = os.path.splitext(cache_path)
    return base + ".meta.json"

def read_meta(meta_path):
    with open(meta_path, "r") as f:
        m = json.load(f)
    S = int(m.get("sensors", 0))
    H = int(m.get("hours", 0))
    C = int(m.get("ncomp", 1))
    if S <= 0 or H <= 0:
        raise ValueError("Invalid dims in meta: sensors=%r hours=%r" % (S, H))
    if C != 1:
        raise ValueError("ncomp=%r not supported (expect illuminance single component)" % C)
    return S, H

def open_memmap_f32_le(path):
    f = open(path, "rb")
    mm = mmap.mmap(f.fileno(), 0, access=mmap.ACCESS_READ)
    return f, mm

def read_hour_row(mm, sensors, hours, h):
    if not (0 <= h < hours):
        raise IndexError("hour_index %d out of range [0..%d]" % (h, hours-1))

    start = h * sensors * 4
    end   = start + sensors * 4
    bs = mm[start:end]
    return list(struct.unpack("<%df" % sensors, bs))


_PAR = []
if isinstance(_result, str) and os.path.isfile(_result) and _hour_index is not None:
    try:
        cache_path = _result
        meta_path  = meta_path_for(cache_path)
        if not os.path.isfile(meta_path):
            raise IOError("Meta file not found: %s" % meta_path)

        S, H = read_meta(meta_path)


        f, mm = open_memmap_f32_le(cache_path)
        try:
            h = int(_hour_index)
            lux_row = read_hour_row(mm, S, H, h)
        finally:
            mm.close(); f.close()


        k = parse_factor(_conversion_factor)
        _PAR = [lux_to_par(v, k) for v in lux_row]

    except Exception as e:
        _PAR = []

else:
    _PAR = []
# ---------- end point_in_time_illuminance_3 ----------
panel_52 = Panel(point_in_time_illuminance_3.PAR)
sensor_3 = Slider(82, range=0..428)
custom_preview_4 = CustomPreview(Geometry=python_3_script_24.marker, Material=ColourSwatch(SwatchColor=RGBA(31, 31, 31, 92)))
grid_mode_2 = Slider(0, range=0..3)
concatenate_4 = Concatenate(Fragment_A="""PPFD from Daylight
Hour:""", Fragment_B=python_3_script_23, A="""(out of 8760 annual hours)
umol/m2/s""")
colrange_7 = LBColorRange(index=Slider(2, range=0..26))  # -> colors; plug-in component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
run_2 = Button()
legendpar_7 = LBLegendParameters(
    min=Slider(200, range=100..410),
    max=Slider(1000, range=0..1550),
    colors=colrange_7,
    continuous_leg=Toggle(True),
    num_decimals=Toggle(False),
    text_height=Slider(0.193, range=0..1))  # -> leg_par; plug-in component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
heatmap_7 = LBSpatialHeatmap(values=point_in_time_illuminance_3.PAR, mesh=genpts.mesh, legend_par=legendpar_7, legend_title=concatenate_4)  # -> mesh, legend, title, colors, legend_par, vis_set; plug-in component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

# ----
# Combined PPFD
python_3_script_25 = Python3Script(day=point_in_time_illuminance_3.PAR, elec=point_in_time_illuminance.PAR)  # -> out, flatten(combined); same code as python_3_script_22
panel_53 = Panel(python_3_script_25.combined)
concatenate_5 = Concatenate(
    Fragment_A="""PPFD (Daylight + Electric Light)
Hour: """,
    Fragment_B=python_3_script_23,
    A="""(out of 8760 annual hours)
umol/m2/s""")
colrange_8 = LBColorRange(index=Slider(2, range=0..26))  # -> colors; plug-in component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
legendpar_8 = LBLegendParameters(
    min=Slider(200, range=200..1050),
    max=Slider(1050, range=0..1050),
    colors=colrange_8,
    continuous_leg=Toggle(True),
    num_decimals=Toggle(False),
    text_height=Slider(0.193, range=0..1))  # -> leg_par; plug-in component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

concatenate_6 = Concatenate(FragmentA="Annual PPFD Heat Map for sensor # ", FragmentB=sensor_2)

python_3_script_26 = Python3Script(
    result_hourly=python_3_script_24.PAR,
    graph_title=concatenate_6,
    range1=Slider(100, range=0..1050),
    range2=Slider(200, range=0..1050),
    range3=Slider(600, range=0..1050),
    range4=Slider(1050, range=0..1050),
    name_range1="PPFD<100 umol/m2/s  ",
    name_range2="100-200 umol/m2/s  ",
    name_range3="200-600 umol/m2/s  ",
    name_range4="600-1050 umol/m2/s  ",
    name_range5="1050 umol/m2/s  <PPFD",
    run=run_2,
    grid_mode=grid_mode_2,
    grid_color=ColourSwatch(SwatchColor=RGB(207, 207, 207)))  # -> out, form; inputs result_hourly: list
# ---------- python_3_script_26: Python ----------
ghenv.Component.Message = 'Kybele 1.0.0'


import System.Windows.Forms as WinForms
import System.Drawing as Drawing
from System.Drawing import Point, Color
from System.Drawing.Drawing2D import SmoothingMode, PixelOffsetMode

# Inputs
if not _run:
    ghenv.Component.Message = """Kybele 0.1 Beta
Annual Plot"""
else:
    try:
        flat_data = [float(x) for x in _result_hourly if x is not None]
        if len(flat_data) != 8760:
            raise ValueError("Expected 8760 values.")
    except:
        WinForms.MessageBox.Show("PAR_8760 must contain exactly 8760 float values.", "Error")
        raise

    thresholds = [
        float(_range1) if _range1 is not None else 0,
        float(_range2) if _range2 is not None else 10,
        float(_range3) if _range3 is not None else 20,
        float(_range4) if _range4 is not None else 50
    ]

    # Ascending thresholds
    if not (thresholds[0] <= thresholds[1] <= thresholds[2] <= thresholds[3]):
        WinForms.MessageBox.Show("Ranges must be ascending (r1 ≤ r2 ≤ r3 ≤ r4).", "Invalid Ranges")
        raise ValueError("Non-ascending thresholds")

    # Color Setup
    def to_color(val):
        if val is None:
            return Color.LightGray
        if isinstance(val, Color):
            return val
        if isinstance(val, (tuple, list)) and len(val) == 3:
            return Color.FromArgb(int(val[0]), int(val[1]), int(val[2]))
        if isinstance(val, str):
            s = val.strip()
            if ',' in s or ' ' in s:
                s = s.replace('(', '').replace(')', '')
                parts = [p for p in s.replace(',', ' ').split(' ') if p]
                if len(parts) == 3:
                    r, g, b = [int(float(p)) for p in parts]
                    return Color.FromArgb(r, g, b)
            s = s.lstrip('#')
            if len(s) == 6:
                r = int(s[0:2], 16); g = int(s[2:4], 16); b = int(s[4:6], 16)
                return Color.FromArgb(r, g, b)
        raise ValueError("Unsupported color format: use '#rrggbb', (r,g,b), 'r,g,b', or a GH Color.")

    def hex_to_color(hex_str):
        s = hex_str.lstrip('#')
        return Drawing.Color.FromArgb(int(s[0:2], 16), int(s[2:4], 16), int(s[4:6], 16))

    # Grid / inset mode
    mode = int(round(float(_grid_mode))) if _grid_mode is not None else 0
    mode = max(0, min(3, mode))  # clamp to 0..3

    INSET = 0.5
    inset_px     = INSET if mode == 1 else 0.0
    grid_enabled = (mode in (2, 3))
    grid_color   = to_color("#636363") if mode == 3 else \
                   (to_color(_grid_color) if _grid_color else Drawing.Color.LightGray)

    # Bucket 0 color
    first_color = hex_to_color("#808080") if mode == 3 else hex_to_color("#ffffff")

    colors = [
        first_color,                 # imperceptible
        hex_to_color("#f9ebab"),     # perceptible
        hex_to_color("#f0be39"),     # disturbing
        hex_to_color("#e46828"),     # intolerable
        hex_to_color("#d70e17")      # excessive
    ]

    # Classification
    def classify(value):
        if value <= thresholds[0]: return 0
        elif value <= thresholds[1]: return 1
        elif value <= thresholds[2]: return 2
        elif value <= thresholds[3]: return 3
        else: return 4

    # Custom range names
    def _safe_name(val, default):
        return val if (val is not None and str(val).strip() != "") else default

    n1 = _safe_name(globals().get("_name_range1"), "Imperceptible")
    n2 = _safe_name(globals().get("_name_range2"), "Perceptible")
    n3 = _safe_name(globals().get("_name_range3"), "Disturbing")
    n4 = _safe_name(globals().get("_name_range4"), "Intolerable")
    n5 = _safe_name(globals().get("_name_range5"), "Excessive")
    range_names = [n1, n2, n3, n4, n5]


    # Heatmap Form Class
    class PARHeatmapForm(WinForms.Form):
        def __init__(self, data):
            super(PARHeatmapForm, self).__init__()
            self.Text = "Hourly Heat Map"
            self.StartPosition = WinForms.FormStartPosition.CenterScreen
            self.FormBorderStyle = WinForms.FormBorderStyle.Sizable
            self.DoubleBuffered = True
            self.BackColor = Drawing.Color.Gray if mode == 3 else Drawing.Color.White


            self.mode = mode
            self.inset_px = inset_px
            self.grid_enabled = grid_enabled
            self.grid_color = grid_color
            self.colors = colors
            self.range_names = range_names

            self.cell_w = 4
            self.cell_h = 20
            self.cols = 365
            self.rows = 24
            self.title_height = 25
            self.margin_top = 40
            self.margin_right = 130
            self.margin_left = 30
            self.margin_bottom = 200
            self.data = data

            self.ClientSize = Drawing.Size(
                self.margin_left + self.cols * self.cell_w + self.margin_right,
                self.rows * self.cell_h + self.margin_bottom + self.margin_top
            )

            self.Paint += self.on_paint
            self.MouseMove += self.on_mouse_move

            self.save_btn = WinForms.Button()
            self.save_btn.Text = "Export PNG"
            self.save_btn.Height = 30
            self.save_btn.Dock = WinForms.DockStyle.Bottom
            self.save_btn.Margin = WinForms.Padding(0, 10, 0, 10)
            self.save_btn.Click += self.on_export_click
            self.Controls.Add(self.save_btn)

            self.hover_label = WinForms.Label()
            self.hover_label.AutoSize = True
            self.hover_label.Location = Point(120, self.rows * self.cell_h + self.margin_top + 70)
            self.Controls.Add(self.hover_label)

        def on_paint(self, sender, e):
            g = e.Graphics
            g.SmoothingMode = SmoothingMode.Default
            g.PixelOffsetMode = PixelOffsetMode.HighSpeed

            # Shift title
            g.TranslateTransform(self.margin_left, self.margin_top + self.title_height)

            # GDI objects
            bucket_brushes = [Drawing.SolidBrush(c) for c in self.colors]
            grid_pen = Drawing.Pen(self.grid_color) if self.grid_enabled else None

            # Heatmap cells
            inset = float(self.inset_px)
            for i in range(self.rows):
                for j in range(self.cols):
                    idx = j * 24 + i
                    value = self.data[idx]
                    cat = classify(value)
                    brush = bucket_brushes[cat]

                    x = j * self.cell_w
                    y = i * self.cell_h

                    # symmetric inset
                    ix = x + inset
                    iy = y + inset
                    w  = self.cell_w  - 2 * inset
                    h  = self.cell_h  - 2 * inset

                    g.FillRectangle(brush, ix, iy, w, h)

                    if self.grid_enabled:
                        g.DrawRectangle(grid_pen, x, y, self.cell_w, self.cell_h)

            # Month dividers and labels
            month_starts = [0, 31, 59, 90, 120, 151, 181, 212, 243, 273, 304, 334]
            month_names = ["Jan", "Feb", "Mar", "Apr", "May", "Jun",
                           "Jul", "Aug", "Sep", "Oct", "Nov", "Dec"]

            if self.mode == 2:
                month_pen = Drawing.Pens.Gray
            elif self.mode == 3:
                month_pen = Drawing.Pens.Black
            else:
                month_pen = Drawing.Pens.LightGray

            for idx, day in enumerate(month_starts):
                x = day * self.cell_w
                g.DrawLine(month_pen, x, 0, x, self.rows * self.cell_h)
                g.DrawString(month_names[idx], self.Font, Drawing.Brushes.Black,
                             x + 50, self.rows * self.cell_h + 5)

            # Hour labels
            for i in [0, 6, 12, 18, 24]:
                if i <= 24:
                    label = str(i).zfill(2) + ":00"
                    y = i * self.cell_h - 20
                    g.DrawString(label, self.Font, Drawing.Brushes.Black,
                                 self.cols * self.cell_w + 5, y)


            # Legend (counts + labels)
            legend_counts = [0] * 5
            for val in self.data:
                legend_counts[classify(val)] += 1

            total = float(len(self.data))
            percentages = [int(round(c / total * 100)) for c in legend_counts]

            legend_labels = [
                "{}% {}".format(percentages[0], self.range_names[0]),
                "{}% {}".format(percentages[1], self.range_names[1]),
                "{}% {}".format(percentages[2], self.range_names[2]),
                "{}% {}".format(percentages[3], self.range_names[3]),
                "{}% {}".format(percentages[4], self.range_names[4])
            ]

            legend_spacing = 55
            legend_elements = []
            total_width = 0
            for i in range(5):
                label = legend_labels[i]
                label_size = g.MeasureString(label, self.Font)
                element_width = 20 + 5 + int(label_size.Width) + legend_spacing
                legend_elements.append((label, element_width))
                total_width += element_width

            legend_x = (self.cols * self.cell_w - total_width) // 2
            legend_y = self.rows * self.cell_h + self.margin_top + 45

            for i, (label, element_width) in enumerate(legend_elements):
                g.FillRectangle(bucket_brushes[i], legend_x, legend_y, 20, 15)
                g.DrawString(label, self.Font, Drawing.Brushes.Black, legend_x + 25, legend_y)
                legend_x += element_width

            # Reset transform
            g.ResetTransform()

            # Title
            title_font = Drawing.Font(self.Font.FontFamily, 10) # Drawing.FontStyle.Bold
            title = _graph_title or ""
            sz = g.MeasureString(title, title_font)
            g.DrawString(_graph_title, title_font, Drawing.Brushes.Black,
                        self.margin_left + (self.cols * self.cell_w - sz.Width) / 2.0, 10)

            # X-Axis Label
            g.DrawString("Day of Year", self.Font, Drawing.Brushes.Black,
                        self.margin_left + self.cols * self.cell_w // 2 - 30,
                        self.rows * self.cell_h + self.margin_top + 70)

            # Y-Axis Label
            g.TranslateTransform(self.cols * self.cell_w + 90,
                                 self.margin_top + self.rows * self.cell_h // 2 + 30)
            g.RotateTransform(-90)
            g.DrawString("Time of Day", self.Font, Drawing.Brushes.Black, -60, 30)
            g.ResetTransform()

            # GDI objects
            if grid_pen: grid_pen.Dispose()
            for b in bucket_brushes: b.Dispose()

        def on_mouse_move(self, sender, e):
            x, y = e.X, e.Y
            col = (x - self.margin_left) // self.cell_w
            row = (y - self.margin_top - self.title_height) // self.cell_h
            if 0 <= col < 365 and 0 <= row < 24:
                index = col * 24 + row
                val = round(self.data[index], 2)
                self.hover_label.Text = f"Day {col+1}, Hour {row}: {val}"

        def on_export_click(self, sender, args):
            dialog = WinForms.SaveFileDialog()
            dialog.Filter = "PNG Image|*.png"
            dialog.FileName = _graph_title
            if dialog.ShowDialog() == WinForms.DialogResult.OK:
                try:
                    bmp = Drawing.Bitmap(self.ClientSize.Width, self.ClientSize.Height)
                    g = Drawing.Graphics.FromImage(bmp)
                    g.Clear(self.BackColor)
                    paint_args = WinForms.PaintEventArgs(g, self.ClientRectangle)
                    self.on_paint(self, paint_args)
                    bmp.Save(dialog.FileName)
                    WinForms.MessageBox.Show("Saved successfully to:\n" + dialog.FileName)
                except Exception as e:
                    WinForms.MessageBox.Show("Export failed:\n" + str(e), "Error")

    # Show Form
    form = PARHeatmapForm(flat_data)
    form.Show()
# ---------- end python_3_script_26 ----------

# ----
# Preview me to see point in time PPFD
# results for the combined daylighting and electric lighting!
# Unpreview to see other heat maps!
# 
# The ideal value varies by plant and growth stage: Generally,
# Seedling/Clone: 100-300 umol/m2/s
# Vegetative: 200-600 umol/m2/s
# Bloom/Flowering: 500-1050 umol/m2/s
heatmap_8 = LBSpatialHeatmap(values=python_3_script_25.combined, mesh=genpts.mesh, legend_par=legendpar_8, legend_title=concatenate_5)  # -> mesh, legend, title, colors, legend_par, vis_set; plug-in component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

# ----
# DAILY LIGHT INTEGRAL (DLI) over the drid for a select day
# Preview me to see point in time DLI
# results over the grid!
# Unpreview to see other heat maps!
# 
# The ideal value varies by plant and growth stage: Generally,
# Vegetative Growth (Leafy Greens/Herbs): > 17 mol/m²/d
# Flowering Crops (Peppers/Tomatoes): 20-40 mol/m²/d
# ANNUAL PPFD for a sensor
number_slider_9 = Slider(0.57, range=0..10)
number_slider_10 = Slider(500, range=0..500)
python_3_script_27 = Python3Script(run=select_hour_index_5)  # -> hour_index; same code as python_3_script_9
point_in_time_illuminance_4 = Python3Script(result=python_3_script_16.result, hour_index=python_3_script_27, conversion_factor=python_3_script_8.conversion_factor)  # -> out, flatten(DLI), hourly_DLI; inputs result: String, hour_index: Int32
# ---------- point_in_time_illuminance_4: Python ----------
ghenv.Component.Message = """Kybele 0.1 Beta
DLI Hourly"""

import os, json, mmap, struct, System
from Grasshopper import DataTree
from Grasshopper.Kernel.Data import GH_Path
from Grasshopper.Kernel import GH_RuntimeMessageLevel as RML

_DLI = []
_hourly_DLI = DataTree[System.Object]()


def error(msg):
    ghenv.Component.AddRuntimeMessage(RML.Error, str(msg))

def parse_factor(val):
    default = 0.0185
    if isinstance(val, (int, float)): return float(val)
    if val is None: return default
    s = str(val).strip().lower()
    if s in ("electric","elec","electriconly","electric_light","electriclighting"): return 0.015
    if s in ("sunonly","sun","sunlight"): return 0.0205
    if s in ("skyonly","sky"): return 0.0135
    try: return float(s)
    except: return default

def meta_path_for(cache_path):
    base, _ = os.path.splitext(cache_path)
    return base + ".meta.json"

def read_meta(meta_path):
    with open(meta_path, "r") as f:
        m = json.load(f)
    S = int(m.get("sensors", 0))
    H = int(m.get("hours", 0))
    C = int(m.get("ncomp", 1))
    if S <= 0 or H <= 0:
        raise ValueError("Invalid dims in meta: sensors=%r hours=%r" % (S,H))
    if C != 1:
        raise ValueError("ncomp=%r not supported (expect 1 component illuminance)" % C)
    return S, H

def open_memmap_f32_le(path):
    f = open(path, "rb")
    mm = mmap.mmap(f.fileno(), 0, access=mmap.ACCESS_READ)
    return f, mm

def read_sensor_col(mm, sensors, hours, s):
    if not (0 <= s < sensors):
        raise IndexError("sensor_index %d out of range [0..%d]" % (s, sensors-1))
    out = []
    stride = sensors * 4
    offset = s * 4
    unpack_from = struct.unpack_from
    for h in range(hours):
        pos = h * stride + offset
        out.append(unpack_from("<f", mm, pos)[0])
    return out

def hourly_dli_from_lux(lux24, k):
    hourly = []
    total = 0.0
    for v in lux24:
        fv = float(v)
        ppfd = fv * k
        mol  = ppfd * 3600.0 / 1e6
        hourly.append(mol)
        total += mol
    return hourly, total



try:
    if not (isinstance(_result, str) and os.path.isfile(_result)):
        error("Provide _result as a valid path to the .f32 cache file.")
    elif _hour_index is None:
        error("Provide _hour_index (integer hour number).")
    else:
        cache_path = _result
        meta_path  = meta_path_for(cache_path)
        if not os.path.isfile(meta_path):
            error("Meta file not found beside cache: %s" % meta_path)
        else:
            S, H = read_meta(meta_path)
            k = parse_factor(_conversion_factor)
            h = max(0, int(_hour_index))

            f, mm = open_memmap_f32_le(cache_path)
            try:
                for sidx in range(S):
                    path = GH_Path(sidx)
                    lux_vals = read_sensor_col(mm, S, H, sidx)

                    L = len(lux_vals)
                    if L == 0:
                        _DLI.append(None)
                        continue


                    days_available = max(1, L // 24) if L >= 24 else 1
                    day_idx = min(h // 24, days_available - 1)
                    start = day_idx * 24
                    end   = min(start + 24, L)
                    lux24 = lux_vals[start:end]


                    hourly, total = hourly_dli_from_lux(lux24, k)


                    if len(hourly) < 24:
                        hourly += [None] * (24 - len(hourly))


                    for val in hourly:
                        _hourly_DLI.Add(val, path)
                    _DLI.append(total)

            finally:
                mm.close(); f.close()

except Exception as e:
    _DLI = []
    _hourly_DLI = DataTree[System.Object]()
    error("Unhandled error: %s" % e)
# ---------- end point_in_time_illuminance_4 ----------
expression = Expression(x=python_3_script_27, Expression="(x/24)+1")
panel_54 = Panel(point_in_time_illuminance_4.DLI)
python_3_script_28 = Python3Script(
    result=python_3_script_16.result,
    conversion_factor=python_3_script_8.conversion_factor,
    sensor_index=number_slider_10,
    mark=Toggle(True),
    marker_size=number_slider_9)  # -> out, DLI, sensor_pt, marker; inputs result: String, sensor_index: Int32, sensor_pts: tree, mark: Boolean, marker_size: Double
# ---------- python_3_script_28: Python ----------
ghenv.Component.Message = """Kybele 0.1 Beta
DLI Each Sensor"""

import os, json, mmap, struct
import Rhino.Geometry as rg
import scriptcontext as sc
import System
from Grasshopper.Kernel import GH_RuntimeMessageLevel as RML

_DLI, _marker = [], []
_sensor_pt = None


def is_tree(x):
    return hasattr(x, "BranchCount") and hasattr(x, "Branch") and hasattr(x, "Path")

def flat_items(T):
    L = []
    for bi in range(T.BranchCount):
        br = T.Branch(T.Path(bi))
        for it in br: L.append(it)
    return L

def coerce_point(x):
    if isinstance(x, rg.Point3d): return x
    if hasattr(x, "Location"):    return x.Location
    if isinstance(x, (list, tuple)) and len(x) == 3:
        try: return rg.Point3d(float(x[0]), float(x[1]), float(x[2]))
        except: return None
    if isinstance(x, System.Guid):
        obj = sc.doc.Objects.FindId(x)
        if obj and hasattr(obj, "Geometry") and isinstance(obj.Geometry, rg.Point):
            return obj.Geometry.Location
    return None

def parse_factor(val):
    default = 0.0185
    if isinstance(val, (int, float)): return float(val)
    if val is None: return default
    s = str(val).strip().lower()
    if s in ("electric","elec","electriconly","electric_light","electriclighting"): return 0.015
    if s in ("sunonly","sun","sunlight"): return 0.0205
    if s in ("skyonly","sky"): return 0.0135
    try: return float(s)
    except: return default

def dli_from_par_day(par24):
    """par24: list of 24 PPFD values (µmol·s⁻¹·m⁻²) → DLI (mol·m⁻²·day⁻¹)"""
    s = 0.0
    for v in par24:
        if v is not None:
            s += v * 3600.0 / 1e6
    return s


def meta_path_for(cache_path):
    base, _ = os.path.splitext(cache_path)
    return base + ".meta.json"

def read_meta(meta_path):
    with open(meta_path, "r") as f:
        m = json.load(f)
    S = int(m.get("sensors", 0))
    H = int(m.get("hours", 0))
    C = int(m.get("ncomp", 1))
    if S <= 0 or H <= 0:
        raise ValueError("Invalid dims in meta: sensors=%r hours=%r" % (S, H))
    if C != 1:
        raise ValueError("ncomp=%r not supported (expect 1 component illuminance)" % C)
    return S, H

def open_memmap_f32_le(path):
    f = open(path, "rb")
    mm = mmap.mmap(f.fileno(), 0, access=mmap.ACCESS_READ)
    return f, mm

def read_sensor_col(mm, sensors, hours, s):
    if not (0 <= s < sensors):
        raise IndexError("sensor_index %d out of range [0..%d]" % (s, sensors-1))
    out = []
    stride = sensors * 4  
    offset = s * 4
    unpack_from = struct.unpack_from
    for h in range(hours):
        pos = h * stride + offset
        out.append(unpack_from("<f", mm, pos)[0])
    return out


_DLI, _marker, _sensor_pt = [], [], None

def error(msg):
    ghenv.Component.AddRuntimeMessage(RML.Error, str(msg))

try:
    if not (isinstance(_result, str) and os.path.isfile(_result)):
        error("Provide _result as a valid path to the .f32 cache file.")
    elif _sensor_index is None:
        error("Provide _sensor_index (0-based).")
    else:
        cache_path = _result
        meta_path  = meta_path_for(cache_path)
        if not os.path.isfile(meta_path):
            error("Meta file not found beside cache: %s" % meta_path)
        else:
            S, H = read_meta(meta_path)


            f, mm = open_memmap_f32_le(cache_path)
            try:
                sidx = int(_sensor_index)
                lux_vals = read_sensor_col(mm, S, H, sidx)
            finally:
                mm.close(); f.close()


            k = parse_factor(_conversion_factor)
            par_vals = [v * k for v in lux_vals]


            days = min(365, len(par_vals) // 24)
            _DLI = []
            for d in range(days):
                day_slice = par_vals[d*24:(d+1)*24]
                _DLI.append(dli_from_par_day(day_slice))


            if _sensor_pts is not None:
                if is_tree(_sensor_pts):
                    pts_flat = flat_items(_sensor_pts)
                    if len(pts_flat) > sidx:
                        _sensor_pt = coerce_point(pts_flat[sidx])
                elif isinstance(_sensor_pts, (list, tuple)) and len(_sensor_pts) > sidx:
                    _sensor_pt = coerce_point(_sensor_pts[sidx])


            if _mark and (_sensor_pt is not None) and (_marker_size is not None) and (_marker_size > 0):
                r = float(_marker_size) * 0.5
                sphere_brep = rg.Brep.CreateFromSphere(rg.Sphere(_sensor_pt, r))
                up = _marker_up if (_marker_up and _marker_up.IsValid and _marker_up.Length > 0) else rg.Vector3d.ZAxis
                up.Unitize()
                pl = rg.Plane(_sensor_pt, up)
                side = _marker_size * 10.0
                psrf = rg.PlaneSurface(pl, rg.Interval(-side, side), rg.Interval(-side, side))
                pbrep = psrf.ToBrep()
                tol = sc.doc.ModelAbsoluteTolerance if sc.doc else 1e-6
                parts = sphere_brep.Split(pbrep, tol)
                if parts and len(parts) >= 2:
                    def score(b):
                        c = b.GetBoundingBox(True).Center
                        return rg.Vector3d(c - _sensor_pt) * up
                    _marker = [max(parts, key=score)]

except Exception as e:
    _DLI, _marker, _sensor_pt = [], [], None
    error("Unhandled error: %s" % e)
# ---------- end python_3_script_28 ----------
custom_preview_5 = CustomPreview(Geometry=python_3_script_28.marker, Material=ColourSwatch(SwatchColor=RGBA(31, 31, 31, 92)))
grid_mode_3 = Slider(2, range=0..3)
concatenate_7 = Concatenate(Fragment_A="""DLI from Daylight

Day: """, Fragment_B=expression, A=" (out of 365) mol/m2/day")
colrange_9 = LBColorRange(index=Slider(2, range=0..26))  # -> colors; plug-in component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
run_3 = Button()
legendpar_9 = LBLegendParameters(
    min=Slider(0, range=0..120000),
    max=Slider(30, range=0..100),
    colors=colrange_9,
    continuous_leg=Toggle(True),
    num_decimals=Toggle(False),
    text_height=Slider(0.193, range=0..1))  # -> leg_par; plug-in component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
heatmap_9 = LBSpatialHeatmap(values=point_in_time_illuminance_4.DLI, mesh=genpts.mesh, legend_par=legendpar_9, legend_title=concatenate_7)  # -> out, mesh, legend, title, colors, legend_par, vis_set; plug-in component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

# ----
# Combined DLI
python_3_script_29 = Python3Script(day=point_in_time_illuminance_4.DLI, elec=multiplication)  # -> out, flatten(combined); same code as python_3_script_22
panel_55 = Panel(python_3_script_29.combined)
concatenate_8 = Concatenate(
    Fragment_A="""DLI from Daylight + Electric Light
Day: """,
    Fragment_B=expression,
    B="Electric lighting ",
    A=of_hours_with_electric_lighting,
    C=""" hours in a day
mol/m2/day""")
colrange_10 = LBColorRange(index=Slider(2, range=0..26))  # -> colors; plug-in component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
legendpar_10 = LBLegendParameters(
    min=Slider(6, range=0..100),
    max=Slider(16, range=0..100),
    colors=colrange_10,
    continuous_leg=Toggle(True),
    num_decimals=Toggle(False),
    text_height=Slider(0.193, range=0..1))  # -> leg_par; plug-in component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

concatenate_9 = Concatenate(FragmentA="Annual DLI Heat Mapfor Sensor # ", FragmentB=number_slider_10)

python_3_script_30 = Python3Script(
    result_daily=python_3_script_28.DLI,
    graph_title=concatenate_9,
    range1=Slider(10, range=0..100),
    range2=Slider(20, range=0..100),
    range3=Slider(30, range=0..100),
    range4=Slider(40, range=0..100),
    name_range1="DLI<10 mol/m2/day",
    name_range2="10-20 mol/m2/day",
    name_range3="20-30 mol/m2/day",
    name_range4="30-40 mol/m2/day",
    name_range5="40 mol/m2/s <DLI",
    run=run_3,
    grid_mode=grid_mode_3,
    grid_color=ColourSwatch(SwatchColor=RGB(207, 207, 207)))  # -> out, form; inputs result_daily: list
# ---------- python_3_script_30: Python ----------
import System.Windows.Forms as WinForms
import System.Drawing as Drawing
from System.Drawing import Point, Color
from System.Drawing.Drawing2D import SmoothingMode, PixelOffsetMode

# Color Setup
def to_color(val):
    if val is None:
        return Color.LightGray
    if isinstance(val, Color):
        return val
    if isinstance(val, (tuple, list)) and len(val) == 3:
        return Color.FromArgb(int(val[0]), int(val[1]), int(val[2]))
    if isinstance(val, str):
        s = val.strip()
        if ',' in s or ' ' in s:
            s = s.replace('(', '').replace(')', '')
            parts = [p for p in s.replace(',', ' ').split(' ') if p]
            if len(parts) == 3:
                r, g, b = [int(float(p)) for p in parts]
                return Color.FromArgb(r, g, b)
        s = s.lstrip('#')
        if len(s) == 6:
            r = int(s[0:2], 16); g = int(s[2:4], 16); b = int(s[4:6], 16)
            return Color.FromArgb(r, g, b)
    raise ValueError("Unsupported color: use '#rrggbb', (r,g,b), 'r,g,b', or a GH Color.")

def hex_to_color(hex_str):
    s = hex_str.lstrip('#')
    return Drawing.Color.FromArgb(int(s[0:2], 16), int(s[2:4], 16), int(s[4:6], 16))

def as_float_or_default(x, default):
    try:
        return float(x)
    except (TypeError, ValueError):
        return default

def _safe_name(val, default):
    return val if (val is not None and str(val).strip() != "") else default

# Main
if not _run:
    ghenv.Component.Message = """Kybele 0.1 Beta
Daily Plot"""
else:
    # Data
    try:
        flat_data = [float(x) for x in _result_daily if x is not None]
        if len(flat_data) != 365:
            raise ValueError("Expected 365 values.")
    except:
        WinForms.MessageBox.Show("DLI_365 must contain exactly 365 float values.", "Error")
        raise

    # Thresholds
    r1 = as_float_or_default(globals().get("_range1"), 0.0)
    r2 = as_float_or_default(globals().get("_range2", globals().get("_range-2")), 10.0)
    r3 = as_float_or_default(globals().get("_range3"), 20.0)
    r4 = as_float_or_default(globals().get("_range4"), 50.0)
    thresholds = [r1, r2, r3, r4]

    # Ascending guard
    if not (thresholds[0] <= thresholds[1] <= thresholds[2] <= thresholds[3]):
        WinForms.MessageBox.Show("Ranges must be ascending (r1 ≤ r2 ≤ r3 ≤ r4).", "Invalid Ranges")
        raise ValueError("Non-ascending thresholds")

    # Grid / inset mode
    mode = int(round(float(globals().get("_grid_mode", 0)))) if globals().get("_grid_mode") is not None else 0
    mode = max(0, min(3, mode))

    INSET = 0.5
    inset_px     = INSET if mode == 1 else 0.0
    grid_enabled = (mode in (2, 3))

    # Grid color
    _grid_col_in = globals().get("_grid_color", globals().get("grid_color"))
    grid_color = to_color("#636363") if mode == 3 else (to_color(_grid_col_in) if _grid_col_in else Drawing.Color.LightGray)

    # Colors
    first_color = hex_to_color("#808080") if mode == 3 else hex_to_color("#ffffff")
    colors = [
        first_color,                 # bucket 0
        hex_to_color("#f9ebab"),
        hex_to_color("#f0be39"),
        hex_to_color("#e46828"),
        hex_to_color("#d70e17")
    ]

    # Names
    n1 = _safe_name(globals().get("_name_range1"), "Imperceptible")
    n2 = _safe_name(globals().get("_name_range2"), "Perceptible")
    n3 = _safe_name(globals().get("_name_range3"), "Disturbing")
    n4 = _safe_name(globals().get("_name_range4"), "Intolerable")
    n5 = _safe_name(globals().get("_name_range5"), "Excessive")
    range_names = [n1, n2, n3, n4, n5]

    # Classification
    def classify(v):
        if v <= thresholds[0]: return 0
        elif v <= thresholds[1]: return 1
        elif v <= thresholds[2]: return 2
        elif v <= thresholds[3]: return 3
        else: return 4

    # UI Form
    class DLIHeatmapForm(WinForms.Form):
        def __init__(self, data):
            super(DLIHeatmapForm, self).__init__()
            self.Text = "Daily Plot Heat Map"
            self.StartPosition = WinForms.FormStartPosition.CenterScreen
            self.FormBorderStyle = WinForms.FormBorderStyle.Sizable
            self.DoubleBuffered = True
            self.BackColor = Drawing.Color.Gray if mode == 3 else Drawing.Color.White


            self.mode = mode
            self.inset_px = inset_px
            self.grid_enabled = grid_enabled
            self.grid_color = grid_color
            self.colors = colors
            self.range_names = range_names

            # Geometry
            self.cell_w = 4
            self.cell_h = 20 * 12   # = 480
            self.cols = 365
            self.rows = 1
            self.title_height = 25
            self.margin_top = 40
            self.margin_right = 60
            self.margin_bottom = 200
            self.margin_left = 30

            self.data = data

            self.ClientSize = Drawing.Size(
                self.margin_left + self.cols * self.cell_w + self.margin_right,
                self.rows * self.cell_h + self.margin_bottom + self.margin_top
            )

            self.Paint += self.on_paint
            self.MouseMove += self.on_mouse_move

            self.save_btn = WinForms.Button()
            self.save_btn.Text = "Export PNG"
            self.save_btn.Height = 30
            self.save_btn.Dock = WinForms.DockStyle.Bottom
            self.save_btn.Margin = WinForms.Padding(0, 10, 0, 10)
            self.save_btn.Click += self.on_export_click
            self.Controls.Add(self.save_btn)

            self.hover_label = WinForms.Label()
            self.hover_label.AutoSize = True
            self.hover_label.Location = Point(120, self.rows * self.cell_h + self.margin_top + 70)
            self.Controls.Add(self.hover_label)

        def on_paint(self, sender, e):
            g = e.Graphics
            g.SmoothingMode = SmoothingMode.Default
            g.PixelOffsetMode = PixelOffsetMode.HighSpeed

            # Shift title
            g.TranslateTransform(self.margin_left, self.margin_top + self.title_height)

            # GDI objects
            bucket_brushes = [Drawing.SolidBrush(c) for c in self.colors]
            grid_pen = Drawing.Pen(self.grid_color) if self.grid_enabled else None

            # Draw cells
            inset = float(self.inset_px)
            i = 0
            for j in range(self.cols):
                idx = j
                value = self.data[idx]
                cat = classify(value)
                brush = bucket_brushes[cat]

                x = j * self.cell_w
                y = i * self.cell_h

                # symmetric inset
                ix = x + inset
                iy = y + inset
                w  = self.cell_w  - 2 * inset
                h  = self.cell_h  - 2 * inset

                g.FillRectangle(brush, ix, iy, w, h)

                if self.grid_enabled:
                    g.DrawRectangle(grid_pen, x, y, self.cell_w, self.cell_h)

            # Month dividers + labels
            month_starts = [0, 31, 59, 90, 120, 151, 181, 212, 243, 273, 304, 334]
            month_names = ["Jan", "Feb", "Mar", "Apr", "May", "Jun",
                           "Jul", "Aug", "Sep", "Oct", "Nov", "Dec"]

            if self.mode == 2:
                month_pen = Drawing.Pen(Drawing.Color.DimGray, 4.0)
            elif self.mode == 3:
                month_pen = Drawing.Pen(Drawing.Color.Gray, 4.0)
            elif self.mode == 1:
                month_pen = Drawing.Pen(Drawing.Color.White, 5.0)
            else:
                month_pen = Drawing.Pen(Drawing.Color.Black, 1.0)

            for idx, day in enumerate(month_starts):
                x = day * self.cell_w
                g.DrawLine(month_pen, x, 0, x, self.rows * self.cell_h)
                g.DrawString(month_names[idx], self.Font, Drawing.Brushes.Black,
                             x + 50, self.rows * self.cell_h + 5)

            # Legend
            legend_counts = [0] * 5
            for val in self.data:
                legend_counts[classify(val)] += 1

            total = float(len(self.data))
            percentages = [int(round(c / total * 100)) for c in legend_counts]

            legend_labels = [
                "{}% {}".format(percentages[0], self.range_names[0]),
                "{}% {}".format(percentages[1], self.range_names[1]),
                "{}% {}".format(percentages[2], self.range_names[2]),
                "{}% {}".format(percentages[3], self.range_names[3]),
                "{}% {}".format(percentages[4], self.range_names[4])
            ]

            legend_spacing = 55
            legend_elements = []
            total_width = 0
            for i5 in range(5):
                label = legend_labels[i5]
                label_size = g.MeasureString(label, self.Font)
                element_width = 20 + 5 + int(label_size.Width) + legend_spacing
                legend_elements.append((label, element_width))
                total_width += element_width

            legend_x = (self.cols * self.cell_w - total_width) // 2
            legend_y = self.rows * self.cell_h + self.margin_top + 45

            for i5, (label, element_width) in enumerate(legend_elements):
                g.FillRectangle(bucket_brushes[i5], legend_x, legend_y, 20, 15)
                g.DrawString(label, self.Font, Drawing.Brushes.Black, legend_x + 25, legend_y)
                legend_x += element_width

            # Reset transform
            g.ResetTransform()

            # Title
            title_font = Drawing.Font(self.Font.FontFamily, 11, Drawing.FontStyle.Regular)
            title = _graph_title or ""
            sz = g.MeasureString(title, title_font)
            g.DrawString(title, title_font, Drawing.Brushes.Black,
                         self.margin_left + (self.cols * self.cell_w - sz.Width) / 2.0, 10)

            # X-Axis Label
            g.DrawString("Day of Year", self.Font, Drawing.Brushes.Black,
                         self.margin_left + self.cols * self.cell_w // 2 - 30,
                         self.rows * self.cell_h + self.margin_top + 70)

            # Y-Axis Label
            g.TranslateTransform(self.margin_left + self.cols * self.cell_w + 90,
                                 self.margin_top + self.rows * self.cell_h // 2 + 30)
            g.RotateTransform(-90)
            g.DrawString("24 Hours", self.Font, Drawing.Brushes.Black, -35, -80)
            g.ResetTransform()

            # Dispose
            if grid_pen: grid_pen.Dispose()
            month_pen.Dispose()
            for b in bucket_brushes: b.Dispose()

        def on_mouse_move(self, sender, e):
            x, y = e.X, e.Y

            col = (x - self.margin_left) // self.cell_w
            row = (y - (self.margin_top + self.title_height)) // self.cell_h
            if 0 <= col < 365 and 0 <= row < 1:
                index = int(col)
                val = round(self.data[index], 2)
                self.hover_label.Text = f"Day {index+1}: {val}"

        def on_export_click(self, sender, args):
            dialog = WinForms.SaveFileDialog()
            dialog.Filter = "PNG Image|*.png"
            dialog.FileName = _graph_title
            if dialog.ShowDialog() == WinForms.DialogResult.OK:
                try:
                    bmp = Drawing.Bitmap(self.ClientSize.Width, self.ClientSize.Height)
                    g = Drawing.Graphics.FromImage(bmp)
                    g.Clear(self.BackColor)
                    paint_args = WinForms.PaintEventArgs(g, self.ClientRectangle)
                    self.on_paint(self, paint_args)
                    bmp.Save(dialog.FileName)
                    WinForms.MessageBox.Show("Saved successfully to:\n" + dialog.FileName)
                except Exception as e:
                    WinForms.MessageBox.Show("Export failed:\n" + str(e), "Error")

    # Show form
    form = DLIHeatmapForm(flat_data)
    form.Show()
# ---------- end python_3_script_30 ----------
# ----
# Preview me to see
# daylight and electric lighting DLI
# results over the grid!
# Unpreview to see other heat maps!
# 
# The ideal value varies by plant and growth stage.
heatmap_10 = LBSpatialHeatmap(values=python_3_script_29.combined, mesh=genpts.mesh, legend_par=legendpar_10, legend_title=concatenate_8)  # -> mesh, legend, title, colors, legend_par, vis_set; plug-in component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

# ----
# Kybele Supplemental Lighting Calculation
number_slider_11 = Slider(50, range=0..100)
number_of_luminaires = Data(list_length)
area_2 = Data(area.Area)
python_3_script_31 = Python3Script(
    Title="Supplemental Lighting Calculations for Leafy Green",
    DLI=python_3_script_28.DLI,
    required_DLI=Slider(22, range=0..900),
    PAR_electric=point_in_time_illuminance.PAR,
    sensor_index=Slider(51, range=0..1000),
    area=area_2,
    number_of_luminire=number_of_luminaires,
    watt_per_luminaire=number_slider_11,
    electricity_cost=Slider(0.1, range=0..0.1),
    run=lb_falsestarttoggle_18)  # -> out, DLI_deficit, hours_needed, total_needed_hr, lighting_loads, energy_usage_annual, annual_cost; inputs DLI: list, PAR_electric: list
# ---------- python_3_script_31: Python ----------
ghenv.Component.Message = """Kybele 0.1 Beta
Required Lighting Hour"""

import System, math
from System.IO import File
import System.Drawing.Drawing2D as D2
from System.Drawing import (Bitmap, Color, Font, FontStyle, Graphics, Pen, Point, Rectangle, SolidBrush, PointF, StringFormat, StringAlignment)
import System.Windows.Forms as WinForms
from System.Windows.Forms import (
    Form, Panel, Label, Button, DataGridView, DataGridViewAutoSizeColumnsMode,
    DataGridViewSelectionMode, DockStyle, SaveFileDialog, AutoScaleMode, FlatStyle
)
import scriptcontext as sc



# DPI awareness — must run before any Form is created
def _set_dpi_aware():
    try:
        import ctypes
        ctypes.windll.shcore.SetProcessDpiAwareness(1)
    except Exception:
        try:
            import ctypes
            ctypes.windll.user32.SetProcessDPIAware()
        except Exception:
            pass

_set_dpi_aware()





# Calculations
def compute_dli_deficit(calculated_DLI, required_DLI):
    result = []
    req = float(required_DLI if required_DLI is not None else 0.0)
    for v in (calculated_DLI or []):
        try: f = float(v)
        except: f = 0.0
        result.append(max(0.0, req - f))
    return result



def compute_hours_needed(dli_deficit_list, par_electric_hourly):
    peh = float(par_electric_hourly if par_electric_hourly is not None else 0.0)
    if peh <= 0:
        return [0.0 for _ in (dli_deficit_list or [])]
    hours = []
    for d in (dli_deficit_list or []):
        try: deficit = float(d)
        except: deficit = 0.0
        hours.append(0.0 if deficit <= 0 else (deficit / peh))
    return hours


# inputs
Title          = _Title if isinstance(_Title, str) and _Title.strip() else "Supplemental Lighting Calculations for Plant"
calculated_DLI = list(_DLI) if isinstance(_DLI, (list, tuple)) else []
required_DLI   = float(_required_DLI if _required_DLI is not None else 0.0)
sensor_index   = int(_sensor_index if _sensor_index is not None else 0)


par_list = list(_PAR_electric) if isinstance(_PAR_electric, (list, tuple)) else []
if 0 <= sensor_index < len(par_list):
    try:    _par_val = float(par_list[sensor_index])
    except: _par_val = 0.0
else:
    _par_val = 0.0

_par_missing       = (_par_val <= 0)
par_electric_hourly = _par_val   # stays 0.0 when missing; hours will be 0



# derived outputs
_DLI_deficit  = compute_dli_deficit(calculated_DLI, required_DLI)
_hours_needed = compute_hours_needed(_DLI_deficit, par_electric_hourly)


MONTH_NAMES = ["JAN","FEB","MAR","APR","MAY","JUN","JUL","AUG","SEP","OCT","NOV","DEC"]
MONTH_DAYS  = [31,   28,    31,   30,    31,   30,    31,   31,    30,   31,   30,   31]


def make_day_label(i):
    d = i + 1
    for m, days in enumerate(MONTH_DAYS):
        if d > days: d -= days
        else: return "{} {:02d}".format(MONTH_NAMES[m], d)
    return "DEC 31"


def _nice_ticks(max_val):
    max_val = max(1e-9, max_val)
    if   max_val <= 1:  step = 0.2
    elif max_val <= 5:  step = 1
    elif max_val <= 10: step = 2
    elif max_val <= 20: step = 5
    else:               step = 10
    top_val = (int(max_val / step) + 1) * step
    ticks = [i * step for i in range(int(top_val/step) + 1)]
    return float(top_val), ticks


def _series_to_poly_points(series, plot, top_val):
    pts = []
    if not series or len(series) < 2 or top_val <= 0 or plot.Width <= 0 or plot.Height <= 0:
        return pts
    n = len(series)
    for i in range(n):
        x = plot.Left + int((float(i) / (n - 1)) * plot.Width)
        v = max(0.0, min(series[i], top_val))
        y = plot.Bottom - int((v / top_val) * plot.Height)
        pts.append(PointF(float(x), float(y)))
    pts.append(PointF(float(plot.Right), float(plot.Bottom)))
    pts.append(PointF(float(plot.Left),  float(plot.Bottom)))
    return pts


def chart_bitmap(series, title_text, y_label, width, height,
                 kind="line", fixed_top_val=None, tick_count=None,
                 title_font="Segoe UI", title_size=12, title_bold=True,
                 title_color=None, title_align="left",
                 pad_top=None, title_padding_top=12,
                 hline_at=None):
    W = max(400, int(width))
    H = max(220, int(height))
    bmp = Bitmap(W, H)
    g = Graphics.FromImage(bmp)
    g.Clear(Color.White)

    if pad_top is None: pad_top = 70
    pad_left, pad_right, pad_bottom = 70, 30, 45
    plot = Rectangle(pad_left, pad_top, W - pad_left - pad_right, H - pad_top - pad_bottom)

    if title_color is None: title_color = Color.Black
    tfont  = Font(title_font, title_size, FontStyle.Bold if title_bold else FontStyle.Regular)
    tbrush = SolidBrush(title_color)
    if title_text:
        fmt = StringFormat()
        if   title_align == "center": fmt.Alignment = StringAlignment.Center
        elif title_align == "right":  fmt.Alignment = StringAlignment.Far
        else:                         fmt.Alignment = StringAlignment.Near
        fmt.LineAlignment = StringAlignment.Near
        g.DrawString(title_text, tfont, tbrush,
                     Rectangle(pad_left, title_padding_top,
                               W - pad_left - 10, pad_top - title_padding_top), fmt)

    pen_axes  = Pen(Color.Black, 1.2)
    pen_grid  = Pen(Color.LightGray, 1.0)
    pen_month = Pen(Color.Gainsboro, 1.0)
    pen_line  = Pen(Color.Black, 1.4)
    bar_fill  = SolidBrush(Color.FromArgb(110, 120, 120, 120))
    bar_edge  = Pen(Color.Black, 0.6)

    max_val_series = max(series) if series else 1.0
    if fixed_top_val is not None and fixed_top_val > 0:
        top_val = float(fixed_top_val)
        if tick_count is None:
            _t, ticks = _nice_ticks(top_val)
            if abs(_t - top_val) > 1e-9:
                step  = top_val / 8.0
                ticks = [round(i * step, 6) for i in range(9)]
        else:
            step  = top_val / float(tick_count)
            ticks = [i * step for i in range(tick_count + 1)]
    else:
        if tick_count is None:
            top_val, ticks = _nice_ticks(max_val_series)
        else:
            max_val_series = max(1e-9, max_val_series)
            step    = max_val_series / float(tick_count)
            top_val = step * tick_count
            ticks   = [i * step for i in range(tick_count + 1)]

    g.DrawLine(pen_axes, plot.Left, plot.Bottom, plot.Right, plot.Bottom)
    g.DrawLine(pen_axes, plot.Left, plot.Top,    plot.Left,  plot.Bottom)

    f_axis = Font("Segoe UI", 7)
    for y in ticks:
        yy = plot.Bottom - int((y / top_val) * plot.Height) if top_val > 0 else plot.Bottom
        g.DrawLine(pen_grid, plot.Left, yy, plot.Right, yy)
        g.DrawString("{:.1f}".format(y), f_axis, System.Drawing.Brushes.Black, 5, yy - 8)

    if series and plot.Width > 0 and top_val > 0:
        n = len(series)
        if kind == "line":
            if n > 1:
                poly = _series_to_poly_points(series, plot, top_val)
                if poly and len(poly) >= 3:
                    g.FillPolygon(SolidBrush(Color.FromArgb(90, 120, 120, 120)), poly)
            if n > 1:
                for i in range(n - 1):
                    x0 = plot.Left + int((float(i)   / (n - 1)) * plot.Width)
                    x1 = plot.Left + int((float(i+1) / (n - 1)) * plot.Width)
                    v0 = max(0.0, min(series[i],   top_val))
                    v1 = max(0.0, min(series[i+1], top_val))
                    y0 = plot.Bottom - int((v0 / top_val) * plot.Height)
                    y1 = plot.Bottom - int((v1 / top_val) * plot.Height)
                    g.DrawLine(pen_line, x0, y0, x1, y1)
        else:
            bw  = max(1, int(float(plot.Width) / n))
            gap = max(0, int(bw * 0.10))
            bw_i = max(1, bw - gap)
            for i, v in enumerate(series):
                v   = max(0.0, min(v, top_val))
                x_c = plot.Left + int((float(i) / (n - 1)) * plot.Width) if n > 1 else plot.Left
                x   = int(x_c - bw_i / 2)
                y   = plot.Bottom - int((v / top_val) * plot.Height)
                rect = Rectangle(x, y, bw_i, max(0, plot.Bottom - y))
                if rect.Width > 0 and rect.Height > 0:
                    g.FillRectangle(bar_fill, rect)
                    g.DrawRectangle(bar_edge, rect)

    # optional horizontal reference line
    if hline_at is not None and top_val > 0 and hline_at <= top_val:
        hy = plot.Bottom - int((float(hline_at) / top_val) * plot.Height)
        pen_hline = Pen(Color.FromArgb(160, 160, 160), 1.2)
        pen_hline.DashStyle = D2.DashStyle.Dash
        g.DrawLine(pen_hline, plot.Left, hy, plot.Right, hy)
        # label
        g.DrawString("{:.0f}h".format(hline_at),
                     Font("Segoe UI", 7), SolidBrush(Color.Gray),
                     plot.Right + 2, hy - 7)
        pen_hline.Dispose()

    total_days = sum(MONTH_DAYS); start = 0
    for md, name in zip(MONTH_DAYS, MONTH_NAMES):
        mx = plot.Left + int((float(start) / total_days) * plot.Width)
        g.DrawLine(pen_month, mx, plot.Top, mx, plot.Bottom)
        cx = plot.Left + int((float(start + md / 2.0) / total_days) * plot.Width)
        g.DrawString(name, f_axis, System.Drawing.Brushes.Black, cx - 12, plot.Bottom + 5)
        start += md
    g.DrawLine(pen_month, plot.Right, plot.Top, plot.Right, plot.Bottom)

    y_font  = Font("Segoe UI", 9, FontStyle.Regular)
    sizeF   = g.MeasureString(y_label, y_font)
    g.DrawString(y_label, y_font, System.Drawing.Brushes.Black,
                 max(10, 70 - 60), plot.Top - int(sizeF.Height) - 8)

    g.Dispose()
    return bmp, plot, float(top_val)


tooltip = WinForms.ToolTip()
def attach_hover_tooltip(picture_box, series_getter, plot_rect_getter, top_val_getter, unit_suffix):
    last_idx = [-1]
    def on_move(sender, e):
        try:   series = series_getter() if callable(series_getter) else series_getter
        except: series = None
        if not series: return
        plot = plot_rect_getter()
        topv = top_val_getter()
        if plot.Width <= 0 or plot.Height <= 0 or topv <= 0: return
        x = e.X
        if x < plot.Left or x > plot.Right:
            tooltip.Hide(picture_box); last_idx[0] = -1; return
        n    = len(series)
        frac = float(x - plot.Left) / float(plot.Width)
        idx  = max(0, min(n - 1, int(round(frac * (n - 1)))))
        if idx != last_idx[0]:
            last_idx[0] = idx
            try:    val = float(series[idx])
            except: val = 0.0
            tooltip.Show("{}: {:.3f} {}".format(make_day_label(idx), val, unit_suffix),
                         picture_box, e.Location, 800)
    try:   picture_box.MouseMove -= on_move
    except: pass
    picture_box.MouseMove += on_move


def lighting_load_calculation(_watt_per_luminaire, _number_of_luminire, _area):
    try: a = float(_area)
    except: a = 0.0
    try: w = float(_watt_per_luminaire)
    except: w = 0.0
    try: n = float(_number_of_luminire)
    except: n = 0.0
    if a <= 0: return 0.0
    return (w * n) / a


def _as_total_hours(_hours):
    if _hours is None: return 0.0
    if isinstance(_hours, (list, tuple)):
        s = 0.0
        for h in _hours:
            try: s += float(h)
            except: pass
        return s
    try: return float(_hours)
    except: return 0.0


def annual_energy_calculation(_hours_needed, _watt_per_luminaire, _number_of_luminire):
    H = _as_total_hours(_hours_needed)
    try: lpd = float(_LPD_Wm2)
    except: lpd = 0.0
    return lpd * H


def electricity_cost_calculation(_electricity_cost, _energy_kwh):
    try: c = float(_electricity_cost)
    except: c = 0.0
    try: e = float(_energy_kwh)
    except: e = 0.0
    return c * e


_LPD_Wm2             = lighting_load_calculation(_watt_per_luminaire, _number_of_luminire, _area)
_energy_usage_annual = annual_energy_calculation(_hours_needed, _watt_per_luminaire, _number_of_luminire)
_annual_cost         = electricity_cost_calculation(_electricity_cost, _energy_usage_annual)
_lighting_loads      = _LPD_Wm2
_total_needed_hr     = _as_total_hours(_hours_needed)




# Form
class TopUpForm(Form):
    def __init__(self):
        super(TopUpForm, self).__init__()
        self.Text            = "Kybele Required Lighting Hour"
        self.Width           = 1000
        self.Height          = 1500
        self.StartPosition   = WinForms.FormStartPosition.CenterScreen
        self.BackColor       = Color.White
        # DPI: rescale fonts and layout for the current monitor
        self.AutoScaleMode       = AutoScaleMode.Dpi
        self.AutoScaleDimensions = System.Drawing.SizeF(96.0, 96.0)

        self._title    = ""
        self._req      = 0.0
        self._dli      = []
        self._def      = []
        self._hrs      = []
        self._sidx     = 0
        self._parh     = 0.0
        self._par_miss = False
        self._hours_mode = "24hr"   # "24hr" | "scale"

        # title label
        self.title_lbl = WinForms.Label()
        self.title_lbl.Location  = Point(12, 16)
        self.title_lbl.AutoSize  = True
        self.title_lbl.Font      = Font("Segoe UI", 16)
        self.title_lbl.ForeColor = Color.Gray
        self.title_lbl.BackColor = Color.White
        self.title_lbl.Anchor    = WinForms.AnchorStyles.Top | WinForms.AnchorStyles.Left
        self.Controls.Add(self.title_lbl)

        # outer table layout
        layout = WinForms.TableLayoutPanel()
        layout.Dock        = DockStyle.Fill
        layout.RowCount    = 4
        layout.ColumnCount = 1
        layout.RowStyles.Add(WinForms.RowStyle(WinForms.SizeType.Absolute, 290))  # info labels
        layout.RowStyles.Add(WinForms.RowStyle(WinForms.SizeType.Absolute, 320))  # chart 1 - DLI deficit
        layout.RowStyles.Add(WinForms.RowStyle(WinForms.SizeType.Absolute, 400))  # chart 2 - hours
        layout.RowStyles.Add(WinForms.RowStyle(WinForms.SizeType.Percent,  100))  # table
        self.Controls.Add(layout)

        # p1: info labels 
        p1 = WinForms.FlowLayoutPanel()
        p1.Dock          = DockStyle.Fill
        p1.BackColor     = Color.White
        p1.FlowDirection = WinForms.FlowDirection.TopDown
        p1.WrapContents  = False
        p1.Padding       = WinForms.Padding(12, 62, 12, 4)  # top=62 clears title_lbl
        layout.Controls.Add(p1, 0, 0)
        self._p1 = p1

        self._labels = []
        for _ in range(7):
            lbl = Label()
            lbl.AutoSize = True
            lbl.Font     = Font("Segoe UI", 9, FontStyle.Regular)
            lbl.Margin   = WinForms.Padding(0, 0, 0, 0)   # 2 px gap below each label
            p1.Controls.Add(lbl)
            self._labels.append(lbl)

        # chart 1: DLI deficit
        p2 = Panel(); p2.Dock = DockStyle.Fill
        layout.Controls.Add(p2, 0, 1)
        self.picDef = WinForms.PictureBox()
        self.picDef.Dock     = DockStyle.Fill
        self.picDef.SizeMode = WinForms.PictureBoxSizeMode.Normal
        p2.Controls.Add(self.picDef)
        self.btnSaveDef = Button()
        self.btnSaveDef.Text   = "Save PNG"
        self.btnSaveDef.Height = 30
        self.btnSaveDef.Dock   = DockStyle.Bottom
        self.btnSaveDef.Click += lambda s, e: self._save_png(self.picDef.Image, "DLI_deficit.png")
        p2.Controls.Add(self.btnSaveDef)

        # chart 2: hours needed
        p3 = Panel(); p3.Dock = DockStyle.Fill
        layout.Controls.Add(p3, 0, 2)

        self.picHours = WinForms.PictureBox()
        self.picHours.Dock     = DockStyle.Fill
        self.picHours.SizeMode = WinForms.PictureBoxSizeMode.Normal
        p3.Controls.Add(self.picHours)


        scale_bar = Panel()
        scale_bar.Dock      = DockStyle.Bottom
        scale_bar.Height    = 30           # height button
        scale_bar.BackColor = Color.White
        p3.Controls.Add(scale_bar)

        tbl_scale = WinForms.TableLayoutPanel()
        tbl_scale.Dock        = DockStyle.Fill
        tbl_scale.ColumnCount = 3
        tbl_scale.RowCount    = 1
        tbl_scale.ColumnStyles.Add(WinForms.ColumnStyle(WinForms.SizeType.Percent, 50))   # left  – Scale
        tbl_scale.ColumnStyles.Add(WinForms.ColumnStyle(WinForms.SizeType.Absolute, 4))   # middle gap
        tbl_scale.ColumnStyles.Add(WinForms.ColumnStyle(WinForms.SizeType.Percent, 50))   # right – 24hr Scale
        tbl_scale.BackColor = Color.White
        scale_bar.Controls.Add(tbl_scale)

        def _mk_scale_btn(text):
            b = Button()
            b.Text      = text
            b.Dock      = DockStyle.Fill   # fills table cell
            b.FlatStyle = FlatStyle.Flat
            b.FlatAppearance.BorderColor = Color.FromArgb(180, 180, 180)
            b.BackColor  = Color.White
            b.ForeColor  = Color.FromArgb(50, 50, 50)
            b.Font       = Font("Segoe UI", 9)
            b.Margin     = WinForms.Padding(0)
            return b

        self.btnScale = _mk_scale_btn("Scale")
        self.btn24hr  = _mk_scale_btn("24hr Scale")
        tbl_scale.Controls.Add(self.btnScale, 0, 0)
        tbl_scale.Controls.Add(self.btn24hr,  2, 0)

        # Save PNG
        self.btnSaveHours = Button()
        self.btnSaveHours.Text   = "Save PNG"
        self.btnSaveHours.Height = 30
        self.btnSaveHours.Dock   = DockStyle.Bottom
        self.btnSaveHours.Click += lambda s, e: self._save_png(
            self.picHours.Image, "Hours_needed.png")
        p3.Controls.Add(self.btnSaveHours)

        def _set_active(active_btn, inactive_btn):
            active_btn.BackColor   = Color.FromArgb(160, 160, 160)
            active_btn.ForeColor   = Color.White
            inactive_btn.BackColor = Color.White
            inactive_btn.ForeColor = Color.FromArgb(50, 50, 50)

        def on_scale(s, e):
            self._hours_mode = "scale"
            _set_active(self.btnScale, self.btn24hr)
            self.refresh_all()

        def on_24hr(s, e):
            self._hours_mode = "24hr"
            _set_active(self.btn24hr, self.btnScale)
            self.refresh_all()

        self.btnScale.Click += on_scale
        self.btn24hr.Click  += on_24hr
        _set_active(self.btn24hr, self.btnScale)   # 24hr active default

        # table
        p4 = Panel(); p4.Dock = DockStyle.Fill
        layout.Controls.Add(p4, 0, 3)

        self.dgv = DataGridView()
        self.dgv.Dock                   = DockStyle.Fill
        self.dgv.AllowUserToAddRows     = False
        self.dgv.SelectionMode          = DataGridViewSelectionMode.FullRowSelect
        self.dgv.AutoSizeColumnsMode    = DataGridViewAutoSizeColumnsMode.Fill
        self.dgv.RowHeadersVisible      = False
        self.dgv.EnableHeadersVisualStyles = False
        self.dgv.CellBorderStyle        = WinForms.DataGridViewCellBorderStyle.SingleHorizontal
        self.dgv.GridColor              = Color.LightGray

        grey_sel = Color.FromArgb(220, 220, 220)
        for style in [self.dgv.DefaultCellStyle,
                      self.dgv.RowsDefaultCellStyle,
                      self.dgv.AlternatingRowsDefaultCellStyle]:
            style.SelectionBackColor = grey_sel
            style.SelectionForeColor = Color.Black

        self._hdr_bg     = Color.FromArgb(240, 240, 240)
        self._hdr_sel_bg = Color.FromArgb(220, 220, 220)
        self._hdr_fg     = Color.Black

        for col in [("Day","Day"), ("CalcDLI","Calculated_DLI"), ("ReqDLI","Required_DLI"),
                    ("Deficit","DLI_Deficit"), ("Hours","Hours_Needed")]:
            self.dgv.Columns.Add(col[0], col[1])

        p4.Controls.Add(self.dgv)

        self.btnSaveCSV = Button()
        self.btnSaveCSV.Text   = "Save CSV"
        self.btnSaveCSV.Height = 30
        self.btnSaveCSV.Dock   = DockStyle.Bottom
        self.btnSaveCSV.Click += lambda s, e: self._save_csv("DLI_TopUp_Table.csv")
        p4.Controls.Add(self.btnSaveCSV)




        # custom header paint
        def handle_header_paint(sender, e):
            if e.RowIndex == -1 and e.ColumnIndex >= 0:
                e.PaintBackground(e.ClipBounds, False)
                bg = self._hdr_sel_bg if (e.State & WinForms.DataGridViewElementStates.Selected) != 0 else self._hdr_bg
                e.Graphics.FillRectangle(SolidBrush(bg), e.CellBounds)
                fmt = StringFormat()
                fmt.Alignment     = StringAlignment.Near
                fmt.LineAlignment = StringAlignment.Center
                text_rect = System.Drawing.Rectangle(e.CellBounds.X + 6, e.CellBounds.Y,
                                                     e.CellBounds.Width - 6, e.CellBounds.Height)
                e.Graphics.DrawString(sender.Columns[e.ColumnIndex].HeaderText,
                                      Font("Segoe UI", 10, FontStyle.Bold),
                                      SolidBrush(self._hdr_fg), text_rect, fmt)
                e.Graphics.DrawLine(System.Drawing.Pens.LightGray,
                                    e.CellBounds.Left,  e.CellBounds.Bottom - 1,
                                    e.CellBounds.Right, e.CellBounds.Bottom - 1)
                e.Handled = True

        self.dgv.CellPainting          += handle_header_paint
        self.dgv.SelectionChanged       += (lambda *_: self.dgv.Invalidate())
        self.dgv.ColumnHeaderMouseClick += (lambda *_: self.dgv.Invalidate())

        self._plot_rects = [Rectangle(0,0,0,0), Rectangle(0,0,0,0)]
        self._top_vals   = [1.0, 1.0]
        self.Resize      += (lambda *_: self.refresh_all())

        attach_hover_tooltip(self.picDef,   lambda: self._def or [], lambda: self._plot_rects[0], lambda: self._top_vals[0], "mol·m⁻²·day⁻¹")
        attach_hover_tooltip(self.picHours, lambda: self._hrs or [], lambda: self._plot_rects[1], lambda: self._top_vals[1], "h")




    # push new data 
    def set_data(self, title, req, dli_list, dli_deficit, hours_needed,
                 sensor_idx, par_hourly, par_missing=False):
        self._title    = title
        self._req      = float(req)
        self._dli      = list(dli_list    or [])
        self._def      = list(dli_deficit or [])
        self._hrs      = list(hours_needed or [])
        self._sidx     = int(sensor_idx)
        self._parh     = float(par_hourly)
        self._par_miss = par_missing
        self._apply_labels()
        self._rebuild_table()
        self.refresh_all()

        if par_missing:
            WinForms.MessageBox.Show(
                "No values for supplemental lights.\n\n"
                "Please connect a valid _PAR_electric list.\n"
                "Hours needed will show as zero until a value is supplied.",
                "Missing PAR Data",
                WinForms.MessageBoxButtons.OK,
                WinForms.MessageBoxIcon.Warning
            )



    # labels
    def _apply_labels(self):
        self.title_lbl.Text = self._title
        if self._par_miss:
            par_str = "No input values for electric light"
        else:
            par_str = "{:.4f} mol·m⁻²·h⁻¹".format(self._parh)
        items = [
            "Required DLI: {:.2f} mol·m⁻²·day⁻¹".format(self._req),
            "Number of Days with Insufficient DLI: {}".format(sum(1 for x in self._def if x > 0)),
            "Total number of needed electric lighting hours: {:.1f} h".format(sum(self._hrs)),
            "Sensor index: {}   |   Electric Source PAR: {}".format(self._sidx, par_str),
            "Annual Energy Usage: {:.2f} Wh·m⁻²".format(_energy_usage_annual),
            "Annual Electricity Cost: {:.2f} USD".format(_annual_cost),
            "Lighting Load for Energy Calculation: {} W·m⁻²".format(_LPD_Wm2),
        ]
        for i, (lbl, txt) in enumerate(zip(self._labels, items)):
            lbl.Text = txt
            if i == 3:
                lbl.ForeColor = Color.FromArgb(200, 40, 40) if self._par_miss \
                                else Color.FromArgb(30, 30, 30)
            else:
                lbl.ForeColor = Color.FromArgb(30, 30, 30)



    # table
    def _rebuild_table(self):
        self.dgv.Rows.Clear()
        n = max(len(self._dli), len(self._def), len(self._hrs))
        for i in range(n):
            cD = float(self._dli[i]) if i < len(self._dli) else 0.0
            dD = float(self._def[i]) if i < len(self._def) else 0.0
            hN = float(self._hrs[i]) if i < len(self._hrs) else 0.0
            self.dgv.Rows.Add(make_day_label(i),
                              "{:.3f}".format(cD), "{:.3f}".format(self._req),
                              "{:.3f}".format(dD), "{:.3f}".format(hN))



    # charts
    def refresh_all(self):
        w1 = max(400, self.picDef.ClientSize.Width)
        h1 = max(220, self.picDef.ClientSize.Height   - self.btnSaveDef.Height)
        w2 = max(400, self.picHours.ClientSize.Width)
        h2 = max(220, self.picHours.ClientSize.Height)

        tcolor = Color.DimGray; tpad = 90

        bmp1, plot1, top1 = chart_bitmap(
            self._def, "DLI Deficiency per Day",
            "DLI Deficiency (mol·m⁻²·day⁻¹)",
            w1, h1, kind="line",
            title_font="Segoe UI", title_size=10, title_bold=False,
            title_color=tcolor, title_align="left",
            pad_top=tpad, title_padding_top=12)
        self.picDef.Image    = bmp1
        self._plot_rects[0]  = plot1
        self._top_vals[0]    = top1

        raw_max_hours = max(self._hrs) if self._hrs else 0.0

        if self._hours_mode == "scale":
            # Axis scaled to data range
            top_hours = raw_max_hours if raw_max_hours > 0 else 1.0
            hline     = None 

        else:  
            top_hours = raw_max_hours if raw_max_hours > 24.0 else 24.0
            hline     = 24.0 if raw_max_hours > 24.0 else None

        bmp2, plot2, top2 = chart_bitmap(
            self._hrs, "Supplemental Lighting Period (hours/day)",
            "Hours (h)",
            w2, h2, kind="bar",
            fixed_top_val=top_hours, tick_count=8,
            title_font="Segoe UI", title_size=10, title_bold=False,
            title_color=tcolor, title_align="left",
            pad_top=tpad, title_padding_top=12,
            hline_at=hline)
        self.picHours.Image  = bmp2
        self._plot_rects[1]  = plot2
        self._top_vals[1]    = top2



    # save PNG
    def _save_png(self, bmp, suggested_name):
        if bmp is None: return
        dlg = SaveFileDialog()
        dlg.Title    = "Save chart as PNG"
        dlg.Filter   = "PNG Image (*.png)|*.png"
        dlg.FileName = suggested_name
        if dlg.ShowDialog() == WinForms.DialogResult.OK:
            bmp.Save(dlg.FileName, System.Drawing.Imaging.ImageFormat.Png)
            WinForms.MessageBox.Show(
                "Successfully saved to:\n{}".format(dlg.FileName),
                "Saved",
                WinForms.MessageBoxButtons.OK,
                WinForms.MessageBoxIcon.Information)



    # save CSV
    def _save_csv(self, suggested_name):
        dlg = SaveFileDialog()
        dlg.Title    = "Save table as CSV"
        dlg.Filter   = "CSV (*.csv)|*.csv"
        dlg.FileName = suggested_name
        if dlg.ShowDialog() != WinForms.DialogResult.OK: return
        try:
            try: self.dgv.EndEdit()
            except: pass
            from System.Text import StringBuilder
            sb      = StringBuilder()
            headers = [self.dgv.Columns[c].HeaderText for c in range(self.dgv.ColumnCount)]
            sb.AppendLine(",".join(headers))
            row_count = self.dgv.RowCount
            if getattr(self.dgv, "AllowUserToAddRows", False):
                row_count = max(0, row_count - 1)
            for r in range(row_count):
                cells = []
                for c in range(self.dgv.ColumnCount):
                    try:    val = self.dgv.Rows[r].Cells[c].FormattedValue
                    except: val = self.dgv.Rows[r].Cells[c].Value
                    s = "" if val is None else str(val)
                    if any(ch in s for ch in [",", "\"", "\n", "\r"]):
                        s = '"' + s.replace('"', '""') + '"'
                    cells.append(s)
                sb.AppendLine(",".join(cells))
            File.WriteAllText(dlg.FileName, sb.ToString())
            WinForms.MessageBox.Show(
                "Successfully saved to:\n{}".format(dlg.FileName),
                "Saved",
                WinForms.MessageBoxButtons.OK,
                WinForms.MessageBoxIcon.Information)
        except Exception as ex:
            WinForms.MessageBox.Show("Failed to save CSV:\n{}".format(ex), "Error")



# Grasshopper
KEY_FORM = "kybele_topup_form_instance_live"

def get_or_create_form():
    frm = sc.sticky.get(KEY_FORM, None)
    if frm is None or frm.IsDisposed:
        frm = TopUpForm()
        sc.sticky[KEY_FORM] = frm
    return frm

def close_existing_form():
    frm = sc.sticky.get(KEY_FORM, None)
    if frm and not frm.IsDisposed:
        try: frm.Close()
        except: pass
    sc.sticky[KEY_FORM] = None

def on_form_closed(sender, args):
    sc.sticky[KEY_FORM] = None

if bool(_run):
    form = get_or_create_form()
    if not form.Visible:
        form.FormClosed += on_form_closed
        form.Show()
    try:
        form.set_data(Title, required_DLI, calculated_DLI,
                      _DLI_deficit, _hours_needed,
                      sensor_index, par_electric_hourly,
                      par_missing=_par_missing)
    except Exception as e:
        WinForms.MessageBox.Show("Unable to update form:\n{}".format(e), "Error")
else:
    close_existing_form()
# ---------- end python_3_script_31 ----------
panel_56 = Panel(python_3_script_31.DLI_deficit)
panel_57 = Panel(python_3_script_31.hours_needed)
panel_58 = Panel(python_3_script_31.total_needed_hr)
panel_59 = Panel(python_3_script_31.lighting_loads)
panel_60 = Panel(python_3_script_31.energy_usage_annual)
panel_61 = Panel(python_3_script_31.annual_cost)

python_3_script_32 = Python3Script(
    hours_needed=python_3_script_31.hours_needed,
    area=area_2,
    number_of_luminaires=number_of_luminaires,
    watt_per_luminaire=number_slider_11)  # -> out, monthly_lighting_energy, total_lighting_energy, lighting_energy_per_area; inputs hours_needed: list
# ---------- python_3_script_32: Python ----------
ghenv.Component.Message = """Kybele 0.1 Beta
Monthly Lighting Energy"""


month_days = [31, 28, 31, 30, 31,30, 31, 31, 30, 31, 30, 31]


# KWh Calculation
def each_kwh(watt, count, hour):
    calculated_kwh = (watt * count * hour)/1000
    return calculated_kwh


# Daily Lighting Energy
try:
    kwh_list = []
    for i in _hours_needed:
        kwh_value = each_kwh(_watt_per_luminaire, _number_of_luminaires, i)
        kwh_value_per_area = kwh_value/ _area
        kwh_list.append(kwh_value_per_area)
except Exception as e:
    print("Error computing daily values:", e)



# Monthly Lighting Energy
try:
    monthly_list = []
    running_day_index = 0
    for i in range(12):
        if running_day_index == 0:
            start_index = 0
            end_index = month_days[0]
            running_day_index = 31-1
        else:
            start_index = running_day_index + 1
            end_index = start_index + month_days[i]
            running_day_index =+ running_day_index + month_days[i]


        monthly_total = 0
        for j in range(start_index, end_index):
            monthly_total += kwh_list[j]
        monthly_list.append(round(monthly_total, 3))
    print(monthly_list)
    _monthly_lighting_energy = monthly_list
except Exception as e:
    print("Error computing monthly values:", e)


try:
    _lighting_energy_per_area = sum(_monthly_lighting_energy)
    _total_lighting_energy = _lighting_energy_per_area * _area
except Exception as e:
    print("Error computing total values:", e)
# ---------- end python_3_script_32 ----------
# Lighting Energy Export
# _monthly_lighting_energy component must be internalised
# from the lighting portion of the workflow. If the panel shows
# blank list, internalise in the lighting file and paste inside the
# thermal file.
panel_62 = Panel(python_3_script_32.monthly_lighting_energy)
panel_63 = Panel(python_3_script_32.total_lighting_energy)
panel_64 = Panel(python_3_script_32.lighting_energy_per_area)
monthly_lighting_energy = Data(python_3_script_32.monthly_lighting_energy)
panel_65 = Panel(monthly_lighting_energy)
